# Grasshopper definition GridShell Geometry.gh (Grasshopper 1.0.7)
# plug-ins: LunchBox, Karamba3D, Telepathy, Heteroptera

number_slider = Slider(80, range=0..1000)
number_slider_2 = Slider(40, range=0..1000)
dom = ConstructDomain(DomainStart=expr("x/2", number_slider), DomainEnd=expr("-x/2", number_slider))
dom_2 = ConstructDomain(DomainStart=expr("x/2", number_slider_2), DomainEnd=expr("-x/2", number_slider_2))
rectangle = Rectangle(Plane=PlaneXY(0, 0, 0), XSize=dom_2, YSize=dom, Radius=0)  # -> Rectangle, Length
trib = TrianglePanelsB(Surface=reparameterize(rectangle.Rectangle), UDivisions=Slider(20, range=0..100), VDivisions=Slider(34, range=0..100))
debrep = DeconstructBrep(Brep=trib)  # -> Faces, Edges, Vertices
xy = XYPlane(Origin=Point(0, 0, 0))
trim = TrimWithRegion(Curve=debrep.Edges, Region=rectangle.Rectangle, Plane=xy)  # -> Inside, Outside
crv = Curve(flatten(trim.Inside))
end = EndPoints(Curve=crv)  # -> Start, End
merge = Merge(Data1=end.Start, Data2=end.End)
explode = Explode(Curve=rectangle.Rectangle, Recursive=True)  # -> Segments, Vertices
cullpt = CullDuplicates(Points=merge, Tolerance=0.1, CullMode=1)  # -> Points, Indices, Valence
item = ListItem(List=explode.Segments, Index=0, Wrap=True)  # -> Item, Item1, Item2, Item3
crv_2 = Curve([item.Item1, item.Item3])
crv_cp = CurveClosestPoint(Point=cullpt.Points, Curve=graft(crv_2))  # -> Point, Parameter, Distance
flip = FlipMatrix(Data=crv_cp.Distance)
extremums = MinMax(Number=flip)  # -> flatten(Minimum), Maximum
smaller = SmallerThan(FirstNumber=extremums.Minimum, SecondNumber=Slider(0.13744, range=0..1))  # -> SmallerThan, OrEqualTo
dispatch = Dispatch(List=cullpt.Points, DispatchPattern=smaller.OrEqualTo)  # -> ListA, ListB
supports = RemoteSender(dispatch.ListA)
matselect = MaterialSelectionKaramba3D(menu=[dropdown(5), dropdown(1)])
number_slider_3 = Slider(100, range=0..100)
end_2 = EndPoints(Curve=crv)  # -> Start, End
merge_2 = Merge(Data1=end_2.Start, Data2=end_2.End)
supports_2 = RemoteReceiver(supports)
ln = Line(StartPoint=end_2.Start, EndPoint=end_2.End)
cull_curves = CullCurvesKaramba3D(Curves=ln, LimitDistance=0.05, NumberOfSamplePoints=3)
panel = Panel(ln)
cross_section = CrossSectionKaramba3D(
    FamilyNameOfCrossSection="DefaultCroSec",
    Material=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,
    Height_cm=number_slider_3,
    UpperFlangeWidth_cm=number_slider_3,
    LowerFlangeWidth_cm=number_slider_3,
    mode="Trapezoid")
cullpt_2 = CullDuplicates(Points=merge_2, Tolerance=0.1, CullMode=1)  # -> Points, Indices, Valence
cp = ClosestPoint(Point=supports_2, Cloud=cullpt_2.Points)  # -> ClosestPoint, CPIndex, Distance
linetobeam = LineToBeamKaramba3D(
    Line=cull_curves,
    CrossSection=cross_section,
    New=True,
    Remove=True,
    LimitDistance_m=0.005,
    Bending=True,
    SetBucklingLength=True,
    ToPolylineMaxAngle=0.03,
    ToPolylineTolerance=0.01,
    ToPolylineMinEdgeLength=0.25)  # -> Element, Points, Info
joint_agent = BeamJointAgentKaramba3D(
    ToGeometry=cullpt_2.Points,
    Ct_kN_m=Vector(0, 0, 0),
    Cr_kNm_rad=Vector(0, 0, 0),
    menu=[buttons(off, off, off, off, off, off)])
supp = SupportKaramba3D(PosInd=cp.ClosestPoint, menu=[buttons(on, on, on, off, off, off)])
Z = UnitZ(Factor=Slider(70, range=0..1000))
loads = LoadsKaramba3D(Vector=Z, LCase="0", mode="Gravity")
assemble = AssembleModelKaramba3D(Elem=flatten(linetobeam.Element), Support=flatten(supp), Load=loads, Joint=joint_agent, LimitDistance_m=0.005)  # -> Model, Info, Mass_kg, CenterOfGravity, LoadCaseNames
ladeform = LargeDeformationAnalysisKaramba3D(Model=assemble.Model, Increments=5, MaximumDisplacement_m=-1)  # -> CalculatedModel, MaximumDisplacement_cm
ladeform_2 = LargeDeformationAnalysisKaramba3D(Model=assemble.Model, Increments=Slider(5, range=0..100), MaximumDisplacement_m=-1)  # -> CalculatedModel, MaximumDisplacement_cm
modelview = ModelViewKaramba3D(Model=ladeform.CalculatedModel, ResultFactors=1, ResultCase=-1)  # -> Model, DeformedMesh, DeformedAxes, DeformedModel
firstdeformation = RemoteSender(modelview.DeformedAxes)
