# Grasshopper definition Mapping geometry to found node.gh (Grasshopper 1.0.7)
# plug-ins: Wombat, Karamba3D, treesloth01, Heteroptera, Pufferfish, Human

grid_curves = Curve()
new_curves = Curve()
midpt = CurveMiddle(Curve=grid_curves)
rdlines = RemoveDuplicateLinesKaramba3D(Line=new_curves, LimitDistance=0.005)  # -> OutLine, Info, Indexes
mp = Midpoint(Curve=rdlines.OutLine)
cp = ClosestPoint(Point=graft(mp), Cloud=midpt)  # -> ClosestPoint, flatten(CPIndex), Distance
closeness_need = Slider(1, range=0..1)
cull_i = CullIndex(List=grid_curves, Indices=cp.CPIndex, Wrap=True)
extremums = MinMax(Number=flatten(cp.Distance))  # -> Minimum, Maximum
larger = LargerThan(FirstNumber=extremums.Maximum, SecondNumber=closeness_need)  # -> LargerThan, OrEqualTo
end = EndPoints(Curve=rdlines.OutLine)  # -> Start, End
tolerance_for_end_node_placement = Slider(0.4, range=0..1)
merge = Merge(Data1=end.Start, Data2=end.End)
pdecon = Deconstruct(Point=merge)  # -> XComponent, YComponent, ZComponent
extremums_2 = MinMax(Number=pdecon.ZComponent)  # -> Minimum, Maximum
filter = StreamFilter(Gate=larger.LargerThan, Stream0=cull_i)
equalst = EqualityWithinTolerance(FirstNumber=pdecon.ZComponent, SecondNumber=extremums_2.Maximum, Tolerance=tolerance_for_end_node_placement)  # -> Equality, Inequality
end_2 = EndPoints(Curve=graft(filter))  # -> Start, End
dispatch = DispatchUnweave(Data=merge, Pattern=equalst.Equality)  # -> Out00, Out01, Out02
merge_2 = Merge(Data1=end_2.Start, Data2=end_2.End)
distance_between_point_and_node = Slider(1, range=0..1)
geo = Geometry(dispatch.Out01)
pdecon_2 = Deconstruct(Point=merge_2)  # -> XComponent, YComponent, ZComponent
cullpt = CullDuplicates(Points=geo, Tolerance=0.1, CullMode=1)  # -> Points, Indices, Valence
subtraction = Subtraction(A=pdecon_2.ZComponent, B=extremums_2.Maximum)
abs = Absolute(Value=subtraction)
first_last = FirstLast(List=abs)  # -> FirstValue, LastValue
min = Minimum(A=first_last.FirstValue, B=first_last.LastValue)
mindex = MemberIndex(Set=abs, Member=min)  # -> Index, Count
item = ListItem(List=merge_2, Index=mindex.Index, Wrap=True)
pdecon_3 = Deconstruct(Point=item)  # -> XComponent, YComponent, ZComponent
abs_2 = Absolute(Value=pdecon_3.YComponent)
first_last_2 = FirstLast(List=abs_2)  # -> FirstValue, LastValue
cull_i_2 = CullIndex(List=merge_2, Indices=mindex.Index, Wrap=True)
min_2 = Minimum(A=first_last_2.FirstValue, B=first_last_2.LastValue)
mindex_2 = MemberIndex(Set=abs_2, Member=min_2)  # -> Index, Count
cull_i_3 = CullIndex(List=item, Indices=mindex_2.Index, Wrap=True)
item_2 = ListItem(List=item, Index=mindex_2.Index, Wrap=True)
dist = Distance(PointA=graft(cullpt.Points), PointB=flatten(item_2))
lng = ListLength(List=dist)
series = Series(Start=0, Step=1, Count=lng)
cp_2 = ClosestPoint(Point=flatten(item_2), Cloud=graft(cullpt.Points))  # -> ClosestPoint, flatten(CPIndex), Distance
smaller = SmallerThan(FirstNumber=dist, SecondNumber=Slider(1.5, range=0..10))  # -> SmallerThan, OrEqualTo
dispatch_2 = Dispatch(List=series, DispatchPattern=smaller.SmallerThan)  # -> ListA, ListB
tstat = TreeStatistics(Tree=item_2)  # -> Paths, Length, Count
lng_2 = ListLength(List=dispatch_2.ListA)
cull_i_4 = CullIndex(List=tstat.Paths, Indices=flatten(dispatch_2.ListA), Wrap=True)
repeat = RepeatData(Data=graft(cullpt.Points), Length=lng_2)
sort = SortList(Keys=flatten(cp_2.CPIndex), ValuesA=flatten(cp_2.ClosestPoint))  # -> Keys, ValuesA
merge_3 = Merge(Data1=cull_i_3, Data2=cull_i_2)
item_3 = ListItem(List=tstat.Paths, Index=flatten(dispatch_2.ListA), Wrap=True)
branch = TreeBranch(Tree=item_2, Path=cull_i_4, MaintainPaths=True)
sort_2 = SortList(Keys=flatten(dispatch_2.ListA), ValuesA=flatten(repeat))  # -> Keys, ValuesA
branch_2 = TreeBranch(Tree=item_2, Path=item_3, MaintainPaths=True)
clone = CloneStructure(List=sort_2.ValuesA, Structure=branch_2)
merge_4 = Merge(Data1=simplify(branch), Data2=simplify(merge_3), Data3=simplify(clone))
pline = PolyLine(Vertices=merge_4, Closed=False)
merge_5 = Merge(Data1=flatten(pline), Data2=flatten(rdlines.OutLine))
mp_2 = Midpoint(Curve=merge_5)
pdecon_4 = Deconstruct(Point=mp_2)  # -> XComponent, YComponent, ZComponent
sort_3 = SortList(Keys=pdecon_4.XComponent, ValuesA=merge_5)  # -> Keys, ValuesA
pt = ConstructPoint(XCoordinate=sort_3.Keys, YCoordinate=0, ZCoordinate=0)
cullpt_2 = CullDuplicates(Points=pt, Tolerance=Slider(1, range=0..1), CullMode=1)  # -> Points, Indices, Valence
merge_6 = Merge(
    Data1=Slider(17, range=0..100),
    Data2=Slider(36, range=0..100),
    Data3=Slider(18, range=0..100),
    Data4=Slider(36, range=0..100))
repeat_2 = RepeatData(Data=merge_6, Length=Slider(29, range=0..100))
partition = PartitionList(List=sort_3.ValuesA, Size=repeat_2)
mp_3 = Midpoint(Curve=partition)
pdecon_5 = Deconstruct(Point=mp_3)  # -> XComponent, YComponent, ZComponent
sort_4 = SortList(Keys=pdecon_5.YComponent, ValuesA=partition)  # -> Keys, reverse(ValuesA)
end_3 = EndPoints(Curve=flatten(sort_4.ValuesA))  # -> Start, End
tstat_2 = TreeStatistics(Tree=sort_4.ValuesA)  # -> Paths, Length, Count
merge_7 = Merge(Data1=Slider(4, range=0..10), Data2=Slider(3, range=0..10))
item_4 = ListItem(List=tstat_2.Paths, Index=merge_7, Wrap=True)
merge_8 = Merge(Data1=end_3.Start, Data2=end_3.End)
branch_3 = TreeBranch(Tree=sort_4.ValuesA, Path=item_4, MaintainPaths=True)
cullpt_3 = CullDuplicates(Points=merge_8, Tolerance=0.1, CullMode=1)  # -> Points, Indices, Valence
swatch = ColourSwatch(SwatchColor=RGB(93, 94, 42))
new_lines = Line(branch_3)
del = DelaunayMesh(Points=cullpt_3.Points, Plane=PlaneXY(0, 0, 0))
new_shell = Mesh(del)
previewlw = CustomPreviewLineweights(Geometry=branch_3, Shader=ColourSwatch(SwatchColor=RGB(203, 207, 91)), Thickness=Slider(2, range=0..10), Absolute=False)
