# Grasshopper definition 120812_study.gh (Grasshopper 1.0.7)
# plug-ins: Heteroptera, LunchBox, Kangaroo2 Components, Wombat, Human, LunchBoxML, Telepathy, Karamba3D, Pufferfish, oneNode, Wallacei, treesloth01

genes = GenePool(Decimals=2, Maximum=10, Minimum=-10, Value=[-0.64, -1.61, -3.1, 0.2])
genes_2 = GenePool(Decimals=2, Maximum=30, Minimum=0, Value=[11.39, 15.89, 24.37, 23.5])
genes_3 = GenePool(Decimals=2, Maximum=30, Minimum=0, Value=[20.03, 0, 18.65, 21.08])
genes_4 = GenePool(Decimals=2, Maximum=30, Minimum=0, Value=[13.32, 10.63, 0, 16.45])
genes_5 = GenePool(Decimals=2, Maximum=10, Minimum=0, Value=[2.320153264, 0.7751483804, 0.7368194697, 6.820038672])
genes_6 = GenePool(Decimals=2, Maximum=10, Minimum=0, Value=[7.82, 1.63, 1.125, 3.51])
merge = Merge(
    Data1=Slider(18.49, range=0..100),
    Data2=Slider(58.95, range=0..100),
    Data3=Slider(46.01, range=0..100),
    Data4=Slider(47.54, range=0..100))
merge_2 = Merge(
    Data1=Slider(20.46, range=0..100),
    Data2=Slider(36.63, range=0..100),
    Data3=Slider(74.44, range=0..100),
    Data4=Slider(39.81, range=0..100))
merge_3 = Merge(
    Data1=Slider(-2.666, range=-10..10),
    Data2=Slider(3.071, range=-10..10),
    Data3=Slider(-2.025, range=-10..10),
    Data4=Slider(-1.023, range=-10..10))
merge_4 = Merge(
    Data1=Slider(-2.739, range=-10..10),
    Data2=Slider(0.7, range=-10..10),
    Data3=Slider(-1.149, range=-10..10),
    Data4=Slider(-2.184, range=-10..10))
galapagos = Galapagos(fitness=extremums_16, gene=[genes_2, genes])
_2n = TwoNode()  # -> LinesOut, Cost
number_slider = Slider(0, range=0..10)
crv = Curve([<curve referenced from the Rhino model> x6])
comp = Compound()
galapagos_2 = Galapagos(fitness=extremums, gene=[genes_4, genes_3, genes_5, genes_6])
previewlw = CustomPreviewLineweights(Shader=ColourSwatch(SwatchColor=RGB(255, 157, 0)), Thickness=Slider(2.3, range=0..10), Absolute=False)
xy = XYPlane(Origin=Point(0, 0, 0))
extremums = MinMax()  # -> Minimum, Maximum
crv_2 = Curve([<curve referenced from the Rhino model> x6])
panel = Panel(extremums.Maximum)
item = ListItem(List=crv, Index=0, Wrap=True)  # -> Item, Item1
vrot = Rotate()
theta2 = Slider(58.089, range=0..100)
theta2_2 = Slider(0, range=0..100)
galapagos_3 = Galapagos()
theta42 = Slider(70.719, range=0..100)
_1 = Point(Point(-9.923564505, -1.739795298, 0))
_2 = Point(Point(-15.78193329, -5.216678553, 0))
_3 = Point(Point(-9.929961951, 5.215808845, 0))
_4 = Point(Point(-15.69657054, 1.739015713, 0))
plx = LinePlane()  # -> Point, ParamL, ParamP
panel_2 = Panel("single")
avr = Average(Input=[_1, _2])
theta42_2 = Slider(58.009, range=0..100)
merge_5 = Merge(Data1=_1, Data2=_2, Data3=_3, Data4=_4)
theta2_3 = Slider(59.964, range=0..100)
pln = Plane(Plane(origin=(-19.78193329, -5.216678553, -1.492401758e-09), x=(0, -0.9751784674, 0.2214203171), y=(1, 0, 0)))
plfit = PlaneFit(Points=flatten([_1, _2, avr]))  # -> Plane, Deviation
xy_2 = XYPlane(Origin=Point(0, 0, 0))
pln_2 = Plane(Plane(origin=(-19.69657054, 5.709334014, -0.4863872811), x=(0, -0.9925795753, 0.1215968203), y=(1, 0, 0)))
pl_origin = PlaneOrigin(Base=pln, Origin=_2)
xy_3 = XYPlane(Origin=_4)
xy_4 = XYPlane(Origin=Point(0, 0, 0))
galapagos_4 = Galapagos(fitness=addition_6, gene=[theta2, theta42, theta2_3, theta42_2])
othernodes = CSharpScript(p=merge_5, theta2=theta2, theta42=theta42)  # -> out, originalLines, changedLines, pOut, finalAngles; inputs p: list of Point3d, theta2: Double, theta42: Double
# ---------- othernodes: C# ----------
    List<Line> holderOriginalLines = new List<Line>();
    holderOriginalLines.Add(new Line(p[2], p[3]));
    holderOriginalLines.Add(new Line(p[1], p[3]));
    holderOriginalLines.Add(new Line(p[2], p[0]));
    holderOriginalLines.Add(new Line(p[0], p[3]));
    holderOriginalLines.Add(new Line(p[0], p[1]));

    double x2 = (p[1] - p[3])[0];
    double y2 = (p[1] - p[3])[1];
    double x3 = (p[2] - p[3])[0];
    double y3 = (p[2] - p[3])[1];

    originalLines = holderOriginalLines;


    double thetaRest = 360 - RhinoMath.ToDegrees(Vector3d.VectorAngle((p[2] - p[3]), (p[1] - p[3])));
    double theta12 = 180 - theta42 - theta2;
    Print(thetaRest.ToString());
    double theta43 = 360 - theta42 - thetaRest;

    theta43 = RhinoMath.ToRadians(theta43);
    theta12 = RhinoMath.ToRadians(theta12);
    theta42 = RhinoMath.ToRadians(theta42);
    theta2 = RhinoMath.ToRadians(theta2);


    double l42 = Math.Sqrt(Math.Pow(x2, 2) + Math.Pow(y2, 2));


    double c1 = Math.Sin(theta2) * l42 / Math.Sin(theta12);
    double c2 = Math.Sin(theta42) * l42 / Math.Sin(theta12);
    double c3 = (Math.Pow(c1, 2) - Math.Pow(c2, 2) + Math.Pow(x2, 2) + Math.Pow(y2, 2)) / (2 * x2);
    double c4 = -y2 / x2;
    double c5 = Math.Pow(c4, 2) + 1;
    double c6 = Math.Pow(c3, 2) - Math.Pow(c1, 2);
    double c7 = c3 * c4 * 2;

    double y = (-c7 + Math.Sqrt(Math.Pow(c7, 2) - (4 * c6 * c5))) / (2 * c5);
    double y_ = (-c7 - Math.Sqrt(Math.Pow(c7, 2) - (4 * c6 * c5))) / (2 * c5);

    double x = c3 - ((y * y2) / (x2));
    double x_ = c3 - ((y_ * y2) / (x2));

    if (x < 0){
      x = x_;
      y = y_;
    }
    double l41 = Math.Sqrt(Math.Pow(x, 2) + Math.Pow(y, 2));
    double l31 = Math.Sqrt(Math.Pow((x - x3), 2) + Math.Pow((y - y3), 2));
    double theta3 = Math.Asin(l41 * Math.Sin(theta43) / l31);
    double theta13 = Math.PI - theta43 - theta3;


    Print(l42.ToString());

    Point3d p1New = new Point3d(p[3].X + x, p[3].Y + y, p[3].Z);

    List<Line> holderChangeLines = new List<Line>();
    holderChangeLines.Add(new Line(p[2], p[3]));
    holderChangeLines.Add(new Line(p[1], p[3]));
    holderChangeLines.Add(new Line(p[2], p1New));
    holderChangeLines.Add(new Line(p1New, p[3]));
    holderChangeLines.Add(new Line(p1New, p[1]));

    List<Point3d> newP = new List<Point3d>();
    newP.Add(p1New);
    newP.Add(p[1]);
    newP.Add(p[2]);
    newP.Add(p[3]);
    pOut = newP;


    changedLines = holderChangeLines;


    List<double> angles = new List<double>();
    angles.Add(RhinoMath.ToDegrees(theta3));
    angles.Add(RhinoMath.ToDegrees(theta13));
    angles.Add(RhinoMath.ToDegrees(theta12));
    angles.Add(RhinoMath.ToDegrees(theta2));
    angles.Add(RhinoMath.ToDegrees(theta42));
    angles.Add(RhinoMath.ToDegrees(theta43));
    finalAngles = angles;
# ---------- othernodes: C# additional code ----------
  /// <summary>
  /// This method will be called once every solution, before any calls to RunScript.
  /// </summary>
  public override void BeforeRunScript()
  { }
  /// <summary>
  /// This method will be called once every solution, after any calls to RunScript.
  /// </summary>
  public override void AfterRunScript()
  { }
# ---------- end othernodes ----------
item_2 = ListItem(List=othernodes.pOut, Index=0, Wrap=True)
srf = Surface(<surface referenced from the Rhino model>)
pl_origin_2 = PlaneOrigin(Base=pln_2, Origin=_4)
_1_2 = Point(Point(-9.94235686, -8.693493565, 0))
_2_2 = Point(Point(-15.6305656, -12.17237538, 0))
_3_2 = Point(item_2)
_4_2 = Point(Point(-15.78193329, -5.216678553, 0))
panel_3 = Panel("""60
59.32
55.75
57.69
58.82
56.6
58.12
57.79
86.12
86.8
90.37
88.43
87.3
89.52
88
88.33""")
deplane = DeconstructPlane(Plane=xy_2)  # -> Origin, XAxis, YAxis, ZAxis
merge_6 = Merge(Data1=xy_4, Data2=pl_origin, Data3=xy_4, Data4=pl_origin_2)
panel_4 = Panel("""12
25""")
merge_7 = Merge(Data1=flatten(_1_2), Data2=flatten(_2_2), Data3=flatten(_3_2), Data4=flatten(_4_2))
da_upper = DynamicAnglesUpper()  # -> oLines, pOut, newLines, aOut, pOutTest, testPL, testLN, ACost, testSP
mp = Midpoint()
panel_5 = Panel(othernodes.finalAngles)
galapagos_5 = Galapagos()
theta2_4 = Slider(37.735, range=0..100)
theta42_3 = Slider(39.584, range=0..100)
pt = Point()
_1_3 = Point(Point(-0.1767338635, -6.947413571, 0))
_2_3 = Point(Point(-2.725951225, -10.42036577, 0))
_3_3 = Point(Point(0, 0, 0))
_4_3 = Point(Point(-2.588061245, -3.47083031, 0))
crv_3 = Curve()
pl = ConstructPlane(Origin=mp, XAxis=Vector(1, 0, 0), YAxis=deplane.ZAxis)
othernodes_2 = CSharpScript(p=merge_7, theta2=theta2_3, theta42=theta42_2)  # -> out, originalLines, changedLines, pOut, finalAngles; inputs p: list of Point3d, theta2: Double, theta42: Double; same code as othernodes
crv_4 = Curve()
line = Line(Line((-15.71670085, 1.732900793, 0), (-11.37873072, -5.025530927, 0.9061191745)))
pln_3 = Plane()
crv_5 = Curve()
pln_4 = Plane()
merge_8 = Merge(Data1=_1_3, Data2=_2_3, Data3=_3_3, Data4=_4_3)
theta2_5 = Slider(53.127, range=0..100)
theta42_4 = Slider(90.598, range=0..100)
panel_6 = Panel(othernodes_2.finalAngles)
plx_2 = LinePlane(Line=line)  # -> Point, ParamL, ParamP
previewlw_2 = CustomPreviewLineweights(
    Geometry=othernodes.originalLines,
    Shader=ColourSwatch(SwatchColor=RGB(0, 238, 255)),
    Thickness=Slider(5.65, range=0..10),
    Absolute=False)
previewlw_3 = CustomPreviewLineweights(
    Geometry=othernodes.changedLines,
    Shader=ColourSwatch(SwatchColor=RGB(255, 85, 0)),
    Thickness=Slider(5.65, range=0..10),
    Absolute=False)
othernodes_3 = CSharpScript(p=merge_8, theta2=theta2_4, theta42=theta42_3)  # -> out, originalLines, changedLines, pOut, finalAngles; inputs p: list of Point3d, theta2: Double, theta42: Double
# ---------- othernodes_3: C# ----------
    List<Line> holderOriginalLines = new List<Line>();
    holderOriginalLines.Add(new Line(p[2], p[3]));
    holderOriginalLines.Add(new Line(p[1], p[3]));
    holderOriginalLines.Add(new Line(p[2], p[0]));
    holderOriginalLines.Add(new Line(p[0], p[3]));
    holderOriginalLines.Add(new Line(p[0], p[1]));

    double x2 = (p[1] - p[3])[0];
    double y2 = (p[1] - p[3])[1];
    double x3 = (p[2] - p[3])[0];
    double y3 = (p[2] - p[3])[1];

    originalLines = holderOriginalLines;


    double thetaRest = RhinoMath.ToDegrees(Vector3d.VectorAngle((p[2] - p[3]), (p[1] - p[3])));
    double theta12 = 180 - theta42 - theta2;
    double theta43 = 360 - theta42 - thetaRest;
    
    theta43 = RhinoMath.ToRadians(theta43);
    theta12 = RhinoMath.ToRadians(theta12);
    theta42 = RhinoMath.ToRadians(theta42);
    theta2 = RhinoMath.ToRadians(theta2);


    double l42 = Math.Sqrt(Math.Pow(x2, 2) + Math.Pow(y2, 2));
    

    double c1 = Math.Sin(theta2) * l42 / Math.Sin(theta12);
    double c2 = Math.Sin(theta42) * l42 / Math.Sin(theta12);
    double c3 = (Math.Pow(c1, 2) - Math.Pow(c2, 2) + Math.Pow(x2, 2) + Math.Pow(y2, 2)) / (2 * x2);
    double c4 = -y2 / x2;
    double c5 = Math.Pow(c4, 2) + 1;
    double c6 = Math.Pow(c3, 2) - Math.Pow(c1, 2);
    double c7 = c3 * c4 * 2;

    double y = (-c7 + Math.Sqrt(Math.Pow(c7, 2) - (4 * c6 * c5))) / (2 * c5);
    double y_ = (-c7 - Math.Sqrt(Math.Pow(c7, 2) - (4 * c6 * c5))) / (2 * c5);

    double x = c3 - ((y * y2) / (x2));
    double x_ = c3 - ((y_ * y2) / (x2));

    if (x < 0){
      x = x_;
      y = y_;
    }
    double l41 = Math.Sqrt(Math.Pow(x, 2) + Math.Pow(y, 2));
    double l31 = Math.Sqrt(Math.Pow((x - x3), 2) + Math.Pow((y - y3), 2));
    double theta3 = Math.Asin(l41 * Math.Sin(theta43) / l31);
    double theta13 = Math.PI - theta43 - theta3;
      
      
    Print(l42.ToString());

    Point3d p1New = new Point3d(p[3].X + x, p[3].Y + y, p[3].Z);

    List<Line> holderChangeLines = new List<Line>();
    holderChangeLines.Add(new Line(p[2], p[3]));
    holderChangeLines.Add(new Line(p[1], p[3]));
    holderChangeLines.Add(new Line(p[2], p1New));
    holderChangeLines.Add(new Line(p1New, p[3]));
    holderChangeLines.Add(new Line(p1New, p[1]));

    List<Point3d> newP = new List<Point3d>();
    newP.Add(p1New);
    newP.Add(p[1]);
    newP.Add(p[2]);
    newP.Add(p[3]);
    pOut = newP;


    changedLines = holderChangeLines;
    
    
    List<double> angles = new List<double>();
    angles.Add(RhinoMath.ToDegrees(theta3));
    angles.Add(RhinoMath.ToDegrees(theta13));
    angles.Add(RhinoMath.ToDegrees(theta12));
    angles.Add(RhinoMath.ToDegrees(theta2));
    angles.Add(RhinoMath.ToDegrees(theta42));
    angles.Add(RhinoMath.ToDegrees(theta43));
    finalAngles = angles;
# ---------- othernodes_3: C# additional code ----------
  /// <summary>
  /// This method will be called once every solution, before any calls to RunScript.
  /// </summary>
  public override void BeforeRunScript()
  { }
  /// <summary>
  /// This method will be called once every solution, after any calls to RunScript.
  /// </summary>
  public override void AfterRunScript()
  { }
# ---------- end othernodes_3 ----------
item_3 = ListItem(List=othernodes_3.pOut, Index=0, Wrap=True)
galapagos_6 = Galapagos(fitness=addition_6, gene=[genes_2, genes, theta42_2, theta2_3, theta42, theta2])
panel_7 = Panel(othernodes_2.out)
_1_4 = Point(Point(-0.2648733242, -13.897251, 0))
_2_4 = Point(Point(-2.77910876, -17.37171311, 0))
_3_4 = Point(item_3)
_4_4 = Point(Point(-2.725951225, -10.42036577, 0))
merge_9 = Merge(Data1=flatten(_1_4), Data2=flatten(_2_4), Data3=flatten(_3_4), Data4=flatten(_4_4))
number_slider_2 = Slider(80, range=0..1000)
number_slider_3 = Slider(40, range=0..1000)
previewlw_4 = CustomPreviewLineweights(Geometry=crv_5, Shader=ColourSwatch(SwatchColor=RGB(255, 0, 115)), Thickness=Slider(5.65, range=0..10), Absolute=False)
previewlw_5 = CustomPreviewLineweights(
    Geometry=othernodes_2.originalLines,
    Shader=ColourSwatch(SwatchColor=RGB(171, 249, 255)),
    Thickness=Slider(5.65, range=0..10),
    Absolute=False)
previewlw_6 = CustomPreviewLineweights(
    Geometry=othernodes_2.changedLines,
    Shader=ColourSwatch(SwatchColor=RGB(232, 162, 128)),
    Thickness=Slider(5.65, range=0..10),
    Absolute=False)
multiplication = Multiplication(B=20)
dist = Distance(PointA=merge_5, PointB=othernodes.pOut)
othernodes_4 = CSharpScript(p=merge_9, theta2=theta2_5, theta42=theta42_4)  # -> out, originalLines, changedLines, pOut, finalAngles; inputs p: list of Point3d, theta2: Double, theta42: Double; same code as othernodes_3
dist_2 = Distance(PointA=merge_7, PointB=othernodes_2.pOut)
panel_8 = Panel(othernodes_4.finalAngles)
subtraction = Subtraction(A=graft(othernodes_4.finalAngles), B=panel_3)
subtraction_2 = Subtraction(A=graft(othernodes_3.finalAngles), B=panel_3)
panel_9 = Panel("""1
0""")
panel_10 = Panel("""2
0""")
dom = ConstructDomain(DomainStart=expr("x/2", number_slider_2), DomainEnd=expr("-x/2", number_slider_2))
dom_2 = ConstructDomain(DomainStart=expr("x/2", number_slider_3), DomainEnd=expr("-x/2", number_slider_3))
addition = Addition(A=dist_2, B=dist)
panel_11 = Panel("""3
0
0
0""")
item_4 = ListItem(List=addition, Index=0, Wrap=True)
previewlw_7 = CustomPreviewLineweights(
    Geometry=othernodes_3.originalLines,
    Shader=ColourSwatch(SwatchColor=RGB(0, 238, 255)),
    Thickness=Slider(5.65, range=0..10),
    Absolute=False)
previewlw_8 = CustomPreviewLineweights(
    Geometry=othernodes_3.changedLines,
    Shader=ColourSwatch(SwatchColor=RGB(255, 85, 0)),
    Thickness=Slider(5.65, range=0..10),
    Absolute=False)
panel_12 = Panel("""0
0
1
0""")
abs = Absolute(Value=subtraction)
abs_2 = Absolute(Value=subtraction_2)
multiplication_2 = Multiplication(A=item_4, B=4)
multiplication_3 = Multiplication(A=multiplication_2, B=Slider(7, range=0..100))
extremums_2 = MinMax(Number=abs)  # -> flatten(Minimum), Maximum
extremums_3 = MinMax(Number=abs_2)  # -> flatten(Minimum), Maximum
addition_2 = Addition(A=extremums_2.Minimum, B=extremums_3.Minimum)  # -> flatten(Result)
previewlw_9 = CustomPreviewLineweights(
    Geometry=othernodes_4.originalLines,
    Shader=ColourSwatch(SwatchColor=RGB(171, 249, 255)),
    Thickness=Slider(5.65, range=0..10),
    Absolute=False)
previewlw_10 = CustomPreviewLineweights(
    Geometry=othernodes_4.changedLines,
    Shader=ColourSwatch(SwatchColor=RGB(232, 162, 128)),
    Thickness=Slider(5.65, range=0..10),
    Absolute=False)
avr_2 = Average(Input=addition_2)
panel_13 = Panel(avr_2)
number_slider_4 = Slider(0, range=0..100)
number_slider_5 = Slider(1, range=0..1)
rectangle = Rectangle(Plane=PlaneXY(0, 0, 0), XSize=dom_2, YSize=dom, Radius=0)  # -> Rectangle, Length
number_slider_6 = Slider(5.224, range=0..10)
merge_10 = Merge(Data1=Slider(50, range=0..100), Data2=Slider(60, range=0..100), Data3=Slider(52, range=0..100))
merge_11 = Merge(Data1=Slider(86, range=0..100), Data2=Slider(38, range=0..100), Data3=Slider(31, range=0..100))
genes_7 = GenePool(Decimals=3, Maximum=100, Minimum=0, Value=[60.48, 56.139, 55.337, 59.94, 59.603, 59.155])
genes_8 = GenePool(Decimals=2, Maximum=10, Minimum=-10, Value=[0.87, 2.16, 0.32, 2.2, 2.97, -0.58, -5.59])
number_slider_7 = Slider(0.2429, range=0..10)
explode = Explode(Curve=rectangle.Rectangle, Recursive=True)  # -> Segments, Vertices
item_5 = ListItem(List=explode.Segments, Index=0, Wrap=True)  # -> Item, Item1, Item2, Item3
subtraction_3 = Subtraction(A=number_slider_3, B=number_slider_7)
crv_6 = Curve([item_5.Item1, item_5.Item3])
addition_3 = Addition(A=number_slider_3, B=number_slider_7)
pt_2 = Point()
license = LicenseKaramba3D()
ma = MassAddition()  # -> Result, PartialResults
bool = Boolean(True)
matselect = MaterialSelectionKaramba3D(menu=[dropdown(5), dropdown(1)])
panel_14 = Panel("""0
1""")
number_slider_8 = Slider(100, range=0..100)
number_slider_9 = Slider(100, range=0..100)
cross_section = CrossSectionKaramba3D(
    FamilyNameOfCrossSection="DefaultCroSec",
    Material=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,
    Height_cm=number_slider_8,
    UpperFlangeWidth_cm=number_slider_8,
    LowerFlangeWidth_cm=number_slider_8,
    mode="Trapezoid")
cross_section_2 = CrossSectionKaramba3D(
    FamilyNameOfCrossSection="DefaultCroSec",
    Material=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,
    Height_cm=number_slider_9,
    UpperFlangeWidth_cm=number_slider_9,
    LowerFlangeWidth_cm=number_slider_9,
    mode="Trapezoid")
license_2 = LicenseKaramba3D()
joint_agent = BeamJointAgentKaramba3D(Ct_kN_m=Vector(0, 0, 0), Cr_kNm_rad=Vector(0, 0, 0), menu=[buttons(off, off, off, off, on, off)])
loads = LoadsKaramba3D(Vector=Vector(0, 0, -1), LCase="0", mode="Gravity")
Z = UnitZ(Factor=Slider(70, range=0..1000))
loads_2 = LoadsKaramba3D(Vector=Z, LCase="0", mode="Gravity")
number_slider_10 = Slider(98, range=0..100)
series = Series(Start=0, Step=1, Count=Slider(148, range=0..1000))
series_2 = Series(Start=0, Step=1, Count=Slider(74, range=0..1000))
matselect_2 = MaterialSelectionKaramba3D(menu=[dropdown(5), dropdown(1)])
number_slider_11 = Slider(100, range=0..100)
genes_9 = GenePool(Decimals=4, Maximum=2.5, Minimum=0, Value=[1.3313, 0.4415, 1.5253, 1.2876, 0.4484])
panel_15 = Panel("""17
36""")
genes_10 = GenePool(Decimals=0, Maximum=0.001, Minimum=0, Value=[0, 0, 0, 0, 0, 0, 0, 0, 0, 0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])
genes_11 = GenePool(Decimals=2, Maximum=60, Minimum=10, Value=[32.63, 46.18, 32.89, 23.91, 53.89])
cross_section_3 = CrossSectionKaramba3D(
    FamilyNameOfCrossSection="DefaultCroSec",
    Material=matselect_2,
    Height_cm=number_slider_11,
    UpperFlangeWidth_cm=number_slider_11,
    LowerFlangeWidth_cm=number_slider_11,
    mode="Trapezoid")
number_slider_12 = Slider(1, range=0..1)
genes_12 = GenePool(
    Decimals=2,
    Maximum=60,
    Minimum=10,
    Value=[23.84, 20.09, 42.02, 26.1, 48.22, 15.76, 29.97, 30.71, 33.22, 57.06, 28.75, 25.49, 23.17, 35, 35])
panel_16 = Panel("""36
18""")
number_slider_13 = Slider(3, range=0..10)
panel_17 = Panel("""2
3
1
0""")
genes_13 = GenePool(Decimals=2, Maximum=90, Minimum=0, Value=[44.55, 41.31, 39.62, 36.41, 38.22, 53.5, 39.23, 41.91, 35.56, 52.45])
genes_14 = GenePool(Decimals=4, Maximum=4, Minimum=0, Value=[2.0643, 2.1904, 1.5354, 2.2489, 1.5408, 1.2641, 1.6304, 1.9703, 1.6971, 2.1692])
number_slider_14 = Slider(3, range=0..10)
item_6 = ListItem(List=genes_11, Index=panel_17, Wrap=True)
subtraction_4 = Subtraction(A=Slider(60, range=0..100), B=item_6)
subtraction_5 = Subtraction(A=Slider(60, range=0..100), B=genes_11)
panel_18 = Panel(item_6)
Z_2 = UnitZ(Factor=Slider(300, range=0..1000))
loads_3 = LoadsKaramba3D(Vector=Z_2, LCase="0", mode="Gravity")
del = DelaunayMesh(Plane=PlaneXY(0, 0, 0))
panel_19 = Panel(subtraction_4)
genes_15 = GenePool(Decimals=4, Maximum=4, Minimum=0, Value=[1.2076, 1.1323, 1.3601, 1.2136, 2, 2])
subtraction_6 = Subtraction(A=Slider(60, range=0..100), B=genes_11)
genes_16 = GenePool(Decimals=2, Maximum=90, Minimum=0, Value=[24.17, 36.67, 32.28, 39.13, 45, 45])
genes_17 = GenePool(Decimals=2, Maximum=90, Minimum=0, Value=[35.74, 23.79, 45.8, 43.59, 45, 45])
genes_18 = GenePool(Decimals=0, Maximum=5, Minimum=0, Value=[0, 0, 0, 0, 1, 0])
subtraction_7 = Subtraction(A=Slider(60, range=0..100), B=genes_13)
genes_19 = GenePool(Decimals=2, Maximum=4, Minimum=0, Value=[3.29, 0.68, 0.27, 2.1, 0.68, 3.52, 3.12, 1.25])
genes_20 = GenePool(Decimals=2, Maximum=90, Minimum=20, Value=[75.77, 45.26, 70.32, 89.72, 40.36, 44.47, 72.6, 21.39])
crv_7 = Curve([<curve referenced from the Rhino model> x4])
galapagos_7 = Galapagos(fitness=extremums_33, gene=[genes_13, genes_14])
crv_8 = Curve()
extremums_4 = MinMax()  # -> Minimum, Maximum
crv_9 = Curve()
panel_20 = Panel(number_slider_13)
galapagos_8 = Galapagos(fitness=extremums_26, gene=[genes_17, genes_16, genes_18, genes_15])
galapagos_9 = Galapagos(fitness=extremums_32, gene=[genes_20, genes_19])
panel_21 = Panel(extremums_4.Maximum)
galapagos_10 = Galapagos(fitness=extremums_32, gene=[genes_20, genes_19])
number_slider_15 = Slider(1.681, range=0..10)
panel_22 = Panel("""25
12""")
panel_23 = Panel("""25
12""")
panel_24 = Panel("""25
12""")
pln_5 = Plane()
genes_21 = GenePool(
    Decimals=4,
    Maximum=4,
    Minimum=0,
    Value=[2.295, 2.1558, 1.8914, 2.1999, 2.2095, 2.1338, 2.0527, 1.9294, 1.9865, 2.0927, 1.7159, 1.7919, 2.2095, 2.1061, 2.2662, 2.1611])
genes_22 = GenePool(
    Decimals=4,
    Maximum=4,
    Minimum=0,
    Value=[2.0475, 2.1306, 1.872, 2.2843, 1.8588, 2.3157, 1.9601, 1.9875, 2.1314, 2.2666, 2.0685, 2.054, 2.2277, 2.0608, 1.8573, 2.1266])
genes_23 = GenePool(
    Decimals=4,
    Maximum=4,
    Minimum=0,
    Value=[1.7613, 2.0633, 2.2305, 2.3088, 2.1495, 2.1769, 2.1253, 2.2179, 2.3932, 2.0841, 2.1139, 1.9391, 2.007, 2.1585, 3.1043, 2.1302])
genes_24 = GenePool(
    Decimals=4,
    Maximum=4,
    Minimum=0,
    Value=[1.9527, 1.836, 2.1973, 2.0627, 2.1133, 2.0769, 1.6766, 2.049, 1.9739, 1.8083, 2.0905, 2.0668, 1.7668, 1.889, 2.2595, 1.9568])
genes_25 = GenePool(
    Decimals=2,
    Maximum=90,
    Minimum=0,
    Value=[42.7, 41.02, 44.98, 46.37, 49.86, 42.21, 44.27, 46.24, 42, 43.55, 45.82, 44.49, 47.17, 50.82, 46.49, 43.09])
genes_26 = GenePool(
    Decimals=2,
    Maximum=90,
    Minimum=0,
    Value=[45.42, 43.78, 42.77, 45.84, 47.16, 43.97, 40.69, 39.41, 44.61, 39.81, 43.21, 44.59, 46.58, 51.45, 42.59, 45.8])
genes_27 = GenePool(
    Decimals=2,
    Maximum=90,
    Minimum=0,
    Value=[45.54, 45.6, 45.75, 42.95, 43.79, 44.27, 46.04, 46.86, 44.29, 43.75, 40.04, 42.98, 47.91, 42.11, 42.16, 46.93])
genes_28 = GenePool(
    Decimals=2,
    Maximum=90,
    Minimum=0,
    Value=[39.81, 43.44, 43.62, 41.25, 42.83, 44.04, 44.27, 44.03, 42.25, 41.67, 48.08, 49.95, 47.39, 44.5, 34.64, 41.66])
genes_29 = GenePool(
    Decimals=2,
    Maximum=90,
    Minimum=0,
    Value=[44.73, 40.23, 44.54, 45.64, 46.33, 46.36, 46.66, 38.96, 41.96, 48.04, 45.82, 44.64, 44.73, 44.11, 41.93, 44.36])
subtraction_8 = Subtraction(A=Slider(60, range=0..100), B=genes_29)
genes_30 = GenePool(
    Decimals=2,
    Maximum=90,
    Minimum=0,
    Value=[43.89, 43.33, 42.84, 45.03, 43.88, 52.16, 47.95, 42.95, 52.07, 43.77, 45.85, 43.94, 39.09, 46.73, 45.27, 51.77])
glass_thickness_in = Panel(".5")
glass_pcf = Slider(180, range=0..1000)
multiplication_4 = Multiplication()
division = Division(A=glass_thickness_in, B=12)
matselect_3 = MaterialSelectionKaramba3D(menu=[dropdown(5), dropdown(2)])
move = Move(Motion=Vector(0, 0, 10))  # -> Geometry, Transform
panel_25 = Panel("15")
multiplication_5 = Multiplication(A=division, B=glass_pcf, C=0.04788025889, D="1.2")
multiplication_6 = Multiplication(A="20", B=0.04788025889, C="1.6")
cp = ControlPoints()  # -> Points, Weights, Knots
Z_3 = UnitZ(Factor=multiplication_6)
Z_4 = UnitZ(Factor=multiplication_5)
Z_5 = UnitZ(Factor="1.2")
neg = Negative(Value=Z_3)
neg_2 = Negative(Value=Z_5)
neg_3 = Negative(Value=Z_4)
loads_4 = LoadsKaramba3D(Vector=neg_2, LCase="0", mode="Gravity")
multiplication_7 = Multiplication(A=Slider(8.5, range=0..100), B=2.54)
multiplication_8 = Multiplication(A=Slider(28.5, range=4.5..100), B=2.54)
cross_section_4 = CrossSectionKaramba3D(
    FamilyNameOfCrossSection="DefaultCroSec",
    Material=matselect_3,
    Height_cm=multiplication_8,
    UpperFlangeWidth_cm=multiplication_7,
    LowerFlangeWidth_cm=multiplication_7,
    mode="Trapezoid")
Z_6 = UnitZ(Factor=1)
beam_joints = BeamJointsKaramba3D(
    AtElementIdentifiers="wood",
    CtKNMAtStartingNode=Vector(0, 0, 0),
    CrKNmRadAtStartingNode=Vector(0, 0, 0),
    CtKNMAtEndNode=Vector(0, 0, 0),
    CrKNmRadAtEndNode=Vector(0, 0, 0),
    menu=[buttons(off, off, off, off, off, off), buttons(off, off, off, off, off, off)])
multiplication_9 = Multiplication(A=multiplication_7, B=2)
multiplication_10 = Multiplication(A=multiplication_8, B=0.393701)
pi = Pi(Factor=Slider(2, range=0..10))
multiplication_11 = Multiplication(A=multiplication_9, B=6)
panel_26 = Panel(multiplication_10)
division_2 = Division(A=multiplication_11, B=pi)
panel_27 = Panel(division_2)
crv_10 = Curve(<curve referenced from the Rhino model>)
cp_2 = ControlPoints(Curve=crv_10)  # -> Points, Weights, Knots
genes_31 = GenePool(Decimals=4, Maximum=4, Minimum=0, Value=1.4248)
swatch = ColourSwatch(SwatchColor=RGB(214, 174, 62))
plfit_2 = PlaneFit(Points=cp_2.Points)  # -> Plane, Deviation
project = Project(Geometry=cp_2.Points, Plane=plfit_2.Plane)  # -> Geometry, Transform
genes_32 = GenePool(Decimals=2, Maximum=60, Minimum=0, Value=20.99)
genes_33 = GenePool(Decimals=2, Maximum=60, Minimum=0, Value=25.68)
genes_34 = GenePool(Decimals=2, Maximum=60, Minimum=0, Value=40.76)
genes_35 = GenePool(Decimals=2, Maximum=60, Minimum=40, Value=[40, 41.08])
genes_36 = GenePool(Decimals=2, Maximum=60, Minimum=0, Value=47.81)
genes_37 = GenePool(Decimals=2, Maximum=60, Minimum=40, Value=[59.37, 56.16])
pline = PolyLine(Vertices=project.Geometry, Closed=False)
area = Area(Geometry=pline)  # -> Area, Centroid
division_3 = Division(A=area.Area, B=2)
multiplication_12 = Multiplication(A=multiplication_6, B=area.Area)
division_4 = Division(A=multiplication_12, B=Slider(4, range=0..10))
number_slider_16 = Slider(1, range=0..1)
panel_28 = Panel("""1
2
0
3""")
neg_4 = Negative(Value=Slider(1.6, range=0..10))
abs_3 = Absolute()
swatch_2 = ColourSwatch(SwatchColor=RGB(102, 207, 91))
number_slider_17 = Slider(9, range=0..10)
empty = EmptyObjectToEmptyBranch()
number_slider_18 = Slider(0, range=0..100)
null = NullItem()  # -> NullFlags, InvalidFlags, Description
null_2 = NullItem()  # -> NullFlags, InvalidFlags, Description
swatch_3 = ColourSwatch(SwatchColor=RGB(0, 0, 0))
number_slider_19 = Slider(7, range=0..10)
number_slider_20 = Slider(1, range=0..1)
galapagos_11 = Galapagos(fitness=filter_3, gene=[genes_32, genes_36, genes_33, genes_34, genes_37, genes_35, genes_31])
genes_38 = GenePool(Decimals=4, Maximum=2.5, Minimum=0, Value=[0.5972, 1.1842, 1.3622])
genes_39 = GenePool(Decimals=2, Maximum=60, Minimum=10, Value=[22.74, 40.24, 37.22])
genes_40 = GenePool(Decimals=0, Maximum=2, Minimum=0, Value=[0, 0, 0, 0, 0, 0, 0, 0, 0, 0, 0, 0, 0, 0, 0, 0, 0, 0])
galapagos_12 = Galapagos(fitness=filter_3, gene=[genes_32, genes_36, genes_33, genes_34, genes_37, genes_35, genes_31])
number_slider_21 = Slider(9, range=0..14)
closeness_need = Slider(1, range=0..1)
galapagos_13 = Galapagos(fitness=roundd, gene=[genes_39, genes_40, genes_38])
tolerance_for_end_node_placement = Slider(0.3, range=0..1)
galapagos_14 = Galapagos()
subtraction_9 = Subtraction(A=Slider(60, range=0..100), B=genes_39)
number_slider_22 = Slider(12, range=0..14)
swatch_4 = ColourSwatch(SwatchColor=RGB(99, 177, 255))
distance_between_point_and_node = Slider(1, range=0..1)
panel_29 = Panel("""0
1""")
swatch_5 = ColourSwatch(SwatchColor=RGB(195, 84, 255))
number_slider_23 = Slider(9, range=0..10)
panel_30 = Panel("""1
2
0
3""")
neg_5 = Negative(Value=Slider(1.6, range=0..10))
subtraction_10 = Subtraction(A=Slider(60, range=0..100), B=genes_39)
multiplication_13 = Multiplication(B=10)
panel_31 = Panel("""1
3
4
6
8
9""")
panel_32 = Panel("""0
2
3
5
7
8""")
merge_12 = Merge(
    Data1=Slider(17, range=0..100),
    Data2=Slider(36, range=0..100),
    Data3=Slider(18, range=0..100),
    Data4=Slider(36, range=0..100))
repeat = RepeatData(Data=merge_12, Length=Slider(29, range=0..100))
merge_13 = Merge(Data1=Slider(4, range=0..10), Data2=Slider(3, range=0..10))
swatch_6 = ColourSwatch(SwatchColor=RGB(93, 94, 42))
multiplication_14 = Multiplication(B=10)
number_slider_24 = Slider(600000, range=0..1000000)
merge_14 = Merge(Data1=Slider(4, range=0..10), Data2=Slider(3, range=0..10))
swatch_7 = ColourSwatch(SwatchColor=RGB(93, 94, 42))
cull_i = CullIndex(Wrap=True)
split = SplitList()  # -> ListA, ListB
cull_i_2 = CullIndex(Wrap=True)
split_2 = SplitList()  # -> ListA, ListB
number_slider_25 = Slider(1000, range=0..1000)
galapagos_15 = Galapagos(fitness=filter_15, gene=[genes_32, genes_36, genes_33, genes_34, genes_37, genes_35, genes_31])
number_slider_26 = Slider(2, range=0..10)  # disabled
number_slider_27 = Slider(1, range=0..10)  # disabled
panel_33 = Panel("0")  # disabled
panel_34 = Panel("0")  # disabled
number_slider_28 = Slider(2, range=0..10)  # disabled
number_slider_29 = Slider(0, range=0..10)  # disabled
number_slider_30 = Slider(86, range=0..100)  # disabled
number_slider_31 = Slider(10000, range=0..10000)  # disabled

number_slider_32 = Slider(60.96, range=0..1000)
cir = Circle(Plane=PlaneXY(0, 0, 0), Radius=number_slider_3)
panel_35 = Panel("Creating GRIDSHELL")
trib = TrianglePanelsB(Surface=reparameterize(rectangle.Rectangle), UDivisions=Slider(20, range=0..100), VDivisions=Slider(34, range=0..100))
debrep = DeconstructBrep(Brep=trib)  # -> Faces, Edges, Vertices
xy_5 = XYPlane(Origin=Point(0, 0, 0))
trim = TrimWithRegion(Curve=debrep.Edges, Region=rectangle.Rectangle, Plane=xy_5)  # -> Inside, Outside
crv_11 = Curve(flatten(trim.Inside))
vec = Vector(crv_11)
divide = DivideCurve(Curve=crv_11, Count="1", Kinks=False)  # -> flatten(Points), Tangents, Parameters
cullpt = CullDuplicates(Points=divide.Points, Tolerance=0.1, CullMode=1)  # -> Points, Indices, Valence
cullpt_2 = CullDuplicates(Points=cullpt.Points, Tolerance=Slider(0, range=0..100), CullMode=3)  # -> Points, Indices, Valence
srf_cp = SurfaceClosestPoint(Point=flatten(cullpt_2.Points), Surface=reparameterize(rectangle.Rectangle))  # -> Point, UVPoint, Distance
sort_pt = SortPoints(Points=srf_cp.UVPoint)  # -> Points, Indices
item_7 = ListItem(List=cullpt_2.Points, Index=sort_pt.Indices, Wrap=True)
del_2 = DelaunayMesh(Points=flatten(item_7), Plane=PlaneXY(0, 0, 0))
demesh = DeconstructMesh(Mesh=del_2)  # -> Vertices, Faces, Colours, Normals
pt_3 = Point(Point(0, 0, 0))
dist_3 = Distance(PointA=pt_3, PointB=demesh.Vertices)
vertexloads = VertexLoads(Mesh=del_2, Strength=Slider(1.4, range=0..10))
larger = LargerThan(FirstNumber=dist_3, SecondNumber=subtraction_3)  # -> LargerThan, OrEqualTo
edgelengths = EdgeLengths(Mesh=del_2, LengthFactor=Slider(0.882, range=0..1), Strength=1)
show = Show(G=del_2)

end = EndPoints(Curve=crv_11)  # -> Start, End
gdshellnd = RemoteSender(crv_11)
merge_15 = Merge(Data1=end.Start, Data2=end.End)
cullpt_3 = CullDuplicates(Points=merge_15, Tolerance=0.1, CullMode=1)  # -> Points, Indices, Valence
crv_cp = CurveClosestPoint(Point=cullpt_3.Points, Curve=graft(crv_6))  # -> Point, Parameter, Distance
flip = FlipMatrix(Data=crv_cp.Distance)
extremums_5 = MinMax(Number=flip)  # -> flatten(Minimum), Maximum
smaller = SmallerThan(FirstNumber=extremums_5.Minimum, SecondNumber=Slider(0.13744, range=0..1))  # -> SmallerThan, OrEqualTo
medges = MeshEdges(Mesh=del_2)  # -> NakedEdges, InteriorEdges, NonManifoldEdges
gdshellnd_2 = RemoteReceiver(gdshellnd)
end_2 = EndPoints(Curve=gdshellnd_2)  # -> Start, End
merge_16 = Merge(Data1=end_2.Start, Data2=end_2.End)
ln = Line(StartPoint=end_2.Start, EndPoint=end_2.End)
cull_curves = CullCurvesKaramba3D(Curves=ln, LimitDistance=0.05, NumberOfSamplePoints=3)
panel_36 = Panel(ln)
cullpt_4 = CullDuplicates(Points=merge_16, Tolerance=0.1, CullMode=1)  # -> Points, Indices, Valence
linetobeam = LineToBeamKaramba3D(
    Line=cull_curves,
    CrossSection=cross_section,
    New=True,
    Remove=True,
    LimitDistance_m=0.005,
    Bending=True,
    SetBucklingLength=True,
    ToPolylineMaxAngle=0.03,
    ToPolylineTolerance=0.01,
    ToPolylineMinEdgeLength=0.25)  # -> Element, Points, Info
joint_agent_2 = BeamJointAgentKaramba3D(
    ToGeometry=cullpt_4.Points,
    Ct_kN_m=Vector(0, 0, 0),
    Cr_kNm_rad=Vector(0, 0, 0),
    menu=[buttons(off, off, off, off, off, off)])

dispatch = Dispatch(List=cullpt_3.Points, DispatchPattern=smaller.OrEqualTo)  # -> ListA, ListB
pt_4 = Point(dispatch.ListA)
anchor = Anchor(Point=pt_4, Strength=10000)
entwine = Entwine(Branch00=edgelengths, Branch01=anchor, Branch02=vertexloads, Branch03=show, FlattenInputs=True)
solver = Solver(GoalObjects=entwine, Reset=Button(), Threshold=1e-15, Tolerance=0.0001, On=Toggle(False))  # -> I, V, O
bang = ExplodeTree(Data=solver.O)  # -> Branch0, Branch1, Branch2, Branch3, Branch4
preview = CustomPreview(
    Geometry=bang.Branch3,
    Material={diffuse=RGB(221, 160, 221), emission=RGB(66, 48, 66), shine=0.5, specular=RGB(255, 255, 255), transparency=0})  # disabled

pdecon = Deconstruct(Point=dispatch.ListB)  # -> XComponent, YComponent, ZComponent
extremums_6 = MinMax(Number=pdecon.YComponent)  # -> Minimum, Maximum
supports = RemoteSender([dispatch.ListA, pt_2])
equals = Equality(FirstNumber=pdecon.YComponent, SecondNumber=extremums_6.Minimum)  # -> Equality, Inequality
equals_2 = Equality(FirstNumber=pdecon.YComponent, SecondNumber=extremums_6.Maximum)  # -> Equality, Inequality
dispatch_2 = Dispatch(List=dispatch.ListB, DispatchPattern=equals.Equality)  # -> ListA, ListB
dispatch_3 = Dispatch(List=dispatch.ListB, DispatchPattern=equals_2.Equality)  # -> ListA, ListB
medges_2 = MeshEdges(Mesh=bang.Branch3)  # -> NakedEdges, InteriorEdges, NonManifoldEdges
dam = DataDam(DataA=bang.Branch3, BufferDelay=10000000, BufferMode=0)

medges_3 = MeshEdges(Mesh=dam)  # -> NakedEdges, InteriorEdges, NonManifoldEdges

supports_2 = RemoteReceiver(supports)
cp_3 = ClosestPoint(Point=supports_2, Cloud=cullpt_4.Points)  # -> ClosestPoint, CPIndex, Distance
supports_3 = RemoteReceiver(supports)
supp = SupportKaramba3D(PosInd=cp_3.ClosestPoint, menu=[buttons(on, on, on, off, off, off)])
assemble = AssembleModelKaramba3D(Elem=flatten(linetobeam.Element), Support=flatten(supp), Load=loads_2, Joint=joint_agent_2, LimitDistance_m=0.005)  # -> Model, Info, Mass_kg, CenterOfGravity, LoadCaseNames
ladeform = LargeDeformationAnalysisKaramba3D(Model=assemble.Model, Increments=5, MaximumDisplacement_m=-1)  # -> CalculatedModel, MaximumDisplacement_cm
ladeform_2 = LargeDeformationAnalysisKaramba3D(Model=assemble.Model, Increments=Slider(5, range=0..100), MaximumDisplacement_m=-1)  # -> CalculatedModel, MaximumDisplacement_cm
modelview = ModelViewKaramba3D(Model=ladeform.CalculatedModel, ResultFactors=1, ResultCase=-1)  # -> Model, DeformedMesh, DeformedAxes, DeformedModel
firstdeformation = RemoteSender(modelview.DeformedAxes)

kangaroo = BooleanToggle(False)
filter = StreamFilter(Gate=kangaroo, Stream0=modelview.DeformedAxes, Stream1=[medges_3.InteriorEdges, medges_3.NakedEdges])
gridshell_lines = RemoteSender(filter)

gridshell_lines_2 = RemoteReceiver(gridshell_lines)
mp_2 = Midpoint(Curve=gridshell_lines_2)
pdecon_2 = Deconstruct(Point=mp_2)  # -> XComponent, YComponent, ZComponent
sort = SortList(Keys=pdecon_2.XComponent, ValuesA=gridshell_lines_2)  # -> Keys, ValuesA
gridshell_lines_3 = RemoteReceiver(gridshell_lines)
partition = PartitionList(List=sort.ValuesA, Size=panel_4)
end_3 = EndPoints(Curve=gridshell_lines_3)  # -> Start, End
mp_3 = Midpoint(Curve=partition)
pdecon_3 = Deconstruct(Point=mp_3)  # -> XComponent, YComponent, ZComponent
merge_17 = Merge(Data1=end_3.Start, Data2=end_3.End)
gridshell_lines_4 = RemoteReceiver(gridshell_lines)
sort_2 = SortList(Keys=pdecon_3.YComponent, ValuesA=partition)  # -> Keys, reverse(simplify(ValuesA))
sort_val = SortDuplicateValues(ValueList=merge_17)  # -> UniqueValues, Indices
tstat = TreeStatistics(Tree=sort_2.ValuesA)  # -> Paths, Length, Count
lng = ListLength(List=tstat.Paths)
item_8 = ListItem(List=gridshell_lines_4, Index=sort_val.Indices, Wrap=True)
item_9 = ListItem(List=merge_17, Index=sort_val.Indices, Wrap=True)
subtraction_11 = Subtraction(A=lng, B="2")
sortedlines = RemoteSender(item_8)
lng_2 = ListLength(List=sort_val.Indices)
dom_3 = ConstructDomain(DomainStart="1", DomainEnd=subtraction_11)
item_10 = ListItem(List=item_9, Index=0, Wrap=True)
subset = SubList(List=tstat.Paths, Domain=dom_3, Wrap=True)  # -> List, Index
branch = TreeBranch(Tree=sort_2.ValuesA, Path=subset.List, MaintainPaths=False)
numberofnodes = RemoteSender(lng_2)
centerpts = RemoteSender(item_10)
centerpts_2 = RemoteReceiver(centerpts)
centerpts_3 = RemoteReceiver(centerpts)
lng_3 = ListLength(List=subset.List)
repeat_2 = RepeatData(Data=panel_9, Length=lng_3)  # -> graft(Data)
repeat_3 = RepeatData(Data=panel_10, Length=lng_3)  # -> graft(Data)
repeat_4 = RepeatData(Data=panel_11, Length=lng_3)  # -> graft(Data)
repeat_5 = RepeatData(Data=panel_12, Length=lng_3)  # -> graft(Data)
equals_3 = Equality(FirstNumber=repeat_3, SecondNumber=0)  # -> Equality, Inequality
equals_4 = Equality(FirstNumber=repeat_2, SecondNumber=0)  # -> Equality, Inequality
sortedlines_2 = RemoteReceiver(sortedlines)
equals_5 = Equality(FirstNumber=repeat_4, SecondNumber=0)  # -> Equality, Inequality
equals_6 = Equality(FirstNumber=repeat_5, SecondNumber=0)  # -> Equality, Inequality
dispatch_4 = Dispatch(List=repeat_3, DispatchPattern=equals_3.Equality)  # -> ListA, ListB
dispatch_5 = Dispatch(List=repeat_3, DispatchPattern=equals_4.Equality)  # -> ListA, ListB
dispatch_6 = Dispatch(List=repeat_4, DispatchPattern=equals_5.Equality)  # -> ListA, ListB
dispatch_7 = Dispatch(List=repeat_5, DispatchPattern=equals_6.Equality)  # -> ListA, ListB
centerpts_4 = RemoteReceiver(centerpts)
lng_4 = ListLength(List=sortedlines_2)
repeat_6 = RepeatData(Data=centerpts_4, Length=lng_4)
end_4 = EndPoints(Curve=graft(sortedlines_2))  # -> Start, End
merge_18 = Merge(Data1=dispatch_5.ListA, Data2=dispatch_4.ListB, Data3=dispatch_6.ListB, Data4=dispatch_7.ListB)
trim_2 = TrimTree(Tree=repeat_6, Depth=1)  # -> graft(Tree)
# TODO write something that always chooses top left
merge_19 = Merge(Data1=end_4.Start, Data2=end_4.End)
trim_3 = TrimTree(Tree=merge_19, Depth=1)
cp_4 = ClosestPoint(Point=trim_2, Cloud=merge_19)  # -> ClosestPoint, CPIndex, Distance
item_11 = ListItem(List=reverse(merge_19), Index=cp_4.CPIndex, Wrap=True)
pt_5 = Point(item_11)
item_12 = ListItem(List=branch, Index=merge_18, Wrap=True)
trim_4 = TrimTree(Tree=pt_5, Depth=1)
fcircle = CircleFit(Points=trim_4)  # -> Circle, Radius, Deviation
crv_cp_2 = CurveClosestPoint(Point=trim_4, Curve=reparameterize(fcircle.Circle))  # -> Point, Parameter, Distance
centerpts_5 = RemoteReceiver(centerpts)
sort_3 = SortList(Keys=crv_cp_2.Parameter, ValuesA=trim_4)  # -> Keys, ValuesA
ln_2 = Line(StartPoint=centerpts_5, EndPoint=sort_3.ValuesA)
linesforan = RemoteSender(ln_2)
linesforan_2 = RemoteReceiver(linesforan)
tstat_2 = TreeStatistics(Tree=linesforan_2)  # -> Paths, Length, Count
linesforan_3 = RemoteReceiver(linesforan)
end_5 = EndPoints(Curve=linesforan_3)  # -> Start, End
endpoints = RemoteSender(end_5.End)
shift = ShiftList(List=end_5.End, Shift=1, Wrap=True)
ln_3 = Line(StartPoint=end_5.End, EndPoint=shift)
centerpts_6 = RemoteReceiver(centerpts)
mp_4 = Midpoint(Curve=ln_3)
pdecon_4 = Deconstruct(Point=centerpts_6)  # -> XComponent, YComponent, ZComponent
numberofnodes_2 = RemoteReceiver(numberofnodes)
int = Integer(flatten(numberofnodes_2))
data = Data(mp_4)
equals_7 = Equality(FirstNumber=int, SecondNumber=6)  # -> Equality, Inequality
endpoints_2 = RemoteReceiver(endpoints)
data_2 = Data(centerpts_6)
tstat_3 = TreeStatistics(Tree=data)  # -> Paths, Length, Count
data_3 = Data(numberofnodes_2)
data_4 = Data(endpoints_2)
mindex = MemberIndex(Set=equals_7.Equality, Member=bool)  # -> Index, Count
tstat_4 = TreeStatistics(Tree=data_2)  # -> Paths, Length, Count
tstat_5 = TreeStatistics(Tree=data_3)  # -> Paths, Length, Count
tstat_6 = TreeStatistics(Tree=data_4)  # -> Paths, Length, Count
gridshell_lines_5 = RemoteReceiver(gridshell_lines)
end_6 = EndPoints(Curve=gridshell_lines_5)  # -> Start, End
merge_20 = Merge(Data1=end_6.Start, Data2=end_6.End)
cullpt_5 = CullDuplicates(Points=merge_20, Tolerance=0.1, CullMode=1)  # -> Points, Indices, Valence
cp_5 = ClosestPoint(Point=supports_3, Cloud=cullpt_5.Points)  # -> ClosestPoint, CPIndex, Distance
joint_agent_3 = BeamJointAgentKaramba3D(
    ToGeometry=cullpt_5.Points,
    Ct_kN_m=Vector(0, 0, 0),
    Cr_kNm_rad=Vector(0, 0, 0),
    menu=[buttons(off, off, off, off, on, off)])
linetobeam_2 = LineToBeamKaramba3D(
    Line=gridshell_lines_5,
    CrossSection=cross_section_2,
    New=True,
    Remove=True,
    LimitDistance_m=0.005,
    Bending=True,
    SetBucklingLength=True,
    ToPolylineMaxAngle=0.03,
    ToPolylineTolerance=0.01,
    ToPolylineMinEdgeLength=0.25)  # -> Element, Points, Info
supp_2 = SupportKaramba3D(PosInd=cp_5.ClosestPoint, menu=[buttons(on, on, on, on, on, on)])
assemble_2 = AssembleModelKaramba3D(Elem=flatten(linetobeam_2.Element), Support=flatten(supp_2), Load=loads, Joint=joint_agent_3, LimitDistance_m=0.005)  # -> Model, Info, Mass_kg, CenterOfGravity, LoadCaseNames
analyze = AnalyzeKaramba3D(Model=assemble_2.Model)  # -> CalculatedModel, MaximumDisplacement_cm, ResultingForceOfGravity_kN, ElasticEnergy_kNm
modelview_2 = ModelViewKaramba3D(Model=analyze.CalculatedModel, ResultFactors=1, ResultCase=-1)  # -> Model, DeformedMesh, DeformedAxes, DeformedModel
beamview = BeamViewKaramba3D(Model=modelview_2.Model)  # -> Model, MeshesOfRenderedBeams, DeformedBeamAxes, LegendColors, LegendTags
end_7 = EndPoints(Curve=filter)  # -> Start, End
merge_21 = Merge(Data1=end_7.Start, Data2=end_7.End)
cullpt_6 = CullDuplicates(Points=merge_21, Tolerance=0.1, CullMode=1)  # -> Points, Indices, Valence
del_3 = DelaunayMesh(Points=cullpt_6.Points, Plane=PlaneXY(0, 0, 0))
filter_2 = StreamFilter(Gate=kangaroo, Stream0=del_3, Stream1=dam)
firstdeformation_2 = RemoteReceiver(firstdeformation)
previewlw_11 = CustomPreviewLineweights(
    Geometry=firstdeformation_2,
    Shader=ColourSwatch(SwatchColor=RGB(176, 176, 176)),
    Thickness=Slider(2, range=0..10),
    Absolute=False)
end_8 = EndPoints(Curve=graft(firstdeformation_2))  # -> Start, End
gridshell = RemoteSender(filter_2)
gridshell_2 = RemoteReceiver(gridshell)
meshcp = MeshClosestPoint(Point=centerpts_2, Mesh=gridshell_2)  # -> Point, Index, Parameter
meval = MeshEval(Mesh=gridshell_2, Parameter=meshcp.Parameter)  # -> Point, Normal, Colour
line_2 = LineSDL(Start=centerpts_3, Direction=meval.Normal, Length=1)
normalgridshelllines = RemoteSender(line_2)

# ---- group: ANGLE 1
normalgridshelllines_2 = RemoteReceiver(normalgridshelllines)
centerpts_7 = RemoteReceiver(centerpts)
linesforan_4 = RemoteReceiver(linesforan)
pl_2 = PlaneNormal(Origin=centerpts_7, ZAxis=normalgridshelllines_2)
project_2 = Project(Geometry=linesforan_4, Plane=pl_2)  # -> Geometry, Transform
projectedline = RemoteSender(project_2.Geometry)
shift_2 = ShiftList(List=project_2.Geometry, Shift=1, Wrap=True)
angle = Angle(VectorA=project_2.Geometry, VectorB=shift_2, Plane=pl_2)  # -> Angle, Reflex
deg = Degrees(Radians=angle.Angle)
expression = Expression(x=deg, Expression="if(x>180, 360-x, x)")
angle1 = RemoteSender(expression)

# ---- group: ANGLE 2
projectedline_2 = RemoteReceiver(projectedline)
linesforan_5 = RemoteReceiver(linesforan)
crv_12 = Curve(graft(projectedline_2))
crv_13 = Curve(graft(linesforan_5))
divide_2 = DivideCurve(Curve=[crv_12, crv_13], Count=10, Kinks=False)  # -> Points, Tangents, Parameters
normalgridshelllines_3 = RemoteReceiver(normalgridshelllines)
trim_5 = TrimTree(Tree=divide_2.Points, Depth=1)
plfit_3 = PlaneFit(Points=trim_5)  # -> Plane, Deviation
projectedline_3 = RemoteReceiver(projectedline)
end_9 = EndPoints(Curve=normalgridshelllines_3)  # -> Start, End
pl_origin_3 = PlaneOrigin(Base=plfit_3.Plane, Origin=end_9.Start)
linesforan_6 = RemoteReceiver(linesforan)
trim_6 = TrimTree(Tree=pl_origin_3, Depth=1)
angle_2 = Angle(VectorA=projectedline_3, VectorB=linesforan_6, Plane=trim_6)  # -> Angle, Reflex
deg_2 = Degrees(Radians=angle_2.Angle)
expression_2 = Expression(x=deg_2, Expression="if(x>180, 360-x, x)")
shift_3 = ShiftList(List=expression_2, Shift=1, Wrap=True)
subtraction_12 = Subtraction(A=expression_2, B=shift_3)

# ----
planes = RemoteSender(pl_2)
planes_2 = RemoteReceiver(planes)
tstat_7 = TreeStatistics(Tree=planes_2)  # -> Paths, Length, Count
cluster = Cluster_2(L=branch, A=merge_18, T=merge_18, planes=planes, B=Slider(1, range=0..10))  # -> points, i
da_upper_2 = DynamicAnglesUpper(Points=cluster.points, TopAngles=genes_7, SideAngles=genes_8, Planes=cluster.i)  # -> OriginalLines, ChangedPoints, ChangedLines, AnglesTop, AnglesSide, TestingPoint, Cost, AngleCost, SidePlanes
crv_14 = Curve(da_upper_2.OriginalLines)
crv_15 = Curve(da_upper_2.ChangedLines)
pln_6 = Plane(da_upper_2.SidePlanes)
cluster_2 = Cluster_6(
    relay=da_upper_2.ChangedPoints,
    gridshell=gridshell,
    L=da_upper_2.ChangedPoints,
    L_2=branch,
    A=merge_18,
    T=merge_18,
    planes=planes,
    B=Slider(2, range=0..10))  # -> L_3, L_4
da_upper_3 = DynamicAnglesUpper(Points=cluster_2.L_4, TopAngles=genes_7, SideAngles=genes_8, Planes=cluster_2.L_3)  # -> OriginalLines, ChangedPoints, ChangedLines, AnglesTop, AnglesSide, TestingPoint, Cost, AngleCost, SidePlanes
item_13 = ListItem(List=cluster.i, Index=0, Wrap=True)  # -> Item, Item1, Item2, Item3
project_3 = Project(Geometry=crv_15, Plane=item_13.Item)  # -> Geometry, Transform
project_4 = Project(Geometry=crv_15, Plane=item_13.Item1)  # -> Geometry, Transform
project_5 = Project(Geometry=crv_15, Plane=item_13.Item2)  # -> Geometry, Transform
cluster_3 = Cluster_7(
    relay=da_upper_3.ChangedPoints,
    gridshell=gridshell,
    L=branch,
    A=merge_18,
    T=merge_18,
    planes=planes,
    B=Slider(3, range=0..10))  # -> L_2, L_3
project_6 = Project(Geometry=crv_15, Plane=item_13.Item3)  # -> Geometry, Transform
item_14 = ListItem(List=project_3.Geometry, Index=0, Wrap=True)  # -> Item, Item1, Item2, Item3, Item4
item_15 = ListItem(List=project_4.Geometry, Index=0, Wrap=True)  # -> Item, Item1, Item2, Item3, Item4
item_16 = ListItem(List=project_5.Geometry, Index=0, Wrap=True)  # -> Item, Item1, Item2, Item3, Item4
item_17 = ListItem(List=project_6.Geometry, Index=0, Wrap=True)  # -> Item, Item1, Item2, Item3, Item4
da_upper_4 = DynamicAnglesUpper(Points=cluster_3.L_3, TopAngles=genes_7, SideAngles=genes_8, Planes=cluster_3.L_2)  # -> OriginalLines, ChangedPoints, ChangedLines, AnglesTop, AnglesSide, TestingPoint, Cost, AngleCost, SidePlanes
crv_16 = Curve(item_15.Item1)
crv_17 = Curve(item_15.Item4)
crv_18 = Curve(item_14.Item2)
crv_19 = Curve(item_14.Item3)
crv_20 = Curve(item_14.Item3)
crv_21 = Curve(item_14.Item4)
crv_22 = Curve(item_16.Item)
crv_23 = Curve(item_16.Item2)
crv_24 = Curve(item_17.Item3)
crv_25 = Curve(item_17.Item1)
crv_26 = Curve(item_17.Item)
crv_27 = Curve(item_17.Item3)
flip_2 = FlipCurve(Curve=crv_18)  # -> Curve, Flag
flip_3 = FlipCurve(Curve=crv_16)  # -> Curve, Flag
angle_3 = Angle(VectorA=crv_22, VectorB=crv_23, Plane=item_13.Item2)  # -> Angle, Reflex
cluster_4 = Cluster_7(
    relay=da_upper_4.ChangedPoints,
    gridshell=gridshell,
    L=branch,
    A=merge_18,
    T=merge_18,
    planes=planes,
    B=Slider(4, range=0..10))  # -> L_2, L_3
angle_4 = Angle(VectorA=flip_2.Curve, VectorB=crv_19, Plane=item_13.Item)  # -> Angle, Reflex
angle_5 = Angle(VectorA=crv_20, VectorB=crv_21, Plane=item_13.Item)  # -> Angle, Reflex
angle_6 = Angle(VectorA=flip_3.Curve, VectorB=crv_17, Plane=item_13.Item1)  # -> Angle, Reflex
angle_7 = Angle(VectorA=crv_25, VectorB=crv_24, Plane=item_13.Item3)  # -> Angle, Reflex
angle_8 = Angle(VectorA=crv_26, VectorB=crv_27, Plane=item_13.Item3)  # -> Angle, Reflex
deg_3 = Degrees(Radians=angle_4.Angle)
deg_4 = Degrees(Radians=angle_5.Angle)
deg_5 = Degrees(Radians=angle_6.Angle)
deg_6 = Degrees(Radians=angle_3.Reflex)
deg_7 = Degrees(Radians=angle_7.Angle)
deg_8 = Degrees(Radians=angle_8.Angle)
panel_37 = Panel(da_upper_2.AnglesTop)
da_upper_5 = DynamicAnglesUpper(Points=cluster_4.L_3, TopAngles=genes_7, SideAngles=genes_8, Planes=cluster_4.L_2)  # -> OriginalLines, ChangedPoints, ChangedLines, AnglesTop, AnglesSide, TestingPoint, Cost, AngleCost, SidePlanes
expression_3 = Expression(x=deg_3, Expression="if(x>180, 360-x, x)")
expression_4 = Expression(x=deg_4, Expression="if(x>180, 360-x, x)")
expression_5 = Expression(x=deg_5, Expression="if(x>180, 360-x, x)")
expression_6 = Expression(x=deg_6, Expression="if(x>180, 360-x, x)")
expression_7 = Expression(x=deg_7, Expression="if(x>180, 360-x, x)")
expression_8 = Expression(x=deg_8, Expression="if(x>180, 360-x, x)")
cluster_5 = Cluster_7(
    relay=da_upper_5.ChangedPoints,
    gridshell=gridshell,
    L=branch,
    A=merge_18,
    T=merge_18,
    planes=planes,
    B=Slider(5, range=0..10))  # -> L_2, L_3
panel_38 = Panel(expression_4)
panel_39 = Panel(expression_3)
panel_40 = Panel(expression_5)
panel_41 = Panel(expression_6)
panel_42 = Panel(expression_8)
panel_43 = Panel(expression_7)
da_upper_6 = DynamicAnglesUpper(Points=cluster_5.L_3, TopAngles=genes_7, SideAngles=genes_8, Planes=cluster_5.L_2)  # -> OriginalLines, ChangedPoints, ChangedLines, AnglesTop, AnglesSide, TestingPoint, Cost, AngleCost, SidePlanes
subtraction_13 = Subtraction(A=panel_39, B=genes_7)
subtraction_14 = Subtraction(A=panel_38, B=genes_7)
abs_4 = Absolute(Value=subtraction_13)
subtraction_15 = Subtraction(A=panel_40, B=genes_7)
subtraction_16 = Subtraction(A=panel_41, B=genes_7)
subtraction_17 = Subtraction(A=panel_43, B=genes_7)
abs_5 = Absolute(Value=subtraction_14)
subtraction_18 = Subtraction(A=panel_42, B=genes_7)
extremums_7 = MinMax(Number=abs_4)  # -> Minimum, Maximum
abs_6 = Absolute(Value=subtraction_17)
abs_7 = Absolute(Value=subtraction_16)
cluster_6 = Cluster_7(
    relay=da_upper_6.ChangedPoints,
    gridshell=gridshell,
    L=branch,
    A=merge_18,
    T=merge_18,
    planes=planes,
    B=Slider(6, range=0..10))  # -> L_2, L_3
extremums_8 = MinMax(Number=abs_5)  # -> Minimum, Maximum
abs_8 = Absolute(Value=subtraction_15)
abs_9 = Absolute(Value=subtraction_18)
extremums_9 = MinMax(Number=abs_8)  # -> Minimum, Maximum
extremums_10 = MinMax(Number=abs_7)  # -> Minimum, Maximum
extremums_11 = MinMax(Number=abs_6)  # -> Minimum, Maximum
extremums_12 = MinMax(Number=abs_9)  # -> Minimum, Maximum
da_upper_7 = DynamicAnglesUpper(Points=cluster_6.L_3, TopAngles=genes_7, SideAngles=genes_8, Planes=cluster_6.L_2)  # -> OriginalLines, ChangedPoints, ChangedLines, AnglesTop, AnglesSide, TestingPoint, Cost, AngleCost, SidePlanes
angle1_2 = RemoteReceiver(angle1)
data_5 = Data(angle1_2)
panel_44 = Panel([extremums_7.Minimum, extremums_8.Minimum, extremums_9.Minimum, extremums_10.Minimum, extremums_11.Minimum, extremums_12.Minimum])
panel_45 = Panel(da_upper_2.AngleCost)
cluster_7 = Cluster_7(
    relay=da_upper_7.ChangedPoints,
    gridshell=gridshell,
    L=branch,
    A=merge_18,
    T=merge_18,
    planes=planes,
    B=Slider(7, range=0..10))  # -> L_2, L_3
tstat_8 = TreeStatistics(Tree=data_5)  # -> Paths, Length, Count
da_upper_8 = DynamicAnglesUpper(Points=cluster_7.L_3, TopAngles=genes_7, SideAngles=genes_8, Planes=cluster_7.L_2)  # -> OriginalLines, ChangedPoints, ChangedLines, AnglesTop, AnglesSide, TestingPoint, Cost, AngleCost, SidePlanes
extremums_13 = MinMax(Number=panel_44)  # -> Minimum, Maximum
cluster_8 = Cluster_7(
    relay=da_upper_8.ChangedPoints,
    gridshell=gridshell,
    L=branch,
    A=merge_18,
    T=merge_18,
    planes=planes,
    B=Slider(8, range=0..10))  # -> L_2, L_3
panel_46 = Panel(extremums_13.Maximum)
da_upper_9 = DynamicAnglesUpper(Points=cluster_8.L_3, TopAngles=genes_7, SideAngles=genes_8, Planes=cluster_8.L_2)  # -> OriginalLines, ChangedPoints, ChangedLines, AnglesTop, AnglesSide, TestingPoint, Cost, AngleCost, SidePlanes
cluster_9 = Cluster_7(
    relay=da_upper_9.ChangedPoints,
    gridshell=gridshell,
    L=branch,
    A=merge_18,
    T=merge_18,
    planes=planes,
    B=Slider(9, range=0..10))  # -> L_2, L_3
da_upper_10 = DynamicAnglesUpper(Points=cluster_9.L_3, TopAngles=genes_7, SideAngles=genes_8, Planes=cluster_9.L_2)  # -> OriginalLines, ChangedPoints, ChangedLines, AnglesTop, AnglesSide, TestingPoint, Cost, AngleCost, SidePlanes
num = Number(flatten([da_upper_5.Cost, da_upper_4.Cost, da_upper_3.Cost, da_upper_2.Cost, da_upper_6.Cost, da_upper_7.Cost, da_upper_8.Cost, da_upper_9.Cost, da_upper_10.Cost]))
panel_47 = Panel(num)
extremums_14 = MinMax(Number=flatten(num))  # -> Minimum, Maximum
panel_48 = Panel(extremums_14.Maximum)
previewlw_12 = CustomPreviewLineweights(
    Geometry=[da_upper_3.ChangedLines, da_upper_2.ChangedLines, da_upper_4.ChangedLines, da_upper_5.ChangedLines, da_upper_6.ChangedLines, da_upper_7.ChangedLines, da_upper_8.ChangedLines, da_upper_9.ChangedLines, da_upper_10.ChangedLines],
    Shader={diffuse=RGB(255, 105, 180), emission=RGB(76, 32, 54), shine=0.5, specular=RGB(255, 255, 255), transparency=0},
    Absolute=False)
angle1_3 = RemoteReceiver(angle1)
k_means = KMeansClustering(TrainingInputs=graft(angle1_3), OfClusters=Slider(6, range=0..10), RandomSeed=Slider(50, range=0..100))  # -> Result, Likelihood, Centroids
extremums_15 = MinMax(Number=k_means.Likelihood)  # -> Minimum, Maximum
subtraction_19 = Subtraction(A=extremums_15.Maximum, B=extremums_15.Minimum)
angle1_4 = RemoteReceiver(flatten(angle1))
addition_4 = Addition(A=subtraction_19, B=1)
panel_49 = Panel(addition_4)
sift = SiftPattern(List=angle1_4, SiftPattern=k_means.Result)  # -> Output0, Output1, Output2, Output3, Output4, Output5
panel_50 = Panel(k_means.Centroids)
null_3 = NullItem(Item=sift.Output0)  # -> NullFlags, InvalidFlags, Description
panel_51 = Panel(k_means.Likelihood)
dispatch_8 = Dispatch(List=sift.Output0, DispatchPattern=null_3.NullFlags)  # -> ListA, ListB
panel_52 = Panel(dispatch_8.ListB)
merge_22 = Merge(Data1=end_8.Start, Data2=end_8.End)
pdecon_5 = Deconstruct(Point=merge_22)  # -> XComponent, YComponent, ZComponent
sort_4 = SortList(Keys=pdecon_5.ZComponent, ValuesA=merge_22)  # -> Keys, ValuesA
item_18 = ListItem(List=sort_4.ValuesA, Index=0, Wrap=True)  # -> flatten(Item)
pdecon_6 = Deconstruct(Point=item_18)  # -> XComponent, YComponent, ZComponent
sort_5 = SortList(Keys=pdecon_6.ZComponent, ValuesA=firstdeformation_2)  # -> Keys, ValuesA
item_19 = ListItem(List=sort_5.ValuesA, Index=series, Wrap=True)
end_10 = EndPoints(Curve=item_19)  # -> Start, End
item_20 = ListItem(List=reverse(end_10.End), Index=0, Wrap=True)  # -> Item, Item1, Item2
pointfor_an = RemoteSender(item_20.Item1)
pointfor_an_2 = RemoteReceiver(pointfor_an)
pdecon_7 = Deconstruct(Point=pointfor_an_2)  # -> XComponent, YComponent, ZComponent
equalst = EqualityWithinTolerance(FirstNumber=pdecon_7.ZComponent, SecondNumber=flatten(pdecon_4.ZComponent), Tolerance=Slider(1, range=0..1))  # -> Equality, Inequality
mindex_2 = MemberIndex(Set=equalst.Equality, Member=Toggle(True))  # -> Index, Count
testforgridshell = RemoteSender(mindex_2.Index)
testforgridshell_2 = RemoteReceiver(testforgridshell)
item_21 = ListItem(List=tstat_2.Paths, Index=testforgridshell_2, Wrap=True)
testforgridshell_3 = RemoteReceiver(testforgridshell)
branch_2 = TreeBranch(Tree=linesforan_2, Path=item_21, MaintainPaths=True)
filteredlines = RemoteSender(branch_2)
filteredlines_2 = RemoteReceiver(filteredlines)
filteredlines_3 = RemoteReceiver(filteredlines)
lng_5 = ListLength(List=filteredlines_2)
equals_8 = Equality(FirstNumber=lng_5, SecondNumber=6)  # -> Equality, Inequality
dispatch_9 = Dispatch(List=filteredlines_2, DispatchPattern=equals_8.Equality)  # -> ListA, ListB
filteredlines_4 = RemoteReceiver(filteredlines)
crv_28 = Curve(filteredlines_4)
clean = CleanTree(RemoveNulls=True, RemoveInvalid=True, RemoveEmpty=invert(False), Tree=dispatch_9.ListA)
end_11 = EndPoints(Curve=clean)  # -> Start, End
end_12 = EndPoints(Curve=clean)  # -> Start, End
pt_6 = Point(end_12.Start)
item_22 = ListItem(List=clean, Index=0, Wrap=True)  # -> Item, Item1, Item2
item_23 = ListItem(List=tstat_7.Paths, Index=testforgridshell_3, Wrap=True)
previewlw_13 = CustomPreviewLineweights(Geometry=branch_2, Shader=ColourSwatch(SwatchColor=RGB(0, 4, 255)), Thickness=Slider(4, range=0..10), Absolute=False)
branch_3 = TreeBranch(Tree=planes_2, Path=item_23, MaintainPaths=True)
filteredplanes = RemoteSender(branch_3)
filteredplanes_2 = RemoteReceiver(filteredplanes)
dispatch_10 = Dispatch(List=filteredplanes_2, DispatchPattern=equals_8.Equality)  # -> ListA, ListB
filteredplanes_3 = RemoteReceiver(filteredplanes)
filteredplanes_4 = RemoteReceiver(filteredplanes)
clean_2 = CleanTree(RemoveNulls=True, RemoveInvalid=True, RemoveEmpty=invert(False), Tree=dispatch_10.ListA)

filteredlines_5 = RemoteReceiver(filteredlines)
filteredplanes_5 = RemoteReceiver(filteredplanes)
deplane_2 = DeconstructPlane(Plane=clean_2)  # -> Origin, XAxis, YAxis, ZAxis
project_7 = Project(Geometry=clean, Plane=clean_2)  # -> Geometry, Transform
crv_29 = Curve(clean)
merge_23 = Merge(Data1=graft(project_7.Geometry), Data2=graft(crv_29))
divide_3 = DivideCurve(Curve=merge_23, Count=10, Kinks=False)  # -> Points, Tangents, Parameters
trim_7 = TrimTree(Tree=divide_3.Points, Depth=1)
end_13 = EndPoints(Curve=crv_29)  # -> Start, End
plfit_4 = PlaneFit(Points=trim_7)  # -> Plane, Deviation
trim_8 = TrimTree(Tree=plfit_4.Plane, Depth=1)
pl_origin_4 = PlaneOrigin(Base=trim_8, Origin=end_13.Start)
angle_9 = Angle(VectorA=crv_29, VectorB=project_7.Geometry, Plane=pl_origin_4)  # -> Angle, Reflex
deg_9 = Degrees(Radians=angle_9.Angle)
larger_2 = LargerThan(FirstNumber=deg_9, SecondNumber=180)  # -> LargerThan, OrEqualTo
dispatch_11 = Dispatch(List=graft(pl_origin_4), DispatchPattern=graft(larger_2.LargerThan))  # -> ListA, ListB
clean_3 = CleanTree(RemoveNulls=True, RemoveInvalid=True, RemoveEmpty=invert(False), Tree=dispatch_11.ListA)
flippln = FlipPlane(Plane=clean_3, FlipX=False, FlipY=False, FlipZ=True)  # -> Flipped, R
merge_24 = Merge(Data1=flippln.Flipped, Data2=dispatch_11.ListB)
trim_9 = TrimTree(Tree=merge_24, Depth=1)
angle_10 = Angle(VectorA=crv_29, VectorB=project_7.Geometry, Plane=trim_9)  # -> Angle, Reflex
deg_10 = Degrees(Radians=angle_10.Angle)
plane2 = RemoteSender(trim_9)
shift_4 = ShiftList(List=deg_10, Shift=1, Wrap=True)
subtraction_20 = Subtraction(A=shift_4, B=deg_10)
panel_53 = Panel(subtraction_20)

project_8 = Project(Geometry=clean, Plane=clean_2)  # -> Geometry, Transform
pln_7 = Plane(clean_2)
xy_6 = XYPlane(Origin=pln_7)
orient = Orient(Geometry=project_8.Geometry, Source=pln_7, Target=xy_6)  # -> Geometry, Transform
project_9 = Project(Geometry=filteredlines_4, Plane=filteredplanes_3)  # -> Geometry, Transform
plane2_2 = RemoteReceiver(plane2)
mp_5 = Midpoint(Curve=project_7.Geometry)
end_14 = EndPoints(Curve=project_7.Geometry)  # -> Start, End
merge_25 = Merge(Data1=graft(end_11.End), Data2=graft(end_11.Start), Data3=graft(end_14.End), Data4=graft(end_14.Start))
plfit_5 = PlaneFit(Points=merge_25)  # -> Plane, Deviation
bbox = BoundingBox(Content=merge_25, Plane=PlaneXY(0, 0, 0), UnionBox=True)  # -> Box, Box_2
filteredplanes_6 = RemoteReceiver(filteredplanes)
trim_10 = TrimTree(Tree=plfit_5.Plane, Depth=1)
pl_origin_5 = PlaneOrigin(Base=trim_10, Origin=end_13.Start)
project_10 = Project(Geometry=clean, Plane=filteredplanes_6)  # -> Geometry, Transform
bang_2 = ExplodeTree(Data=clean_2)  # -> _000170, _000171, _000172, _000173, _000174, _000175, _000176, _000177
item_24 = ListItem(List=project_10.Geometry, Index=number_slider, Wrap=True)
shift_5 = ShiftList(List=project_10.Geometry, Shift=1, Wrap=True)
plane2_3 = RemoteReceiver(plane2)
single_node = CSharpScript(angle10=genes_2, angle20=genes, linesAtNodes=clean, plane=clean_2, plane2=plane2_3)  # -> out, A, B, C, D, E, F; inputs angle10: list of Double, angle20: list of Double, linesAtNodes: list of Line, plane: Plane, plane2: list of Plane, seed: Int32; disabled
# ---------- single_node: C# usings ----------
public static class Globals{
  public static Int32 flipAngle = 0;
}
# ---------- single_node: C# ----------
    int numberOfNodes = angle10.Count;
    // Set up the angle arrays
    double angle = 360 / 6;
    List<double> angles10_total = new List<double>();
    List<double> angle11 = new List<double>();

    for( int i = 0; i < numberOfNodes; i++){
      angles10_total.Add(angle10[i]);
      angle11.Add(angle - angle10[i]);
    }
    for( int i = 0; i < numberOfNodes; i++){
      angles10_total.Add(angle11[i]);
    }
    List<double> angles11_total = new List<double>();
    for( int i = 0; i < numberOfNodes; i++){
      angles11_total.Add(angle11[i]);
    }
    for( int i = 0; i < numberOfNodes; i++){
      angles11_total.Add(angle10[i]);
    }

    List<double> angles1Single = new List<double>();
    List<List<double>> angles1Rel = new List<List<double>>();

    for( int i = 0; i < angles10_total.Count; i++){
      List<double> sublist = new List<double>();
      angles1Single.Add(angle - angles10_total[i] - angles11_total[i]);
      for(int j = 0; j < angles10_total.Count; j++){
        sublist.Add(angles11_total[i] + angles10_total[j]);
      }
      angles1Rel.Add(sublist);
    }



    //Setting up angle2
    numberOfNodes = angle20.Count;
    List<double> angles20_total = new List<double>();
    for( int i = 0; i < numberOfNodes; i++){
      angles20_total.Add(angle20[i]);
    }
    for( int i = 0; i < numberOfNodes; i++){
      angles20_total.Add(-angle20[i]);
    }


    List<double> angles2Single = new List<double>();
    List<List<double>> angles2Rel = new List<List<double>>();
    for( int i = 0; i < numberOfNodes * 2; i++){
      List<double> sublist = new List<double>();
      for(int j = 0; j < numberOfNodes * 2;j++){
        sublist.Add(angles20_total[j] - angles20_total[i]);
      }
      angles2Rel.Add(sublist);
    }
    A = angles1Rel[0];





    List<double> angles1 = angle1Projected(linesAtNodes, plane);
    List<double> angles2Start;
    List<double> angles2 = angle2Projected(linesAtNodes, plane, plane2, out angles2Start);

    B = angles2;
    C = angles20_total;
    List<int> path = new List<int>();
    int count = angles1Single.Count;
    double angleCheck = 0.0;
    double cost = 0.0;
    double optCost = Double.PositiveInfinity;
    for(int i = 0; i < count; i++){
      cost = 0.0;
      angleCheck = angles20_total[i];
      //double cost1 = Math.Abs(angles20_total[i] - angle2Start[0]);
      double cost1 = Math.Abs(angles2Start[0] - angleCheck);
      cost += cost1;
      if (cost < optCost)
        for(int j = 0; j < count; j++){
          cost = cost1;
          angleCheck = angles20_total[i];
          angleCheck += angles2Rel[i][j];
          double cost2 = Math.Abs(angleCheck - angles2Start[1]) + Math.Abs(angles1Rel[i][j] - angles1[0]);
          //double cost2 = Math.Abs(angles2Rel[i][j] - angles2[0]) + Math.Abs(angles1Rel[i][j] - angles1[0]);
          //double cost2 = Math.Abs(angles1Rel[i][j] - angles1[0]);
          cost += cost2;
          if (cost < optCost)
            for(int k = 0; k < count; k++){
              angleCheck = angles20_total[i] + angles2Rel[i][j];
              angleCheck += angles2Rel[j][k];
              cost = cost1 + cost2;
              double cost3 = Math.Abs(angleCheck - angles2Start[2]) + Math.Abs(angles1Rel[j][k] - angles1[1]);

              //double cost3 = Math.Abs(angles2Rel[j][k] - angles2[1]) + Math.Abs(angles1Rel[j][k] - angles1[1]);
              //double cost3 = Math.Abs(angles1Rel[j][k] - angles1[1]);
              cost += cost3;
              if (cost < optCost)
                for(int l = 0; l < count; l++){
                  cost = cost1 + cost2 + cost3;
                  angleCheck = angles20_total[i] + angles2Rel[i][j] + angles2Rel[j][k];
                  angleCheck += angles2Rel[k][l];
                  double cost4 = Math.Abs(angleCheck - angles2Start[3]) + Math.Abs(angles1Rel[k][l] - angles1[2]);
                  //double cost4 = Math.Abs(angles1Rel[k][l] - angles1[2]);
                  //double cost4 = Math.Abs(angles2Rel[k][l] - angles2[2]) + Math.Abs(angles1Rel[k][l] - angles1[2]);
                  cost += cost4;
                  if (cost < optCost)
                    for(int m = 0; m < count; m++){
                      cost = cost1 + cost2 + cost3 + cost4;
                      angleCheck = angles20_total[i] + angles2Rel[i][j] + angles2Rel[j][k] + angles2Rel[k][l];
                      angleCheck += angles2Rel[l][m];
                      double cost5 = Math.Abs(angleCheck - angles2Start[4]) + Math.Abs(angles1Rel[l][m] - angles1[3]);
                      //double cost5 = Math.Abs(angles2Rel[l][m] - angles2[3]) + Math.Abs(angles1Rel[l][m] - angles1[3]);
                      //double cost5 = Math.Abs(angles1Rel[l][m] - angles1[3]);
                      cost += cost5;
                      if (cost < optCost)
                        for(int n = 0; n < count; n++){
                          cost = cost1 + cost2 + cost3 + cost4 + cost5;
                          angleCheck = angles20_total[i] + angles2Rel[i][j] + angles2Rel[j][k] + angles2Rel[k][l] + angles2Rel[l][m];
                          angleCheck += angles2Rel[m][n];
                          double cost6 = Math.Abs(angleCheck - angles2Start[5]) + Math.Abs(angles1Rel[m][n] - angles1[4]) + Math.Abs(angles1Rel[n][i] - angles1[5]);
                          //double cost6 = Math.Abs(angles2Rel[m][n] - angles2[4]) + Math.Abs(angles1Rel[m][n] - angles1[4]) + Math.Abs(angles2Rel[n][i] - angles2[5]) + Math.Abs(angles1Rel[n][i] - angles1[5]);
                          //double cost6 = Math.Abs(angles1Rel[m][n] - angles1[4]) + Math.Abs(angles1Rel[n][i] - angles1[5]);

                          cost += cost6;

                          if(cost < optCost){
                            path.Clear();
                            path.Add(i);
                            path.Add(j);
                            path.Add(k);
                            path.Add(l);
                            path.Add(m);
                            path.Add(n);
                            optCost = cost;
                            Print(cost.ToString());
                          }

                        }
                    }
                }
            }
        }
    }

    E = path;
    D = changeLines(linesAtNodes, path, angles1Rel, angles2Rel, angles20_total, plane, plane2);
    List<double> check = new List<double>();
    for(int i = 0; i < path.Count - 1; i++){
      check.Add(angles2Rel[path[i]][path[i + 1]]);
    }
    check.Add(angles2Rel[path[path.Count - 1]][path[0]]);
    F = check;
# ---------- single_node: C# additional code ----------
  // returns the angle of the projected lines
  private List<double> angle1Projected(List<Line> lns, Plane pl){
    List<double> angles = new List<double>();
    if(RhinoMath.ToDegrees(Vector3d.VectorAngle(lns[0].Direction, lns[1].Direction, pl)) > 180){
      for(int i = 0; i < lns.Count; i++)
        if (i < lns.Count - 1)
          angles.Add(360.0 - RhinoMath.ToDegrees(Vector3d.VectorAngle(lns[i].Direction, lns[i + 1].Direction, pl)));
        else
          angles.Add(360.0 - RhinoMath.ToDegrees(Vector3d.VectorAngle(lns[i].Direction, lns[0].Direction, pl)));
      Globals.flipAngle = 1;
    }
    else{

      for(int i = 0; i < lns.Count; i++)
        if (i < lns.Count - 1)
          angles.Add(RhinoMath.ToDegrees(Vector3d.VectorAngle(lns[i].Direction, lns[i + 1].Direction, pl)));
        else
          angles.Add(RhinoMath.ToDegrees(Vector3d.VectorAngle(lns[i].Direction, lns[0].Direction, pl)));
      Globals.flipAngle = 0;
    }
    return angles;
  }

  // returns the starting angle and then the relative angles
  private List<double> angle2Projected(List<Line> lns, Plane pl, List<Plane> plns, out List<double> anglesOriginal){
    List<double> angles = new List<double>();
    anglesOriginal = new List<double>();
    double angleStart = 0.0;
    for(int i = 0; i < lns.Count; i++){
      Line holderLn = new Line(lns[i].From, pl.ClosestPoint(lns[i].To));
      Plane holderPl = plns[i];
      anglesOriginal.Add(RhinoMath.ToDegrees(Vector3d.VectorAngle(lns[i].Direction, holderLn.Direction, holderPl)));
    }

    angleStart = anglesOriginal[0];
    for(int i = 0; i < lns.Count; i++)
    {
      var holder = i + 1;
      if (holder == lns.Count)
        holder = 0;

      angles.Add(anglesOriginal[holder] - anglesOriginal[i]);

    }


    return angles;
  }


  //updates lines to current state
  private List<Line> changeLines(List<Line> lns, List<int> path, List<List<double>> angles1Rel, List<List<double>> angles2Rel, List<double>angles2Start, Plane pl, List<Plane> plns2){
    List<Line> lns_Updated = new List<Line>();
    List<Line> lns_Updated_length = new List<Line>();
    var xform = Rhino.Geometry.Transform.Rotation(RhinoMath.ToRadians(360 - angles1Rel[path[0]][path[1]]), pl.ZAxis, pl.Origin);;
    var xform2 = Rhino.Geometry.Transform.Rotation(-1 * RhinoMath.ToRadians(angles2Start[path[0]]), plns2[0].ZAxis, plns2[0].Origin);
    Line holderLn = new Line(lns[0].From, pl.ClosestPoint(lns[0].To));
    holderLn.Transform(xform2);
    lns_Updated.Add(holderLn);

    for (int i = 0; i < lns.Count - 1; i++){
      xform = Rhino.Geometry.Transform.Rotation(RhinoMath.ToRadians(360 - angles1Rel[path[i]][path[i + 1]]), pl.ZAxis, pl.Origin);
      if(Globals.flipAngle == 0)
        xform = Rhino.Geometry.Transform.Rotation(RhinoMath.ToRadians(angles1Rel[path[i]][path[i + 1]]), pl.ZAxis, pl.Origin);


      Line holder = new Line(lns_Updated[lns_Updated.Count - 1].From, lns_Updated[lns_Updated.Count - 1].To);
      holder.Transform(xform);
      xform2 = Rhino.Geometry.Transform.Rotation(-1 * RhinoMath.ToRadians(angles2Rel[path[i]][path[i + 1]]), plns2[i + 1].ZAxis, plns2[i + 1].Origin);
      holder.Transform(xform2);


      lns_Updated.Add(holder);

    }
    for (int i = 0; i < lns.Count; i++){
      lns_Updated_length.Add(new Line(lns_Updated[i].From, lns_Updated[i].Direction, lns[i].Length));

    }
    return lns_Updated_length;
  }
# ---------- end single_node ----------
_1n = OneNode(Angle10=genes_2, Angle20=genes, LinesAtNodes=clean, Plane=clean_2, Plane2=plane2_3)  # -> Cost, NewLines
extremums_16 = MinMax(Number=flatten(_1n.Cost))  # -> Minimum, Maximum
extremums_17 = MinMax(Number=single_node.out)  # -> Minimum, Maximum
c_script = CSharpScript(angle10=genes_3, angle11=genes_4, angle20=genes_6, angle21=genes_5, linesAtNodes=clean, plane=clean_2, plane2=plane2_3)  # -> out, A, B, C, D, E; inputs angle10: list of Double, angle11: list of Double, angle20: list of Double, angle21: list of Double, linesAtNodes: list of Line, plane: Plane, plane2: list of Plane, seed: Int32
# ---------- c_script: C# ----------
    int numberOfNodes = angle10.Count;
    // Set up the angle arrays
    double angle = 360 / 3;
    List<double> angles10_total = new List<double>();
    for( int i = 0; i < numberOfNodes; i++){
      angles10_total.Add(angle10[i]);
    }
    for( int i = 0; i < numberOfNodes; i++){
      angles10_total.Add(angle11[i]);
    }
    List<double> angles11_total = new List<double>();
    for( int i = 0; i < numberOfNodes; i++){
      angles11_total.Add(angle11[i]);
    }
    for( int i = 0; i < numberOfNodes; i++){
      angles11_total.Add(angle10[i]);
    }

    List<double> angles1Single = new List<double>();
    List<List<double>> angles1Rel = new List<List<double>>();
    for( int i = 0; i < numberOfNodes * 2; i++){
      List<double> sublist = new List<double>();
      angles1Single.Add(angle - angles10_total[i] - angles11_total[i]);
      for(int j = 0; j < numberOfNodes * 2;j++){
        sublist.Add(angles11_total[i] + angles10_total[j]);
      }
      angles1Rel.Add(sublist);
    }
    A = angles1Rel[0];


    //Setting up angle2
    numberOfNodes = angle20.Count;
    List<double> angles20_total = new List<double>();
    for( int i = 0; i < numberOfNodes; i++){
      angles20_total.Add(angle20[i]);
    }
    for( int i = 0; i < numberOfNodes; i++){
      angles20_total.Add(-angle21[i]);
    }
    List<double> angles21_total = new List<double>();
    for( int i = 0; i < numberOfNodes; i++){
      angles21_total.Add(angle21[i]);
    }
    for( int i = 0; i < numberOfNodes; i++){
      angles21_total.Add(-angle20[i]);
    }

    List<double> angles2Single = new List<double>();
    List<List<double>> angles2Rel = new List<List<double>>();
    for( int i = 0; i < numberOfNodes * 2; i++){
      List<double> sublist = new List<double>();
      angles2Single.Add(angles21_total[i] - angles20_total[i]);
      for(int j = 0; j < numberOfNodes * 2;j++){
        sublist.Add(angles20_total[j] - angles21_total[i]);
      }
      angles2Rel.Add(sublist);
    }
    A = angles1Rel[0];





    List<double> angles1 = angle1Projected(linesAtNodes, plane);
    double angle2Start;
    List<double> angles2 = angle2Projected(linesAtNodes, plane, plane2, out angle2Start);
    A = angles2;
    B = angle2Start;
    C = angles1Rel;
    List<int> path = new List<int>();
    int count = angles1Single.Count;

    double optCost = Double.PositiveInfinity;
    for(int i = 0; i < count; i++){
      double cost = 0;
      double cost_1 = cost1(angles1, angles1Single[i]) + cost1_2(angles2, angle2Start, angles2Single[i], angles20_total[i]);
      cost += cost_1;
      if (cost < optCost){
        for(int j = 0; j < count; j++){
          cost = cost_1;
          double cost_2 = cost2(angles1, angles1Single[j], angles1Rel[i][j]) + cost2_2(angles2, angles2Single[j], angles2Rel[i][j]);
          cost += cost_2;
          if (cost < optCost){
            for(int q = 0; q < count; q++){
              cost = cost_1 + cost_2;
              double cost_3 = cost3(angles1, angles1Single[q], angles1Rel[j][q], angles1Rel[i][q]) + cost3_2(angles2, angles2Single[q], angles2Rel[j][q], angles2Rel[i][q]);
              cost += cost_3;
              if(cost < optCost){
                path.Clear();
                path.Add(i);
                path.Add(i);
                path.Add(j);
                path.Add(j);
                path.Add(q);
                optCost = cost;
                Print(cost.ToString());
              }
            }
          }
        }
      }
    }

    E = path;
    D = changeLines(linesAtNodes, path, angles1Single, angles1Rel, angles2Single, angles2Rel, angles20_total, plane, plane2);
# ---------- c_script: C# additional code ----------
  // returns the angle of the projected lines
  private List<double> angle1Projected(List<Line> lns, Plane pl){
    List<double> angles = new List<double>();
    if(RhinoMath.ToDegrees(Vector3d.VectorAngle(lns[0].Direction, lns[1].Direction, pl)) > 180){
      for(int i = 0; i < lns.Count; i++)
        if (i < lns.Count - 1)
          angles.Add(360.0 - RhinoMath.ToDegrees(Vector3d.VectorAngle(lns[i].Direction, lns[i + 1].Direction, pl)));
        else
          angles.Add(360.0 - RhinoMath.ToDegrees(Vector3d.VectorAngle(lns[i].Direction, lns[0].Direction, pl)));
      Globals.flipAngle = 1;
    }
    else{

      for(int i = 0; i < lns.Count; i++)
        if (i < lns.Count - 1)
          angles.Add(RhinoMath.ToDegrees(Vector3d.VectorAngle(lns[i].Direction, lns[i + 1].Direction, pl)));
        else
          angles.Add(RhinoMath.ToDegrees(Vector3d.VectorAngle(lns[i].Direction, lns[0].Direction, pl)));
      Globals.flipAngle = 0;
    }
    return angles;
  }

  // returns the starting angle and then the relative angles
  private List<double> angle2Projected(List<Line> lns, Plane pl, List<Plane> plns, out double angleStart){
    List<double> angles = new List<double>();
    List<double> anglesOriginal = new List<double>();
    angleStart = 0.0;
    for(int i = 0; i < lns.Count; i++){
      Line holderLn = new Line(lns[i].From, pl.ClosestPoint(lns[i].To));
      Plane holderPl = plns[i];
      anglesOriginal.Add(RhinoMath.ToDegrees(Vector3d.VectorAngle(lns[i].Direction, holderLn.Direction, holderPl)));
    }

    angleStart = anglesOriginal[0];
    for(int i = 0; i < lns.Count; i++)
    {
      var holder = i + 1;
      if (holder == lns.Count)
        holder = 0;

      angles.Add(anglesOriginal[holder] - anglesOriginal[i]);

    }


    return angles;
  }

  // cost of first operation angle 1
  private double cost1(List<double> angles1, double angle1Single){
    return Math.Abs(angles1[0] - angle1Single);
  }

  //cost of second operation angle 1
  private double cost2(List<double> angles1, double angle1Single, double angle1Rel){
    return Math.Abs(angles1[1] - angle1Rel) + Math.Abs(angles1[2] - angle1Single) ;
  }

  // cost of third operation angle 1
  private double cost3(List<double> angles1, double angle1Single, double angle1Rel, double angle1RelStart){
    return Math.Abs(angles1[3] - angle1Rel) + Math.Abs(angles1[4] - angle1Single) + Math.Abs(angles1[5] - angle1RelStart);
  }
  // cost of first operation angle 2
  private double cost1_2(List<double> angles2, double angle2Start_act, double angle2Single, double angle2Start){
    return Math.Abs(angles2[0] - angle2Single) + Math.Abs(angle2Start_act - angle2Start);
  }

  //cost of second operation angle 2
  private double cost2_2(List<double> angles2, double angle2Single, double angle2Rel){
    return Math.Abs(angles2[1] - angle2Rel) + Math.Abs(angles2[2] - angle2Single) ;
  }

  // cost of third operation angle 2
  private double cost3_2(List<double> angles2, double angle2Single, double angle2Rel, double angle2RelStart){
    return Math.Abs(angles2[3] - angle2Rel) + Math.Abs(angles2[4] - angle2Single) + Math.Abs(angles2[5] - angle2RelStart);
  }

  //updates lines to current state
  private List<Line> changeLines(List<Line> lns, List<int> path, List<double> angles1Single, List<List<double>> angles1Rel, List<double>angles2Single, List<List<double>> angles2Rel, List<double>angles2Start, Plane pl, List<Plane> plns2){
    List<Line> lns_Updated = new List<Line>();
    var xform = Rhino.Geometry.Transform.Rotation(RhinoMath.ToRadians(360 - angles1Single[path[0]]), pl.ZAxis, pl.Origin);;
    var xform2 = Rhino.Geometry.Transform.Rotation(RhinoMath.ToRadians(angles2Start[path[0]]), plns2[0].ZAxis, plns2[0].Origin);
    Line holderLn = new Line(lns[0].From, pl.ClosestPoint(lns[0].To));
    holderLn.Transform(xform);
    lns_Updated.Add(holderLn);

    for (int i = 0; i < lns.Count - 1; i++){

      xform = Rhino.Geometry.Transform.Rotation(RhinoMath.ToRadians(360 - angles1Single[path[i]]), pl.ZAxis, pl.Origin);
      if ( i % 2 == 1) {
        xform = Rhino.Geometry.Transform.Rotation(RhinoMath.ToRadians(360 - angles1Rel[path[i]][path[i + 1]]), pl.ZAxis, pl.Origin);
      }
      if(Globals.flipAngle == 0){
        xform = Rhino.Geometry.Transform.Rotation(RhinoMath.ToRadians(angles1Single[path[i]]), pl.ZAxis, pl.Origin);
        if ( i % 2 == 1) {
          xform = Rhino.Geometry.Transform.Rotation(RhinoMath.ToRadians(angles1Rel[path[i]][path[i + 1]]), pl.ZAxis, pl.Origin);
        }
      }


      Line holder = new Line(lns_Updated[lns_Updated.Count - 1].From, lns_Updated[lns_Updated.Count - 1].To);
      holder.Transform(xform);
      if ( i % 2 == 1)
        xform2 = Rhino.Geometry.Transform.Rotation(RhinoMath.ToRadians(angles2Rel[path[i]][path[i + 1]]), plns2[i + 1].ZAxis, plns2[i + 1].Origin);
      else
        xform2 = Rhino.Geometry.Transform.Rotation(RhinoMath.ToRadians(angles2Single[path[i]]), plns2[i + 1].ZAxis, plns2[i + 1].Origin);
      holder.Transform(xform2);


      lns_Updated.Add(holder);

    }
    return lns_Updated;
  }
# ---------- end c_script ----------
panel_54 = Panel(extremums_16.Maximum)
dam_2 = DataDam(DataA=single_node.D, BufferDelay=10000000, BufferMode=0)
crv_30 = Curve(dam_2)
shift_6 = ShiftList(List=crv_30, Shift=1, Wrap=True)
angle_11 = Angle(VectorA=crv_30, VectorB=shift_6, Plane=plane2_2)  # -> Angle, Reflex
deg_11 = Degrees(Radians=angle_11.Angle)
panel_55 = Panel(extremums_17.Minimum)
dam_3 = DataDam(DataA=single_node.F, BufferDelay=10000000, BufferMode=0)
project_11 = Project(Geometry=dam_2, Plane=filteredplanes_6)  # -> Geometry, Transform
project_12 = Project(Geometry=dam_2, Plane=filteredplanes_6)  # -> Geometry, Transform
ma_2 = MassAddition(Input=deg_11)  # -> Result, PartialResults
dam_4 = DataDam(DataA=single_node.B, BufferDelay=10000000, BufferMode=0)
panel_56 = Panel(dam_4)
dam_5 = DataDam(DataA=single_node.C, BufferDelay=10000000, BufferMode=0)
panel_57 = Panel(dam_5)
dam_6 = DataDam(DataA=single_node.E, BufferDelay=10000000, BufferMode=0)
item_25 = ListItem(List=dam_2, Index=0, Wrap=True)
panel_58 = Panel(c_script.A)
item_26 = ListItem(List=project_12.Geometry, Index=number_slider, Wrap=True)
shift_7 = ShiftList(List=project_12.Geometry, Shift=1, Wrap=True)
extremums_18 = MinMax(Number=single_node.out)  # -> Minimum, Maximum
expression_9 = Expression(x=dam_6, Expression="if(x>5,x -6, x)")
extremums_19 = MinMax(Number=c_script.out)  # -> Minimum, Maximum
angle_12 = Angle(VectorA=project_11.Geometry, VectorB=project_10.Geometry, Plane=filteredplanes_6)  # -> Angle, Reflex
bang_3 = ExplodeTree(Data=plane2_3)  # -> _000170, _000171, _000172, _000173, _000174, _000175, _000176, _000177
pln_8 = Plane(bang_2._000177)
panel_60 = Panel(single_node.out)
angle_13 = Angle(VectorA=project_12.Geometry, VectorB=shift_7, Plane=filteredplanes_6)  # -> Angle, Reflex
extremums_20 = MinMax(Number=flatten(extremums_18.Minimum))  # -> Minimum, Maximum
panel_61 = Panel(deg_11)
c_script_2 = CSharpScript(
    angle1A0=Slider(36.95, range=0..100),
    angle1A1=Slider(78.09, range=0..100),
    angle1B0=Slider(10.33, range=0..100),
    angle1B1=Slider(36.32, range=0..100),
    angle1C0=Slider(24.68, range=0..100),
    angle1C1=Slider(27.5, range=0..100),
    angle2A0=Slider(2.588, range=-10..10),
    angle2A1=Slider(-0.333, range=-10..10),
    angle2B0=Slider(3.685, range=-10..10),
    angle2B1=Slider(1.672, range=-10..10),
    angle2C0=Slider(0.997, range=-10..10),
    angle2C1=Slider(0.163, range=-10..10),
    linesAtNodes=clean,
    plane=clean_2,
    plane2=plane2_3)  # -> out, A, B, C, D, E; inputs angle1A0: Double, angle1A1: Double, angle1B0: Double, angle1B1: Double, angle1C0: Double, angle1C1: Double, angle2A0: Double, angle2A1: Double, angle2B0: Double, angle2B1: Double, angle2C0: Double, angle2C1: Double, linesAtNodes: list of Line, plane: Plane, plane2: list of Plane, seed: Int32
# ---------- c_script_2: C# ----------
    int numberOfNodes = 3;
    double angle = 360 / numberOfNodes;
    double angle1A = angle - angle1A0 - angle1A1;
    double angle1A_F = angle1A;
    double angle1B = angle - angle1B0 - angle1B1;
    double angle1B_F = angle1B;
    double angle1C = angle - angle1C0 - angle1C1;
    double angle1C_F = angle1C;

    double angle1AA = angle1A1 + angle1A0;
    double angle1AB = angle1A1 + angle1B0;
    double angle1AC = angle1A1 + angle1C0;
    double angle1AA_F = angle1A1 + angle1A1;
    double angle1AB_F = angle1A1 + angle1B1;
    double angle1AC_F = angle1A1 + angle1C1;

    double angle1BA = angle1B1 + angle1A0;
    double angle1BB = angle1B1 + angle1B0;
    double angle1BC = angle1B1 + angle1C0;
    double angle1BA_F = angle1B1 + angle1A1;
    double angle1BB_F = angle1B1 + angle1B1;
    double angle1BC_F = angle1B1 + angle1C1;

    double angle1CA = angle1C1 + angle1A0;
    double angle1CB = angle1C1 + angle1B0;
    double angle1CC = angle1C1 + angle1C0;
    double angle1CA_F = angle1C1 + angle1A0;
    double angle1CB_F = angle1C1 + angle1B0;
    double angle1CC_F = angle1C1 + angle1C0;

    double angle1A_FA = angle1A0 + angle1A0;
    double angle1A_FB = angle1A0 + angle1B0;
    double angle1A_FC = angle1A0 + angle1C0;
    double angle1A_FA_F = angle1A0 + angle1A1;
    double angle1A_FB_F = angle1A0 + angle1B1;
    double angle1A_FC_F = angle1A0 + angle1C1;

    double angle1B_FA = angle1B0 + angle1A0;
    double angle1B_FB = angle1B0 + angle1B0;
    double angle1B_FC = angle1B0 + angle1C0;
    double angle1B_FA_F = angle1B0 + angle1A1;
    double angle1B_FB_F = angle1B0 + angle1B1;
    double angle1B_FC_F = angle1B0 + angle1C1;

    double angle1C_FA = angle1C0 + angle1A0;
    double angle1C_FB = angle1C0 + angle1B0;
    double angle1C_FC = angle1C0 + angle1C0;
    double angle1C_FA_F = angle1C0 + angle1A0;
    double angle1C_FB_F = angle1C0 + angle1B0;
    double angle1C_FC_F = angle1C0 + angle1C0;

    //Setting up angle2

    double angle2A_F0 = -angle2A1;
    double angle2B_F0 = -angle2B1;
    double angle2C_F0 = -angle2C1;
    double angle2A_F1 = -angle2A0;
    double angle2B_F1 = -angle2B0;
    double angle2C_F1 = -angle2C0;

    double angle2A = angle2A1 - angle2A0;
    double angle2B = angle2B1 - angle2B0;
    double angle2C = angle2C1 - angle2C0;
    double angle2A_F = -angle2A;
    double angle2B_F = -angle2B;
    double angle2C_F = -angle2C;

    double angle2AA = angle2A1 + angle2A0;
    double angle2AB = angle2A1 + angle2B0;
    double angle2AC = angle2A1 + angle2C0;
    double angle2AA_F = angle2A1 + angle2A_F0;
    double angle2AB_F = angle2A1 + angle2B_F0;
    double angle2AC_F = angle2A1 + angle2C_F0;

    double angle2BA = angle2B1 + angle2A0;
    double angle2BB = angle2B1 + angle2B0;
    double angle2BC = angle2B1 + angle2C0;
    double angle2BA_F = angle2B1 + angle2A_F0;
    double angle2BB_F = angle2B1 + angle2B_F0;
    double angle2BC_F = angle2B1 + angle2C_F0;

    double angle2CA = angle2C1 + angle2A0;
    double angle2CB = angle2C1 + angle2B0;
    double angle2CC = angle2C1 + angle2C0;
    double angle2CA_F = angle2C1 + angle2A_F0;
    double angle2CB_F = angle2C1 + angle2B_F0;
    double angle2CC_F = angle2C1 + angle2C_F0;

    double angle2A_FA = angle2A_F1 + angle2A0;
    double angle2A_FB = angle2A_F1 + angle2B0;
    double angle2A_FC = angle2A_F1 + angle2C0;
    double angle2A_FA_F = angle2A_F1 + angle2A1;
    double angle2A_FB_F = angle2A_F1 + angle2B1;
    double angle2A_FC_F = angle2A_F1 + angle2C1;

    double angle2B_FA = angle2B_F1 + angle2A0;
    double angle2B_FB = angle2B_F1 + angle2B0;
    double angle2B_FC = angle2B_F1 + angle2C0;
    double angle2B_FA_F = angle2B_F1 + angle2A1;
    double angle2B_FB_F = angle2B_F1 + angle2B1;
    double angle2B_FC_F = angle2B_F1 + angle2C1;

    double angle2C_FA = angle2C_F1 + angle2A0;
    double angle2C_FB = angle2C_F1 + angle2B0;
    double angle2C_FC = angle2C_F1 + angle2C0;
    double angle2C_FA_F = angle2C_F1 + angle2A0;
    double angle2C_FB_F = angle2C_F1 + angle2B0;
    double angle2C_FC_F = angle2C_F1 + angle2C0;







    // Set up the angle arrays
    double[] angles1Single = {angle1A, angle1B, angle1C, angle1A_F, angle1B_F, angle1C_F};
    //double[] angles1Single = {angle1A, angle1A_F};
    double[,] angles1Rel = {
      {angle1AA, angle1AB, angle1AC, angle1AA_F, angle1AB_F, angle1AC_F},
      {angle1BA, angle1BB, angle1BC, angle1BA_F, angle1BB_F, angle1BC_F},
      {angle1CA, angle1CB, angle1CC, angle1CA_F, angle1CB_F, angle1CC_F},
      {angle1A_FA, angle1A_FB, angle1A_FC, angle1A_FA_F, angle1A_FB_F, angle1A_FC_F},
      {angle1B_FA, angle1B_FB, angle1B_FC, angle1B_FA_F, angle1B_FB_F, angle1B_FC_F},
      {angle1C_FA, angle1C_FB, angle1C_FC, angle1C_FA_F, angle1C_FB_F, angle1C_FC_F}
      };

    // Set up the angle arrays
    double[] angles2Start = {angle2A0, angle2B0, angle2C0, angle2A_F0, angle2B_F0, angle2C_F0};

    double[] angles2Single = {angle2A, angle2B, angle2C, angle2A_F, angle2B_F, angle2C_F};
    //double[] angles1Single = {angle1A, angle1A_F};
    double[,] angles2Rel = {
      {angle2AA, angle2AB, angle2AC, angle2AA_F, angle2AB_F, angle2AC_F},
      {angle2BA, angle2BB, angle2BC, angle2BA_F, angle2BB_F, angle2BC_F},
      {angle2CA, angle2CB, angle2CC, angle2CA_F, angle2CB_F, angle2CC_F},
      {angle2A_FA, angle2A_FB, angle2A_FC, angle2A_FA_F, angle2A_FB_F, angle2A_FC_F},
      {angle2B_FA, angle2B_FB, angle2B_FC, angle2B_FA_F, angle2B_FB_F, angle2B_FC_F},
      {angle2C_FA, angle2C_FB, angle2C_FC, angle2C_FA_F, angle2C_FB_F, angle2C_FC_F}
      };



    List<double> angles1 = angle1Projected(linesAtNodes, plane);
    double angle2Start;
    List<double> angles2 = angle2Projected(linesAtNodes, plane, plane2, out angle2Start);
    A = angles1Single;
    B = angle2Start;
    C = angles1Rel;
    List<int> path = new List<int>();
    int count = angles1Single.Length;

    double optCost = Double.PositiveInfinity;
    for(int i = 0; i < count; i++){
      double cost = 0;
      double cost_1 = cost1(angles1, angles1Single[i]) + cost1_2(angles2, angle2Start, angles2Single[i], angles2Start[i]);
      cost += cost_1;
      if (cost < optCost){
        for(int j = 0; j < count; j++){
          cost = cost_1;
          double cost_2 = cost2(angles1, angles1Single[j], angles1Rel[i, j]) + cost2_2(angles2, angles2Single[j], angles2Rel[i, j]);
          cost += cost_2;
          if (cost < optCost){
            for(int q = 0; q < count; q++){
              cost = cost_1 + cost_2;
              double cost_3 = cost3(angles1, angles1Single[q], angles1Rel[j, q], angles1Rel[i, q]) + cost3_2(angles2, angles2Single[q], angles2Rel[j, q], angles2Rel[i, q]);
              cost += cost_3;
              if(cost < optCost){
                path.Clear();
                path.Add(i);
                path.Add(i);
                path.Add(j);
                path.Add(j);
                path.Add(q);
                optCost = cost;
                Print(cost.ToString());
              }
            }
          }
        }
      }
    }
    E = path;
    D = changeLines(linesAtNodes, path, angles1Single, angles1Rel, angles2Single, angles2Rel, angles2Start, plane, plane2);
# ---------- c_script_2: C# additional code ----------
  // returns the angle of the projected lines
  private List<double> angle1Projected(List<Line> lns, Plane pl){
    List<double> angles = new List<double>();
    if(RhinoMath.ToDegrees(Vector3d.VectorAngle(lns[0].Direction, lns[1].Direction, pl)) > 180){
      for(int i = 0; i < lns.Count; i++)
        if (i < lns.Count - 1)
          angles.Add(360.0 - RhinoMath.ToDegrees(Vector3d.VectorAngle(lns[i].Direction, lns[i + 1].Direction, pl)));
        else
          angles.Add(360.0 - RhinoMath.ToDegrees(Vector3d.VectorAngle(lns[i].Direction, lns[0].Direction, pl)));
      Globals.flipAngle = 1;
    }
    else{

      for(int i = 0; i < lns.Count; i++)
        if (i < lns.Count - 1)
          angles.Add(RhinoMath.ToDegrees(Vector3d.VectorAngle(lns[i].Direction, lns[i + 1].Direction, pl)));
        else
          angles.Add(RhinoMath.ToDegrees(Vector3d.VectorAngle(lns[i].Direction, lns[0].Direction, pl)));
      Globals.flipAngle = 0;
    }
    return angles;
  }

  // returns the starting angle and then the relative angles
  private List<double> angle2Projected(List<Line> lns, Plane pl, List<Plane> plns, out double angleStart){
    List<double> angles = new List<double>();
    List<double> anglesOriginal = new List<double>();
    angleStart = 0.0;
    for(int i = 0; i < lns.Count; i++){
      Line holderLn = new Line(lns[i].From, pl.ClosestPoint(lns[i].To));
      Plane holderPl = plns[i];
      anglesOriginal.Add(RhinoMath.ToDegrees(Vector3d.VectorAngle(lns[i].Direction, holderLn.Direction, holderPl)));
    }

    angleStart = anglesOriginal[0];
    for(int i = 0; i < lns.Count; i++)
    {
      var holder = i + 1;
      if (holder == lns.Count)
        holder = 0;

      angles.Add(anglesOriginal[holder] - anglesOriginal[i]);

    }


    return angles;
  }

  // cost of first operation angle 1
  private double cost1(List<double> angles1, double angle1Single){
    return Math.Abs(angles1[0] - angle1Single);
  }

  //cost of second operation angle 1
  private double cost2(List<double> angles1, double angle1Single, double angle1Rel){
    return Math.Abs(angles1[1] - angle1Rel) + Math.Abs(angles1[2] - angle1Single) ;
  }

  // cost of third operation angle 1
  private double cost3(List<double> angles1, double angle1Single, double angle1Rel, double angle1RelStart){
    return Math.Abs(angles1[3] - angle1Rel) + Math.Abs(angles1[4] - angle1Single) + Math.Abs(angles1[5] - angle1RelStart);
  }
  // cost of first operation angle 2
  private double cost1_2(List<double> angles2, double angle2Start_act, double angle2Single, double angle2Start){
    return Math.Abs(angles2[0] - angle2Single) + Math.Abs(angle2Start_act - angle2Start);
  }

  //cost of second operation angle 2
  private double cost2_2(List<double> angles2, double angle2Single, double angle2Rel){
    return Math.Abs(angles2[1] - angle2Rel) + Math.Abs(angles2[2] - angle2Single) ;
  }

  // cost of third operation angle 2
  private double cost3_2(List<double> angles2, double angle2Single, double angle2Rel, double angle2RelStart){
    return Math.Abs(angles2[3] - angle2Rel) + Math.Abs(angles2[4] - angle2Single) + Math.Abs(angles2[5] - angle2RelStart);
  }

  //updates lines to current state
  private List<Line> changeLines(List<Line> lns, List<int> path, double[]angles1Single, double[,] angles1Rel, double[]angles2Single, double[,] angles2Rel, double[]angles2Start, Plane pl, List<Plane> plns2){
    List<Line> lns_Updated = new List<Line>();
    var xform = Rhino.Geometry.Transform.Rotation(RhinoMath.ToRadians(360 - angles1Single[path[0]]), pl.ZAxis, pl.Origin);;
    var xform2 = Rhino.Geometry.Transform.Rotation(RhinoMath.ToRadians(angles2Start[path[0]]), plns2[0].ZAxis, plns2[0].Origin);
    Line holderLn = new Line(lns[0].From, pl.ClosestPoint(lns[0].To));
    holderLn.Transform(xform);
    lns_Updated.Add(holderLn);

    for (int i = 0; i < lns.Count - 1; i++){

      xform = Rhino.Geometry.Transform.Rotation(RhinoMath.ToRadians(360 - angles1Single[path[i]]), pl.ZAxis, pl.Origin);
      if ( i % 2 == 1) {
        xform = Rhino.Geometry.Transform.Rotation(RhinoMath.ToRadians(360 - angles1Rel[path[i], path[i + 1]]), pl.ZAxis, pl.Origin);
      }
      if(Globals.flipAngle == 0){
        xform = Rhino.Geometry.Transform.Rotation(RhinoMath.ToRadians(angles1Single[path[i]]), pl.ZAxis, pl.Origin);
        if ( i % 2 == 1) {
          xform = Rhino.Geometry.Transform.Rotation(RhinoMath.ToRadians(angles1Rel[path[i], path[i + 1]]), pl.ZAxis, pl.Origin);
        }
      }


      Line holder = new Line(lns_Updated[lns_Updated.Count - 1].From, lns_Updated[lns_Updated.Count - 1].To);
      holder.Transform(xform);
      if ( i % 2 == 1)
        xform2 = Rhino.Geometry.Transform.Rotation(RhinoMath.ToRadians(angles2Rel[path[i], path[i + 1]]), plns2[i + 1].ZAxis, plns2[i + 1].Origin);
      else
        xform2 = Rhino.Geometry.Transform.Rotation(RhinoMath.ToRadians(angles2Single[path[i]]), plns2[i + 1].ZAxis, plns2[i + 1].Origin);
      holder.Transform(xform2);


      lns_Updated.Add(holder);

    }
    return lns_Updated;
  }
# ---------- end c_script_2 ----------
angle_14 = Angle(VectorA=project_10.Geometry, VectorB=shift_5, Plane=filteredplanes_6)  # -> Angle, Reflex
crv_31 = Curve(dam_2)
deg_12 = Degrees(Radians=angle_12.Angle)
deg_13 = Degrees(Radians=angle_13.Angle)
deg_14 = Degrees(Radians=angle_14.Angle)
panel_63 = Panel(extremums_20.Maximum)
panel_64 = Panel(expression_9)
_1n_2 = OneNode(Angle10=genes_2, Angle20=genes, LinesAtNodes=crv_2, Plane=pln_8, Plane2=bang_3._000177)  # -> OutTest, NewLines; disabled
expression_10 = Expression(x=deg_12, Expression="if(x>180, 360-x, x)")
expression_11 = Expression(x=deg_13, Expression="if(x>180, 360-x, x)")
check_angles = Panel(expression_11)
subtraction_21 = Subtraction(A=panel_56, B=check_angles)
abs_10 = Absolute(Value=subtraction_21)
ma_3 = MassAddition(Input=abs_10)  # -> Result, PartialResults
item_27 = ListItem(List=bang_3._000177, Index=0, Wrap=True)  # -> Item, Item1
expression_12 = Expression(x=deg_14, Expression="if(x>180, 360-x, x)")
panel_65 = Panel(expression_12)
line_3 = Line(c_script_2.D)
panel_66 = Panel(c_script_2.D)
panel_67 = Panel(single_node.A)
panel_68 = Panel(dam_3)
item_28 = ListItem(List=line_3, Index=0, Wrap=True)
panel_69 = Panel(c_script_2.A)
panel_70 = Panel(c_script_2.B)
panel_71 = Panel(c_script_2.C)
subtraction_22 = Subtraction(A=expression_11, B=expression_12)
panel_72 = Panel(c_script_2.out)
abs_11 = Absolute(Value=expression_10)
panel_73 = Panel(c_script_2.E)
ma_4 = MassAddition(Input=abs_11)  # -> Result, PartialResults
check_cosst = Panel(ma_4.Result)
filteredplanes_7 = RemoteReceiver(flatten(filteredplanes))
plane2_4 = RemoteReceiver(plane2)
bang_4 = ExplodeTree(Data=panel_67)  # -> Branch0, Branch1
extremums_21 = MinMax(Number=flatten(extremums_17.Minimum))  # -> Minimum, Maximum
panel_74 = Panel(extremums_21.Maximum)
deplane_3 = DeconstructPlane(Plane=filteredplanes_7)  # -> Origin, XAxis, YAxis, ZAxis
pdecon_8 = Deconstruct(Point=deplane_3.Origin)  # -> XComponent, YComponent, ZComponent
sort_6 = SortList(Keys=pdecon_8.YComponent, ValuesA=filteredplanes_7)  # -> Keys, reverse(ValuesA)
panel_75 = Panel(bang_4.Branch0)
item_29 = ListItem(List=sort_6.ValuesA, Index=Slider(5, range=0..100), Wrap=True)
subtraction_23 = Subtraction(A=graft(othernodes_2.finalAngles), B=panel_75)
subtraction_24 = Subtraction(A=graft(othernodes.finalAngles), B=panel_75)
abs_12 = Absolute(Value=subtraction_23)
abs_13 = Absolute(Value=subtraction_24)
extremums_22 = MinMax(Number=abs_12)  # -> flatten(Minimum), Maximum
extremums_23 = MinMax(Number=abs_13)  # -> flatten(Minimum), Maximum
addition_5 = Addition(A=extremums_22.Minimum, B=extremums_23.Minimum)  # -> flatten(Result)
extremums_24 = MinMax(Number=addition_5)  # -> flatten(Minimum), Maximum
avr_3 = Average(Input=addition_5)
multiplication_15 = Multiplication(A=extremums_24.Maximum, B=20)
multiplication_16 = Multiplication(A=extremums_24.Maximum, B=Slider(72, range=0..100))
panel_77 = Panel(multiplication_16)
addition_6 = Addition(A=extremums_21.Maximum, B=multiplication_16, C=multiplication_3)
panel_78 = Panel(addition_6)
testforgridshell_4 = RemoteReceiver(testforgridshell)
item_30 = ListItem(List=tstat_8.Paths, Index=testforgridshell_4, Wrap=True)
branch_4 = TreeBranch(Tree=data_5, Path=item_30, MaintainPaths=True)
angle1filtered = RemoteSender(branch_4)
testforgridshell_5 = RemoteReceiver(testforgridshell)
testforgridshell_6 = RemoteReceiver(testforgridshell)
testforgridshell_7 = RemoteReceiver(testforgridshell)
item_31 = ListItem(List=tstat_3.Paths, Index=testforgridshell_5, Wrap=True)
testforgridshell_8 = RemoteReceiver(testforgridshell)
angle1filtered_2 = RemoteReceiver(angle1filtered)
item_32 = ListItem(List=tstat_4.Paths, Index=testforgridshell_6, Wrap=True)
branch_5 = TreeBranch(Tree=data, Path=item_31, MaintainPaths=True)
item_33 = ListItem(List=tstat_5.Paths, Index=testforgridshell_8, Wrap=True)
branch_6 = TreeBranch(Tree=data_2, Path=item_32, MaintainPaths=True)
item_34 = ListItem(List=tstat_6.Paths, Index=testforgridshell_7, Wrap=True)
trim_11 = TrimTree(Tree=angle1filtered_2, Depth=1)
branch_7 = TreeBranch(Tree=data_3, Path=item_33, MaintainPaths=True)
testforgridshell_9 = RemoteReceiver(testforgridshell)
branch_8 = TreeBranch(Tree=data_4, Path=item_34, MaintainPaths=True)
tag = TextTag(Location=branch_5, Text=trim_11, Colour=ColourSwatch(SwatchColor=RGB(0, 0, 0)))
item_35 = ListItem(List=branch_8, Index=0, Wrap=True)  # -> Item, Item1
angle1filtered_3 = RemoteReceiver(angle1filtered)
tag_2 = TextTag(Location=[item_35.Item, item_35.Item1], Text=panel_14, Colour=ColourSwatch(SwatchColor=RGB(0, 0, 0)))
tag_3 = TextTag(Location=branch_6, Text=branch_7, Colour=ColourSwatch(SwatchColor=RGB(255, 153, 153)))
angle1filtered_4 = RemoteReceiver(angle1filtered)
cull_i_3 = CullIndex(List=sort_5.ValuesA, Indices=series, Wrap=True)
gridshell_lines_6 = RemoteReceiver(gridshell_lines)
previewlw_14 = CustomPreviewLineweights(Geometry=item_19, Shader=ColourSwatch(SwatchColor=RGB(38, 173, 83)), Thickness=Slider(6, range=0..10), Absolute=False)
item_36 = ListItem(List=cull_i_3, Index=series_2, Wrap=True)
mp_6 = Midpoint(Curve=gridshell_lines_6)
cull_i_4 = CullIndex(List=cull_i_3, Indices=series_2, Wrap=True)
pdecon_9 = Deconstruct(Point=mp_6)  # -> XComponent, YComponent, ZComponent
end_15 = EndPoints(Curve=cull_i_3)  # -> Start, End
previewlw_15 = CustomPreviewLineweights(
    Geometry=firstdeformation_2,
    Shader=ColourSwatch(SwatchColor=RGB(0, 98, 255)),
    Thickness=Slider(1.92, range=0..10),
    Absolute=False)
sort_7 = SortList(Keys=pdecon_9.XComponent, ValuesA=gridshell_lines_6)  # -> Keys, ValuesA
supports_4 = RemoteReceiver(supports)
merge_26 = Merge(Data1=end_15.Start, Data2=end_15.End)
previewlw_16 = CustomPreviewLineweights(Geometry=item_36, Shader=ColourSwatch(SwatchColor=RGB(255, 157, 0)), Thickness=Slider(6, range=0..10), Absolute=False)
partition_2 = PartitionList(List=sort_7.ValuesA, Size=panel_15)
cullpt_7 = CullDuplicates(Points=merge_26, Tolerance=0.1, CullMode=1)  # -> Points, Indices, Valence
mp_7 = Midpoint(Curve=partition_2)
pdecon_10 = Deconstruct(Point=mp_7)  # -> XComponent, YComponent, ZComponent
cp_6 = ClosestPoint(Point=supports_4, Cloud=cullpt_7.Points)  # -> ClosestPoint, CPIndex, Distance
sort_8 = SortList(Keys=pdecon_10.YComponent, ValuesA=partition_2)  # -> Keys, reverse(simplify(ValuesA))
joint_agent_4 = BeamJointAgentKaramba3D(
    ToGeometry=cullpt_7.Points,
    Ct_kN_m=Vector(0, 0, 0),
    Cr_kNm_rad=Vector(0, 0, 0),
    menu=[buttons(off, off, off, off, off, off)])
linetobeam_3 = LineToBeamKaramba3D(
    Line=cull_i_3,
    CrossSection=cross_section_3,
    New=True,
    Remove=True,
    LimitDistance_m=0.005,
    Bending=True,
    SetBucklingLength=True,
    ToPolylineMaxAngle=0.03,
    ToPolylineTolerance=0.01,
    ToPolylineMinEdgeLength=0.25)  # -> Element, Points, Info
supp_3 = SupportKaramba3D(PosInd=cp_6.ClosestPoint, menu=[buttons(on, on, on, off, off, off)])
tstat_9 = TreeStatistics(Tree=sort_8.ValuesA)  # -> Paths, Length, Count
lng_6 = ListLength(List=tstat_9.Paths)
assemble_3 = AssembleModelKaramba3D(Elem=flatten(linetobeam_3.Element), Support=flatten(supp_3), Load=loads_3, Joint=joint_agent_4, LimitDistance_m=0.005)  # -> Model, Info, Mass_kg, CenterOfGravity, LoadCaseNames
bang_5 = ExplodeTree(Data=sort_8.ValuesA)  # -> Branch0, Branch1, Branch2
gridshell_3 = RemoteReceiver(gridshell)
subtraction_25 = Subtraction(A=lng_6, B="2")
dom_4 = ConstructDomain(DomainStart="1", DomainEnd=subtraction_25)
subset_2 = SubList(List=tstat_9.Paths, Domain=dom_4, Wrap=True)  # -> List, Index
branch_9 = TreeBranch(Tree=sort_8.ValuesA, Path=subset_2.List, MaintainPaths=False)  # -> flatten(Branch)
partition_3 = PartitionList(List=branch_9, Size=panel_16)
tstat_10 = TreeStatistics(Tree=partition_3)  # -> Paths, Length, Count
split_3 = SplitList(List=tstat_10.Paths, Index=2)  # -> ListA, ListB
branch_10 = TreeBranch(Tree=partition_3, Path=split_3.ListA, MaintainPaths=True)
ladeform_3 = LargeDeformationAnalysisKaramba3D(Model=assemble_3.Model, Increments=5, MaximumDisplacement_m=-1)  # -> CalculatedModel, MaximumDisplacement_cm
mp_8 = Midpoint(Curve=branch_10)
pdecon_11 = Deconstruct(Point=mp_8)  # -> XComponent, YComponent, ZComponent
sort_9 = SortList(Keys=pdecon_11.YComponent, ValuesA=branch_10)  # -> Keys, reverse(simplify(ValuesA))
bang_6 = ExplodeTree(Data=sort_9.ValuesA)  # -> Branch0, Branch1
crv_32 = Curve(bang_6.Branch1)
crv_33 = Curve(bang_6.Branch0)
da_upper_row_asm = DynamicAnglesUpperRowStaticAnglesMulti(
    TopLines=crv_32,
    DiagonalLines=crv_33,
    TopLineIndex=panel_20,
    DiagonalIndex="4",
    CastingIndex=genes_18,
    TopAngles1=genes_11,
    TopAngles2=genes_12,
    SideAngles=genes_9,
    DomeMesh=gridshell_3)  # -> OriginalLines, ChangedPoints, ChangedLines, AnglesTop, AnglesSide, TestingPoint, Cost, AngleCost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; disabled
item_37 = ListItem(List=crv_32, Index=0, Wrap=True)  # -> Item, Item1, Item2, Item3
item_38 = ListItem(List=crv_33, Index=0, Wrap=True)  # -> Item, Item1, Item2, Item3, Item4, Item5, Item6, Item7
item_39 = ListItem(List=bang_6.Branch0, Index=Slider(5, range=0..100), Wrap=True)
item_40 = ListItem(List=bang_6.Branch0, Index=0, Wrap=True)  # -> Item, Item1, Item2
item_41 = ListItem(List=bang_6.Branch1, Index=0, Wrap=True)
da_upper_row_ar = DynamicAnglesUpperRowRelationAngles(
    TopLines=crv_32,
    DiagonalLines=crv_33,
    TopLineIndex=number_slider_12,
    DiagonalIndex=number_slider_14,
    CastingIndex=genes_10,
    TopAngles1=genes_11,
    TopAngles2=subtraction_6,
    SideAngles=genes_9,
    DomeMesh=gridshell_3)  # -> OriginalLines, ChangedPoints, ChangedLines, AnglesTop, AnglesSide, TestingPoint, Cost, Cost1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
panel_79 = Panel(da_upper_row_ar.Cost1)
panel_80 = Panel(da_upper_row_ar.Castings)
panel_81 = Panel(da_upper_row_ar.Cost2)
panel_82 = Panel(da_upper_row_ar.Cost3)
crv_34 = Curve(bang_6.Branch1)
panel_83 = Panel(da_upper_row_ar.Cost)
modelview_3 = ModelViewKaramba3D(Model=ladeform_3.CalculatedModel, ResultFactors=1, ResultCase=-1)  # -> Model, DeformedMesh, DeformedAxes, DeformedModel
merge_27 = Merge(Data1=item_40.Item, Data2=item_40.Item1, Data3=item_40.Item2, Data4=flatten(item_41))
crv_35 = Curve(merge_27)
extremums_25 = MinMax(Number=flatten(da_upper_row_ar.Cost))  # -> Minimum, Maximum
sort_val_2 = SortDuplicateValues(ValueList=flatten(panel_80))  # -> UniqueValues, Indices
unincluded_lines = Curve([crv_35, crv_7])
seconddeformation = RemoteSender(modelview_3.DeformedAxes)
demesh_2 = DeconstructMesh(Mesh=gridshell_3)  # -> Vertices, Faces, Colours, Normals
panel_84 = Panel(extremums_25.Maximum)
crv_36 = Curve(da_upper_row_ar.ChangedLines)
crv_37 = Curve(da_upper_row_asm.ChangedLines)
crv_38 = Curve(da_upper_row_ar.ChangedLines)
da_upper_row_ar_2 = DynamicAnglesUpperRowRelationAngles(
    TopLineIndex=number_slider_12,
    DiagonalIndex=number_slider_13,
    CastingIndex=genes_18,
    TopAngles1=genes_16,
    TopAngles2=genes_17,
    SideAngles=genes_15,
    DomeMesh=gridshell_3)  # -> OriginalLines, ChangedPoints, ChangedLines, AnglesTop, AnglesSide, TestingPoint, Cost, Cost1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; disabled
item_42 = ListItem(List=bang_6.Branch1, Index=0, Wrap=True)  # -> Item, Item1, Item2, Item3
beamview_2 = BeamViewKaramba3D(Model=modelview_3.Model)  # -> Model, MeshesOfRenderedBeams, DeformedBeamAxes, LegendColors, LegendTags
item_43 = ListItem(List=bang_6.Branch0, Index=0, Wrap=True)  # -> Item, Item1, Item2, Item3, Item4, Item5, Item6, Item7, Item8
previewlw_17 = CustomPreviewLineweights(
    Geometry=crv_37,
    Shader={diffuse=RGB(255, 105, 180), emission=RGB(76, 32, 54), shine=0.5, specular=RGB(255, 255, 255), transparency=0},
    Thickness=Slider(4, range=0..10),
    Absolute=False)
lng_7 = ListLength(List=bang_6.Branch1)
panel_85 = Panel(da_upper_row_ar.Cost4)
da_upper_row_as = DynamicAnglesUpperRowStaticAngles(
    TopLines=bang_6.Branch1,
    DiagonalLines=bang_6.Branch0,
    TopLineIndex=number_slider_12,
    DiagonalIndex=number_slider_13,
    CastingIndex=genes_18,
    TopAngles1=genes_13,
    TopAngles2=subtraction_7,
    SideAngles=genes_14,
    DomeMesh=gridshell_3)  # -> OriginalLines, ChangedPoints, ChangedLines, AnglesTop, AnglesSide, TestingPoint, Cost, AngleCost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
panel_87 = Panel(da_upper_row_as.AnglesSide)
panel_88 = Panel(da_upper_row_ar.AnglesTop)
line_4 = LineSDL(Start=demesh_2.Vertices, Direction=demesh_2.Normals, Length=1)
panel_89 = Panel(da_upper_row_ar.Castings)
panel_90 = Panel(da_upper_row_ar.AngleCost)
da_upper_row = DynamicAnglesUpperRow(
    TopLines=bang_6.Branch1,
    DiagonalLines=bang_6.Branch0,
    TopLineIndex=number_slider_12,
    DiagonalIndex=number_slider_13,
    TopAngles=genes_20,
    SideAngles=genes_19,
    DomeMesh=gridshell_3)  # -> OriginalLines, ChangedPoints, ChangedLines, AnglesTop, AnglesSide, TestingPoint, Cost, AngleCost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; disabled
panel_91 = Panel(da_upper_row.AngleCost)
bang_7 = ExplodeTree(Data=da_upper_row.TopPlanes)
crv_39 = Curve(da_upper_row.ChangedLines)
item_44 = ListItem(List=bang_7, Index=0, Wrap=True)
bang_8 = ExplodeTree(Data=da_upper_row.NewMeshes)  # -> Branch0, Branch1, Branch2, Branch3, Branch4, Branch5, Branch6, Branch7, Branch8, Branch9
mesh = Mesh(bang_8.Branch1)
panel_92 = Panel(da_upper_row_asm.AnglesTop)
extremums_26 = MinMax(Number=flatten(da_upper_row_ar_2.Cost))  # -> Minimum, Maximum
da_upper_row_2 = DynamicAnglesUpperRow(
    TopLines=bang_6.Branch1,
    DiagonalLines=bang_6.Branch0,
    TopLineIndex=number_slider_12,
    DiagonalIndex=number_slider_13,
    TopAngles=genes_20,
    SideAngles=genes_19,
    DomeMesh=gridshell_3)  # -> OriginalLines, ChangedPoints, ChangedLines, AnglesTop, AnglesSide, TestingPoint, Cost, AngleCost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; disabled
lng_8 = ListLength(List=line_4)
gridshell_4 = RemoteReceiver(gridshell)
ma_5 = MassAddition(Input=[da_upper_row_ar_2.Cost1, da_upper_row_ar_2.Cost2, da_upper_row_ar_2.Cost3, da_upper_row_ar_2.Cost4])  # -> Result, PartialResults
panel_93 = Panel(da_upper_row_asm.Cost)
facen = FaceNormals(Mesh=bang_8.Branch9)  # -> Centers, Normals
panel_94 = Panel(da_upper_row_asm.Castings)
crv_40 = Curve(da_upper_row_as.OriginalLines)
demesh_3 = DeconstructMesh(Mesh=mesh)  # -> Vertices, Faces, Colours, Normals
faceb = FaceBoundaries(Mesh=bang_8.Branch9)
series_3 = Series(Start=0, Step=1, Count=lng_8)
crv_41 = Curve(da_upper_row_ar_2.ChangedLines)
bang_9 = ExplodeTree(Data=crv_41)  # -> Branch0, Branch1
panel_95 = Panel(extremums_26.Maximum)
bang_10 = ExplodeTree(Data=crv_40)
faceb_2 = FaceBoundaries(Mesh=gridshell_4)
crv_42 = Curve(bang_6.Branch1)
crv_43 = Curve(bang_6.Branch0)
crv_44 = Curve(da_upper_row_ar_2.ChangedLines)
crv_45 = Curve(da_upper_row_2.OriginalLines)
seconddeformation_2 = RemoteReceiver(seconddeformation)
bang_11 = ExplodeTree(Data=da_upper_row.ChangedPoints)
crv_46 = Curve(partition_3)
pt_7 = Point(da_upper_row_ar_2.ChangedPoints)
demesh_4 = DeconstructMesh(Mesh=bang_8.Branch9)  # -> Vertices, Faces, Colours, Normals
line_5 = LineSDL(Start=demesh_4.Vertices, Direction=demesh_4.Normals, Length=1)
xprod = CrossProduct(VectorA=line_5, VectorB=line_4, Unitize=False)  # -> Vector, Length
larger_3 = LargerThan(FirstNumber=xprod.Length, SecondNumber=Slider(0.001, range=0..1))  # -> LargerThan, OrEqualTo
panel_97 = Panel(xprod.Length)
crv_47 = Curve(bang_6.Branch1)
crv_48 = Curve(bang_6.Branch0)
crv_49 = Curve(partition_3)
seconddeformation_3 = RemoteReceiver(seconddeformation)
split_4 = SplitList(List=crv_42, Index=panel_20)  # -> ListA, ListB
split_5 = SplitList(List=crv_43, Index="4")  # -> ListA, ListB
panel_98 = Panel(da_upper_row_ar_2.Cost4)
crv_50 = Curve(partition_3)
split_6 = SplitList(List=crv_47, Index=panel_20)  # -> ListA, ListB
split_7 = SplitList(List=crv_48, Index="4")  # -> ListA, ListB
dispatch_12 = Dispatch(List=series_3, DispatchPattern=larger_3.LargerThan)  # -> ListA, ListB
item_45 = ListItem(List=line_5, Index=dispatch_12.ListA, Wrap=True)
cluster_10 = Cluster_8(T=partition_3, P=split_3.ListB, _0_x=da_upper_row_2.ChangedLines, _1_x=unincluded_lines)  # -> crv_3, L, R
extremums_27 = MinMax(Number=flatten(da_upper_row_ar_2.Cost))  # -> Minimum, Maximum
extremums_28 = MinMax(Number=flatten(da_upper_row_ar_2.Cost1))  # -> Minimum, Maximum
extremums_29 = MinMax(Number=flatten(da_upper_row_ar_2.Cost2))  # -> Minimum, Maximum
line_6 = LineSDL(Start=demesh_4.Vertices, Direction=demesh_4.Normals, Length=1)
panel_99 = Panel(da_upper_row_2.AngleCost)
item_46 = ListItem(List=bang_11, Index=0, Wrap=True)
extremums_30 = MinMax(Number=flatten(da_upper_row_ar_2.Cost3))  # -> Minimum, Maximum
extremums_31 = MinMax(Number=flatten(da_upper_row_ar_2.Cost4))  # -> Minimum, Maximum
panel_100 = Panel(da_upper_row_ar_2.Castings)
panel_101 = Panel(da_upper_row_asm.AngleCost)
panel_102 = Panel(da_upper_row_2.AnglesSide)
crv_51 = Curve([da_upper_row_as.ChangedLines, split_4.ListA, split_5.ListA])
dist_4 = Distance(PointA=item_46, PointB=demesh_4.Vertices)
cp_7 = ClosestPoint(Point=item_46, Cloud=demesh_4.Vertices)  # -> ClosestPoint, CPIndex, Distance
wlc_objective_cost3_min = Number(extremums_30.Maximum)
wlc_objective_cost2_min = Number(extremums_29.Maximum)
wlc_objective_cost_min = Number(extremums_27.Maximum)
gridshell_lines_7 = RemoteReceiver(gridshell_lines)
wlc_objective_cost1_min = Number(extremums_28.Maximum)
wlc_objective_cost4_min = Number(extremums_31.Maximum)
merge_28 = Merge(Data1=cluster_10.crv_3, Data2=cluster_10.L)  # -> flatten(Result)
cluster_11 = Cluster_8(T=partition_3, P=split_3.ListB, _0_x=da_upper_row_ar.ChangedLines, _1_x=unincluded_lines)  # -> crv_3, L, R; disabled
sort_10 = SortList(Keys=dist_4, ValuesA=demesh_4.Vertices)  # -> Keys, ValuesA
item_47 = ListItem(List=sort_10.ValuesA, Index=0, Wrap=True)  # -> Item, Item1, Item2, Item3, Item4, Item5, Item6
del_4 = DelaunayMesh(
    Points=[item_47.Item1, item_47.Item2, item_47.Item3, item_47.Item4, item_47.Item5, item_47.Item6, item_47.Item],
    Plane=PlaneXY(0, 0, 0))
demesh_5 = DeconstructMesh(Mesh=del_4)  # -> Vertices, Faces, Colours, Normals
line_7 = LineSDL(Start=demesh_5.Vertices, Direction=demesh_5.Normals, Length=1)
panel_103 = Panel(da_upper_row_ar_2.AnglesTop)
crv_52 = Curve(da_upper_row_as.ChangedLines)
crv_53 = Curve(partition_3)
panel_104 = Panel(da_upper_row_as.AngleCost)
crv_54 = Curve(da_upper_row_asm.ChangedLines)
crv_55 = Curve(partition_3)
bang_12 = ExplodeTree(Data=crv_53)  # -> Branch0, Branch1
wallacei_x = WallaceiX(
    Genes=[genes_16, genes_15, genes_17, genes_18],
    Objectives=[wlc_objective_cost_min, wlc_objective_cost1_min, wlc_objective_cost2_min, wlc_objective_cost3_min, wlc_objective_cost4_min],
    allFitness="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",
    allFrontIdx="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",
    allGenomes="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",
    curFrontIdx="499|0;499|1;499|2;499|3;499|4;499|5;499|6;499|7;499|8;499|9;499|10;499|11;499|12;499|13;499|14;499|15;499|16;499|17;499|18;499|19;499|20;499|21;499|22;499|23;499|24;499|25;499|26;499|27;499|28;499|29;499|30;499|31;499|32;499|33;499|34;499|35;499|36;499|37;499|38;499|39;499|40;499|41;499|42;499|43;499|44;499|45;499|46;499|47;499|48;499|49",
    curFrontIdxSave="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",
    popGen="50,500",
    total="3764328",
    wlcDone=True)  # -> WallaceiGenomes, FitnessValues, Data, WPhenotypes; disabled
panel_105 = Panel(da_upper_row.AnglesTop)
mp_9 = Midpoint(Curve=merge_28)
bang_13 = ExplodeTree(Data=crv_55)  # -> Branch0, Branch1
cluster_12 = Cluster_8(T=partition_3, P=split_3.ListB, _0_x=crv_52, _1_x=unincluded_lines)  # -> crv_3, L, R; disabled
pdecon_12 = Deconstruct(Point=mp_9)  # -> XComponent, YComponent, ZComponent
sort_11 = SortList(Keys=pdecon_12.XComponent, ValuesA=merge_28)  # -> Keys, ValuesA
python = GhPythonScript(angles=flatten(da_upper_row_2.AnglesTop))  # -> out, numberOfCastings, castings; inputs angles: list
# ---------- python: Python ----------
__author__ = "mskep"
__version__ = "2022.03.19"

import rhinoscriptsyntax as rs
import Grasshopper as gh
import math
def listToTree(nestedList):
    
    """ Convert a nested python iterable to a datatree """
    
    dt = gh.DataTree[object]()
    for i,l in enumerate(nestedList):
        dt.AddRange(l,gh.Kernel.Data.GH_Path(i))
        
    return dt

numberOfCastings = []
anglesRemove = []
i = 0
length = len(angles)
castings = []
k = 0
while length != 0:
    castings.append([])
    angle = angles[0]
    angles[0] = -1
    holder = 1
    anglesRemove = [0]
    castings[-1].append(angle)
    print("Before " + str(len(angles)))
    for j in range(1, len(angles)):
       
        angle2 = angles[j]
        if abs(angle - angle2) < 0.02:
            holder+= 1
            angles[j] = -1
            castings[-1].append(angle2)
    anglesHolder = []

    for angle in angles:
        
        if angle != -1:
            anglesHolder.append(angle)
    angles = anglesHolder[:]

    
    numberOfCastings.append(holder)
    length = len(angles)
    k+=1
    
    if k > 100:
        break
castings = listToTree(castings)
# ---------- end python ----------
python_2 = GhPythonScript(angles=flatten(da_upper_row_2.AnglesSide))  # -> out, numberOfCastings, castings; inputs angles: list; same code as python
merge_29 = Merge(Data1=cluster_11.crv_3, Data2=cluster_11.L)  # -> flatten(Result); disabled
merge_30 = Merge(Data1=cluster_12.crv_3, Data2=cluster_12.L)  # -> flatten(Result)
partition_4 = PartitionList(List=sort_11.ValuesA, Size=panel_22)
mp_10 = Midpoint(Curve=partition_4)
panel_108 = Panel(da_upper_row_2.AnglesTop)
pdecon_13 = Deconstruct(Point=mp_10)  # -> XComponent, YComponent, ZComponent
mp_11 = Midpoint(Curve=merge_30)
pdecon_14 = Deconstruct(Point=mp_11)  # -> XComponent, YComponent, ZComponent
mp_12 = Midpoint(Curve=merge_29)
sort_12 = SortList(Keys=pdecon_13.YComponent, ValuesA=partition_4)  # -> Keys, reverse(simplify(ValuesA))
pdecon_15 = Deconstruct(Point=mp_12)  # -> XComponent, YComponent, ZComponent
sort_13 = SortList(Keys=pdecon_14.XComponent, ValuesA=merge_30)  # -> Keys, ValuesA
tstat_11 = TreeStatistics(Tree=sort_12.ValuesA)  # -> Paths, Length, Count
branch_11 = TreeBranch(Tree=sort_12.ValuesA, Path=tstat_11.Paths, MaintainPaths=False)
entwine_2 = Entwine(Branch00=branch_11, Branch01=cluster_10.R, FlattenInputs=True)  # -> flatten(Result)
end_16 = EndPoints(Curve=flatten(entwine_2))  # -> Start, End
sort_14 = SortList(Keys=pdecon_15.XComponent, ValuesA=merge_29)  # -> Keys, ValuesA
tstat_12 = TreeStatistics(Tree=branch_11)  # -> Paths, Length, Count
merge_31 = Merge(Data1=end_16.Start, Data2=end_16.End)
partition_5 = PartitionList(List=sort_13.ValuesA, Size=panel_23)
split_8 = SplitList(List=tstat_12.Paths, Index=2)  # -> ListA, ListB
branch_12 = TreeBranch(Tree=branch_11, Path=split_8.ListA, MaintainPaths=True)
bang_14 = ExplodeTree(Data=branch_12)  # -> Branch0, Branch1
cluster_13 = Cluster_9(L_3=flatten(partition_2), L=da_upper_row_2.ChangedLines, L_2=da_upper_row_2.ChangedLines)
partition_6 = PartitionList(List=sort_14.ValuesA, Size=panel_24)
cullpt_8 = CullDuplicates(Points=merge_31, Tolerance=0.1, CullMode=1)  # -> Points, Indices, Valence
panel_109 = Panel(python.castings)
panel_110 = Panel(python_2.castings)
mp_13 = Midpoint(Curve=partition_5)
del_5 = DelaunayMesh(Points=cullpt_8.Points, Plane=PlaneXY(0, 0, 0))
da_upper_row_3 = DynamicAnglesUpperRow(
    TopLines=bang_14.Branch1,
    DiagonalLines=bang_14.Branch0,
    TopLineIndex=Slider(1, range=0..1),
    DiagonalIndex=Slider(3, range=0..10),
    TopAngles=genes_20,
    SideAngles=genes_19,
    DomeMesh=del_5)  # -> OriginalLines, ChangedPoints, ChangedLines, AnglesTop, AnglesSide, TestingPoint, Cost, AngleCost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
crv_56 = Curve([da_upper_row_2.ChangedLines, da_upper_row_3.ChangedLines])
extremums_32 = MinMax(Number=flatten([da_upper_row_2.Cost, da_upper_row_3.Cost]))  # -> Minimum, Maximum
panel_111 = Panel(extremums_32.Maximum)
entwine_3 = Entwine(Branch0X=da_upper_row_3.ChangedLines, Branch1X=da_upper_row_2.ChangedLines, FlattenInputs=False)
mp_14 = Midpoint(Curve=partition_6)
panel_112 = Panel(da_upper_row_as.AnglesTop)
pdecon_16 = Deconstruct(Point=mp_13)  # -> XComponent, YComponent, ZComponent
pdecon_17 = Deconstruct(Point=mp_14)  # -> XComponent, YComponent, ZComponent
sort_15 = SortList(Keys=pdecon_16.YComponent, ValuesA=partition_5)  # -> Keys, reverse(simplify(ValuesA))
sort_16 = SortList(Keys=pdecon_17.YComponent, ValuesA=partition_6)  # -> Keys, reverse(simplify(ValuesA))
tstat_13 = TreeStatistics(Tree=sort_15.ValuesA)  # -> Paths, Length, Count
branch_13 = TreeBranch(Tree=sort_15.ValuesA, Path=tstat_13.Paths, MaintainPaths=False)
entwine_4 = Entwine(Branch00=branch_13, Branch01=cluster_12.R, FlattenInputs=True)  # -> flatten(Result)
end_17 = EndPoints(Curve=flatten(entwine_4))  # -> Start, End
tstat_14 = TreeStatistics(Tree=branch_13)  # -> Paths, Length, Count
tstat_15 = TreeStatistics(Tree=sort_16.ValuesA)  # -> Paths, Length, Count
branch_14 = TreeBranch(Tree=sort_16.ValuesA, Path=tstat_15.Paths, MaintainPaths=False)
entwine_5 = Entwine(Branch00=branch_14, Branch01=cluster_11.R, FlattenInputs=True)  # -> flatten(Result)
end_18 = EndPoints(Curve=flatten(entwine_5))  # -> Start, End
merge_32 = Merge(Data1=end_17.Start, Data2=end_17.End)
cluster_14 = Cluster_9(L_3=flatten(cluster_13), L=da_upper_row_3.ChangedLines, L_2=entwine_3)
bang_15 = ExplodeTree(Data=da_upper_row_3.NewMeshes)  # -> Branch0, Branch1, Branch2, Branch3, Branch4, Branch5, Branch6, Branch7, Branch8, Branch9
demesh_6 = DeconstructMesh(Mesh=bang_15.Branch8)  # -> Vertices, Faces, Colours, Normals
tstat_16 = TreeStatistics(Tree=branch_14)  # -> Paths, Length, Count
split_9 = SplitList(List=tstat_14.Paths, Index=2)  # -> ListA, ListB
branch_15 = TreeBranch(Tree=branch_13, Path=split_9.ListA, MaintainPaths=True)
merge_33 = Merge(Data1=end_18.Start, Data2=end_18.End)
line_8 = LineSDL(Start=demesh_6.Vertices, Direction=demesh_6.Normals, Length=1)
panel_114 = Panel(da_upper_row_3.AnglesTop)
cullpt_9 = CullDuplicates(Points=merge_32, Tolerance=0.1, CullMode=1)  # -> Points, Indices, Valence
split_10 = SplitList(List=tstat_16.Paths, Index=2)  # -> ListA, ListB
branch_16 = TreeBranch(Tree=branch_14, Path=split_10.ListA, MaintainPaths=True)
num_2 = Number(flatten(panel_112))
python_3 = GhPythonScript(angles=flatten(panel_112))  # -> out, numberOfCastings, castings; inputs angles: list; same code as python
bang_16 = ExplodeTree(Data=da_upper_row_3.NewMeshes)  # -> Branch0, Branch1, Branch2, Branch3, Branch4, Branch5, Branch6, Branch7, Branch8, Branch9
bang_17 = ExplodeTree(Data=branch_15)  # -> Branch0, Branch1
gridshell_lines_8 = RemoteReceiver(gridshell_lines)
merge_34 = Merge(Data2=flatten(cluster_14), Data3=flatten(entwine_3))  # -> flatten(Result)
cullpt_10 = CullDuplicates(Points=merge_33, Tolerance=0.1, CullMode=1)  # -> Points, Indices, Valence
del_6 = DelaunayMesh(Points=cullpt_9.Points, Plane=PlaneXY(0, 0, 0))
panel_115 = Panel(da_upper_row_3.AngleCost)
previewlw_18 = CustomPreviewLineweights(
    Geometry=crv_56,
    Shader={diffuse=RGB(255, 105, 180), emission=RGB(76, 32, 54), shine=0.5, specular=RGB(255, 255, 255), transparency=0},
    Thickness=Slider(4, range=0..10),
    Absolute=False)
end_19 = EndPoints(Curve=gridshell_lines_8)  # -> Start, End
bang_18 = ExplodeTree(Data=branch_16)  # -> Branch0, Branch1
del_7 = DelaunayMesh(Points=cullpt_10.Points, Plane=PlaneXY(0, 0, 0))
sort_val_3 = SortDuplicateValues(ValueList=flatten(panel_112))  # -> UniqueValues, Indices
merge_35 = Merge(Data1=end_19.Start, Data2=end_19.End)
panel_116 = Panel(num_2)
ma_6 = MassAddition(Input=python_3.numberOfCastings)  # -> Result, PartialResults
da_upper_row_as_2 = DynamicAnglesUpperRowStaticAngles(
    TopLines=bang_17.Branch1,
    DiagonalLines=bang_17.Branch0,
    TopLineIndex=Slider(1, range=0..1),
    DiagonalIndex=Slider(3, range=0..10),
    CastingIndex=genes_18,
    TopAngles1=genes_13,
    SideAngles=genes_14,
    DomeMesh=del_6)  # -> OriginalLines, ChangedPoints, ChangedLines, AnglesTop, AnglesSide, TestingPoint, Cost, AngleCost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
extremums_33 = MinMax(Number=flatten([da_upper_row_as.Cost, da_upper_row_as_2.Cost]))  # -> Minimum, Maximum
panel_117 = Panel(extremums_33.Maximum)
rad = Radians(Degrees=panel_115)
previewlw_19 = CustomPreviewLineweights(
    Geometry=da_upper_row_3.ChangedLines,
    Shader={diffuse=RGB(255, 105, 180), emission=RGB(76, 32, 54), shine=0.5, specular=RGB(255, 255, 255), transparency=0},
    Thickness=Slider(4, range=0..10),
    Absolute=False)
cull_curves_2 = CullCurvesKaramba3D(Curves=gridshell_lines_8, LimitDistance=0.05, NumberOfSamplePoints=Slider(1, range=0..1))
end_20 = EndPoints(Curve=cull_curves_2)  # -> Start, End
cullpt_11 = CullDuplicates(Points=[end_20.Start, end_20.End], Tolerance=0.1, CullMode=1)  # -> Points, Indices, Valence
len = Length(Curve=bang_14.Branch1)
sin = Sine(Value=rad)
da_upper_row_asm_2 = DynamicAnglesUpperRowStaticAnglesMulti(
    TopLines=bang_18.Branch1,
    DiagonalLines=bang_18.Branch0,
    TopLineIndex=Slider(1, range=0..1),
    DiagonalIndex=Slider(3, range=0..10),
    CastingIndex=genes_18,
    TopAngles1=genes_11,
    TopAngles2=genes_12,
    SideAngles=genes_9,
    DomeMesh=del_7)  # -> OriginalLines, ChangedPoints, ChangedLines, AnglesTop, AnglesSide, TestingPoint, Cost, AngleCost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; disabled
extremums_34 = MinMax(Number=flatten([da_upper_row_asm.Cost, da_upper_row_asm_2.Cost]))  # -> Minimum, Maximum
panel_118 = Panel(extremums_34.Maximum)
crv_57 = Curve(da_upper_row_asm_2.ChangedLines)
crv_58 = Curve([da_upper_row_asm.ChangedLines, split_6.ListA, split_7.ListA, crv_57])
python_4 = GhPythonScript(angles=flatten([da_upper_row_asm.AnglesTop, da_upper_row_asm_2.AnglesTop]))  # -> out, numberOfCastings, castings; inputs angles: list; same code as python
del_8 = DelaunayMesh(Points=cullpt_11.Points, Plane=PlaneXY(0, 0, 0))
lng_9 = ListLength(List=python_3.numberOfCastings)
panel_119 = Panel(sort_val_3.Indices)
panel_120 = Panel(sin)
len_2 = Length(Curve=cull_curves_2)
extremums_35 = MinMax(Number=len_2)  # -> Minimum, Maximum
mesh_test = RemoteSender(del_8)
mesh_test_2 = RemoteReceiver(mesh_test)
avr_4 = Average(Input=len_2)
crv_59 = Curve(da_upper_row_as_2.ChangedLines)
panel_121 = Panel(da_upper_row_as_2.AngleCost)
da_upper_row_c = DynamicAnglesUpperRowCastings(
    TopLines=bang_6.Branch1,
    DiagonalLines=bang_6.Branch0,
    TopLineIndex=number_slider_12,
    DiagonalIndex=number_slider_13,
    TopAngles0=genes_25,
    TopAngles4=genes_28,
    TopAngles5=genes_29,
    TopAngles9=genes_26,
    DefAngles1=genes_30,
    DefAngles2=genes_27,
    SideAngles0=genes_23,
    SideAngles4=genes_22,
    SideAngles5=genes_24,
    SideAngles9=genes_21,
    DomeMesh=gridshell_3)  # -> OriginalLines, ChangedPoints, ChangedLines, AnglesTop, AnglesSide, TestingPoint, Cost, AngleCost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
panel_122 = Panel(da_upper_row_as_2.Cost)
bang_19 = ExplodeTree(Data=da_upper_row_asm_2.OriginalLines)  # -> Branch0, Branch1
multiplication_17 = Multiplication(A=panel_120, B=Slider(12, range=0..100))
panel_123 = Panel(da_upper_row_asm_2.AngleCost)
multiplication_18 = Multiplication(A=multiplication_17, B=100)
mesh_test_3 = RemoteReceiver(mesh_test)
end_21 = EndPoints(Curve=cull_curves_2)  # -> Start, End
panel_124 = Panel(da_upper_row_asm_2.Cost)
panel_125 = Panel(multiplication_17)
num_3 = Number(da_upper_row_c.MachineNumber)
division_5 = Division(A=multiplication_17, B=2)
loads_5 = LoadsKaramba3D(Vector=neg_3, Mesh=mesh_test_3, LCase="0", mode="MeshLoad -Const.", menu=[buttons(off, on, off), buttons(on, on)])
loads_6 = LoadsKaramba3D(Vector=neg, Mesh=mesh_test_2, LCase="0", mode="MeshLoad -Const.", menu=[buttons(off, on, off), buttons(on, on)])
num_4 = Number(da_upper_row_c.CastingsDist)
num_5 = Number(da_upper_row_c.CastingNumber)
panel_126 = Panel(lng_9)
panel_127 = Panel(python_3.castings)
merge_36 = Merge(Data1=end_21.Start, Data2=end_21.End)
panel_128 = Panel(num_4)
panel_129 = Panel(num_5)
panel_130 = Panel(num_3)
panel_131 = Panel(division_5)
cullpt_12 = CullDuplicates(Points=merge_36, Tolerance=0.1, CullMode=1)  # -> Points, Indices, Valence
crv_60 = Curve(da_upper_row_c.ChangedLines)
supports_5 = RemoteReceiver(supports)
cp_8 = ClosestPoint(Point=supports_5, Cloud=cullpt_12.Points)  # -> ClosestPoint, CPIndex, Distance
pdecon_18 = Deconstruct(Point=cp_8.ClosestPoint)  # -> XComponent, YComponent, ZComponent
lng_10 = ListLength(List=pdecon_18.XComponent)
sort_17 = SortList(Keys=pdecon_18.XComponent, ValuesA=cp_8.ClosestPoint)  # -> Keys, ValuesA
division_6 = Division(A=lng_10, B=2)
supp_4 = SupportKaramba3D(PosInd=cp_8.ClosestPoint, menu=[buttons(on, on, on, off, off, off)])
partition_7 = PartitionList(List=sort_17.ValuesA, Size=division_6)
bang_20 = ExplodeTree(Data=partition_7)  # -> _00000, _00001
linetobeam_4 = LineToBeamKaramba3D(
    Line=cull_curves_2,
    Identifier="wood",
    CrossSection=cross_section_4,
    New=True,
    Remove=True,
    LimitDistance_m=0.005,
    ZOrientation=Z_6,
    Bending=True,
    SetBucklingLength=True,
    ToPolylineMaxAngle=0.03,
    ToPolylineTolerance=0.01,
    ToPolylineMinEdgeLength=0.25)  # -> Element, Points, Info
assemble_4 = AssembleModelKaramba3D(
    Elem=flatten(linetobeam_4.Element),
    Support=flatten(supp_4),
    Load=flatten([loads_4, loads_5, loads_6]),
    Joint=flatten(beam_joints),
    LimitDistance_m=0.005)  # -> Model, Info, Mass_kg, CenterOfGravity, LoadCaseNames
panel_132 = Panel(python_3.out)
analyzethii = AnalyzeThIIKaramba3D(Model=assemble_4.Model, LoadCase="-1", RTolerance=1e-07, MaxIterations=50, NoTensionalNII=False)  # -> CalculatedModel, MaximumDisplacement_cm, ResultingForceOfGravity_kN, ElasticEnergyChange_kNm
analyze_2 = AnalyzeKaramba3D(Model=assemble_4.Model)  # -> CalculatedModel, MaximumDisplacement_cm, ResultingForceOfGravity_kN, ElasticEnergy_kNm
bmodes = BucklingModesKaramba3D(
    Model=analyzethii.CalculatedModel,
    FromIndex=1,
    NumberOfModes=Slider(1, range=0..10),
    MaximumNumberOfIterations=300,
    Epsilon=1e-07)  # -> ModelWithBucklingModesAsLoadCaseResults, BucklingLoadFactors
panel_133 = Panel(bmodes.BucklingLoadFactors)
subtraction_26 = Subtraction(A=bmodes.BucklingLoadFactors, B=2.5)
abs_14 = Absolute(Value=bmodes.BucklingLoadFactors)
panel_134 = Panel(analyze_2.MaximumDisplacement_cm)
modelview_4 = ModelViewKaramba3D(Model=analyze_2.CalculatedModel, ResultFactors=1, ResultCase=-1)  # -> Model, DeformedMesh, DeformedAxes, DeformedModel
panel_135 = Panel(abs_14)
beamview_3 = BeamViewKaramba3D(Model=modelview_4.Model)  # -> Model, MeshesOfRenderedBeams, DeformedBeamAxes, LegendColors, LegendTags
b_forces = BeamForcesKaramba3D(AnalyzedModel=modelview_4.Model, Ts=[0, 1])  # -> AnalyzedModel, NormalForce_kN, ShearForceVz_kN, ShearForceVy_kN, BendingMomentMt_kNm, BendingMomentMy_kNm, BendingMomentMz_kNm
mcol = MeshColours(Mesh=beamview_3.MeshesOfRenderedBeams, Colours=swatch)
abs_15 = Absolute(Value=b_forces.BendingMomentMz_kNm)
abs_16 = Absolute(Value=b_forces.BendingMomentMy_kNm)
abs_17 = Absolute(Value=b_forces.NormalForce_kN)
abs_18 = Absolute(Value=b_forces.ShearForceVy_kN)
abs_19 = Absolute(Value=b_forces.ShearForceVz_kN)
abs_20 = Absolute(Value=b_forces.BendingMomentMt_kNm)
disassemble = DisassembleModelKaramba3D(Model=analyze_2.CalculatedModel)  # -> Model, Point, Beam, Shell, Support, Load, Line, Mesh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
extremums_36 = MinMax(Number=abs_15)  # -> Minimum, Maximum
extremums_37 = MinMax(Number=abs_17)  # -> Minimum, Maximum
extremums_38 = MinMax(Number=abs_19)  # -> Minimum, Maximum
preview_2 = CustomPreview(Geometry=mcol, Material=swatch)  # disabled
previewmat = CustomPreviewMaterials(Geometry=mcol, DiffuseColor=swatch)
extremums_39 = MinMax(Number=flatten(abs_19))  # -> Minimum, Maximum
extremums_40 = MinMax(Number=abs_18)  # -> Minimum, Maximum
extremums_41 = MinMax(Number=abs_20)  # -> Minimum, Maximum
mindex_3 = MemberIndex(Set=abs_17, Member=extremums_37.Maximum)  # -> Index, Count
disassemble_2 = DisassembleElementKaramba3D(Element=disassemble.Beam)  # -> Element, ElementIdentifier, AxisOfElement, CrossSection, Joint, Material, LocalCoordinateSystem, ElementIsActive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
len_3 = Length(Curve=disassemble_2.AxisOfElement)  # -> graft(Length)
extremums_42 = MinMax(Number=abs_16)  # -> Minimum, Maximum
item_48 = ListItem(List=b_forces.NormalForce_kN, Index=mindex_3.Index, Wrap=True)
num_6 = Number(flatten(item_48))
abs_21 = Absolute(Value=num_6)
extremums_43 = MinMax(Number=flatten(extremums_42.Maximum))  # -> Minimum, Maximum
merge_37 = Merge(
    Data1=item_48,
    Data2=extremums_38.Maximum,
    Data3=extremums_40.Maximum,
    Data4=extremums_41.Maximum,
    Data5=extremums_42.Maximum,
    Data6=extremums_36.Maximum)
disassemble_3 = DisassembleCrossSectionKaramba3D(CroSec=disassemble_2.CrossSection)  # -> CrossSection, FamilyNameOfCrossSection, TypeNameOfCrossSection, ElemIdentifiers, Color, Material, LocalEccentricity_cm, Heights_cm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
da_upper_row_c_2 = DynamicAnglesUpperRowCastings(
    TopLines=bang_6.Branch1,
    DiagonalLines=bang_6.Branch0,
    TopLineIndex=number_slider_12,
    DiagonalIndex=number_slider_13,
    TopAngles0=genes_32,
    TopAngles4=genes_36,
    TopAngles5=genes_33,
    TopAngles9=genes_34,
    DefAngles1=genes_37,
    DefAngles2=genes_35,
    SideAngles5=genes_31,
    DomeMesh=gridshell_3,
    Castings=empty,
    CastingFrom2Becoming6=null.NullFlags,
    CastingFrom1Becoming7=null.NullFlags,
    MachineNumber=number_slider_18,
    MoldCastings=empty)  # -> OriginalLines, ChangedPoints, ChangedLines, AnglesTop, AnglesSide, TestingPoint, Cost, AngleCost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
bang_21 = ExplodeTree(Data=da_upper_row_c_2.TopPlanes)  # -> Branch0, Branch1
prot = RotatePlane(Plane=bang_21.Branch1, Angle=neg_4)
bang_22 = ExplodeTree(Data=da_upper_row_c_2.ChangedLines)  # -> Branch0, Branch1
end_22 = EndPoints(Curve=bang_22.Branch0)  # -> Start, End
merge_38 = Merge(Data1=end_22.Start, Data2=end_22.End)
cullpt_13 = CullDuplicates(Points=merge_38, Tolerance=0.1, CullMode=1)  # -> Points, Indices, Valence
extremums_44 = MinMax(Number=flatten(b_forces.NormalForce_kN))  # -> Minimum, Maximum
extremums_45 = MinMax(Number=flatten(abs_21))  # -> Minimum, Maximum
mindex_4 = MemberIndex(Set=abs_21, Member=extremums_45.Maximum)  # -> Index, Count
item_49 = ListItem(List=num_6, Index=mindex_4.Index, Wrap=True)  # -> flatten(Item)
panel_136 = Panel(extremums_43.Maximum)
previewlw_20 = CustomPreviewLineweights(Geometry=da_upper_row_c_2.ChangedLines, Shader=swatch_2, Thickness=number_slider_17, Absolute=False)
panel_137 = Panel(extremums_44.Maximum)
tstat_17 = TreeStatistics(Tree=da_upper_row_c_2.SidePlanes)  # -> Paths, Length, Count
panel_138 = Panel(item_49)
previewlw_21 = CustomPreviewLineweights(Geometry=bang_22.Branch1, Shader=ColourSwatch(SwatchColor=RGB(99, 177, 255)), Thickness=number_slider_17, Absolute=False)
tstat_18 = TreeStatistics(Tree=da_upper_row_c_2.TopPlanes)  # -> Paths, Length, Count
tstat_19 = TreeStatistics(Tree=da_upper_row_c_2.ChangedLines)  # -> Paths, Length, Count
panel_139 = Panel(extremums_45.Maximum)
panel_140 = Panel(extremums_39.Maximum)
bang_23 = ExplodeTree(Data=da_upper_row_c_2.OriginalLines)  # -> Branch0, Branch1
item_50 = ListItem(List=tstat_17.Paths, Index=Slider(10, range=0..100), Wrap=True)
num_7 = Number(da_upper_row_c_2.CastingsDist)
item_51 = ListItem(List=tstat_19.Paths, Index=Slider(10, range=0..10), Wrap=True)
tag_4 = TextTag3D(Location=prot, Text=panel_28, Size=1, Colour=swatch_3, Justification=8)
item_52 = ListItem(List=tstat_18.Paths, Index=Slider(10, range=0..10), Wrap=True)
branch_17 = TreeBranch(Tree=da_upper_row_c_2.SidePlanes, Path=item_50, MaintainPaths=True)
branch_18 = TreeBranch(Tree=da_upper_row_c_2.TopPlanes, Path=item_52, MaintainPaths=True)
flatten = FlattenTree(Tree=da_upper_row_c_2.Castings, Path="{0}")
tstat_20 = TreeStatistics(Tree=da_upper_row_c_2.Castings)  # -> Paths, Length, Count
tstat_21 = TreeStatistics(Tree=da_upper_row_c_2.MachinedCastings)  # -> Paths, Length, Count
c_latest = CSharpScript(
    F_m=simplify(merge_37),
    ElemType_m="Beam",
    L_m=len_3,
    b_cm=graft(disassemble_3.MaximumWidth_cm),
    h_cm=disassemble_3.Heights_cm,
    kmod_m=Slider(1, range=0..100),
    BucklingRestrainedZ_m=Toggle(False),
    DoubleMember_m=Toggle(False),
    L_width_m=Slider(0.6, range=0..1))  # -> out, simplify(Util), Util_max, simplify(F_out), temp, CS_name; inputs F_m: list of Double, ElemType_m: String, L_m: Double, b_cm: Double, h_cm: Double, kmod_m: list of Double, BucklingRestrainedZ_m: Boolean, BendingRestrainedZ_m: Boolean, DoubleMember_m: Boolean, B_support_m: Double, L_width_m: Double
# ---------- c_latest: C# usings ----------
using System.Linq;
# ---------- c_latest: C# ----------
    //Make functions out of duplicate formulas(x,y) instead of writing them with different inputs?

    //Input

    //DIMENSIONS
    double B = B_support_m;
    double b = b_cm / 100;//m  (Karamba uses cm)
    double h = h_cm / 100;//m  (Karamba uses cm)
    double L = L_m;
    double Lef_y = L;
    double Lef_z = L_width_m;
    //    if (BucklingRestrainedZ_m)
    //  {
    //      Lef_z = 0.5;
    //    }
    //    else
    //    {
    //      Lef_z = L;
    //    }

    //STATE OF THE MEMBER
    double k_h_m; if (h < 600){k_h_m = Math.Min(Math.Pow(0.6 / h, 0.1), 1.1);} else{k_h_m = 1.0;}
    double k_h_t; if (h < 600){k_h_t = Math.Min(Math.Pow(0.6 / b, 0.1), 1.1);} else{k_h_t = 1.0;}
    double km = 0.7;// 0.7 FOR REC AND 1.0 FOR ALL OTHER. THIS SHOULD BE INHERITED FROM INPUT OF THE CROSS-SECTION.
    double kmod = kmod_m[0]; //should be a input

    double fmk = GL28h.fmk(k_h_m);
    double ft0k = GL28h.ft0k(k_h_t);

    double fmd = fmk * kmod / GL28h.gammaM;
    double fc0d = GL28h.fc0k * kmod / GL28h.gammaM;
    double ft0d = ft0k * kmod / GL28h.gammaM;


    //FORICES+unit conversions
    //0N (comp and tension) [kip to kN]
    double Ncd = 0.0; double Ntd = 0.0; if (F_m[0] < 0.0) {Ncd = (Math.Abs(F_m[0]));Ntd = 0;} else{Ncd = 0;Ntd = (Math.Abs(F_m[0]));}
    double Vzd = (Math.Abs(F_m[1]));//[kip to kN]
    double Vyd = (Math.Abs(F_m[2]));//[kip to kN]
    //3Mt [kip-ft to kNm]
    //4My [kip-ft to kNm]
    double Myd = (Math.Abs(F_m[4]));//kNm...ABS
    //5Mz [kip-ft to kNm]
    double Mzd;
    if (BendingRestrainedZ_m)
    {
      Mzd = 0.5;
    }
    else
    {
      Mzd = (Math.Abs(F_m[5]));//kNm...ABS
    }

    //SHEAR CHECK NOT INCLUDED IN SPREADSHEET.


    double sigma_myd = (1.0 / 1000) * Myd / CS.Wy(b, h);
    double sigma_mzd = (1.0 / 1000) * Mzd / CS.Wz(b, h);
    double sigma_c0d = (1.0 / 1000) * Ncd / CS.A(b, h);
    double sigma_t0d = (1.0 / 1000) * Ntd / CS.A(b, h);

    string CS_out;
    double Iz;
    if(DoubleMember_m == true)
    {
      Iz = 2 * (h * Math.Pow(b / 2, 3) / 12) + 2 * (h * (b / 2)) * Math.Pow((((B - b) / 2) + (b / 4)), 2);//Steiner-theorem
      CS_out = "(2)" + b_cm.ToString() + "x" + h_cm.ToString();
    }
    else
    {
      Iz = CS.Iz(b, h);
      CS_out = b_cm.ToString() + "x" + h_cm.ToString();
    }

    double sigmacrit = sigmamcritFunc(b, h, Lef_y, GL28h.E05);
    double lambda_y = Lef_y * Math.Sqrt(CS.A(b, h) / CS.Iy(b, h));//L or Lef???
    double lambda_z = Lef_z * Math.Sqrt(CS.A(b, h) / Iz);//L or Lef???
    double lambda_rel_y = (lambda_y / Math.PI) * Math.Sqrt(GL28h.fc0k / GL28h.E05);
    double lambda_rel_z = (lambda_z / Math.PI) * Math.Sqrt(GL28h.fc0k / GL28h.E05);

    double betha_c = 0.1; //0.1 for GL and 0.2 for MT
    double k_y = 0.5 * (1 + betha_c * (lambda_rel_y - 0.3) + Math.Pow(lambda_rel_y, 2));
    double k_z = 0.5 * (1 + betha_c * (lambda_rel_z - 0.3) + Math.Pow(lambda_rel_z, 2));
    double k_cy = 1.00 / (k_y + (Math.Sqrt(Math.Pow(k_y, 2) - Math.Pow(lambda_rel_y, 2))));
    double k_cz = 1.00 / (k_z + (Math.Sqrt(Math.Pow(k_z, 2) - Math.Pow(lambda_rel_z, 2))));

    double lambda_rel_m = Math.Sqrt(fmk / sigmacrit);//Can I include the formulations like Nested Methods?
    double k_crit = k_critFunc(lambda_rel_m);

    double k_cr = 0.67; //Influence of cracks. To be used in a if statement.
    double b_ef = b * k_cr;
    double tao_vyd = (1.0 / 1000) * Vyd / (h * b_ef);//MPA
    double tao_vzd = (1.0 / 1000) * Vzd / (h * b_ef);//MPA
    //double f

    //UTIL Bending and Axial.
    double Util6_17 = (sigma_t0d / ft0d) + (sigma_myd / fmd) + km * (sigma_mzd / fmd);
    double Util6_18 = (sigma_t0d / ft0d) + km * (sigma_myd / fmd) + (sigma_mzd / fmd);
    double Util6_19 = Math.Pow(sigma_c0d / fc0d, 2) + (sigma_myd / fmd) + km * (sigma_mzd / fmd);
    double Util6_20 = Math.Pow(sigma_c0d / fc0d, 2) + km * (sigma_myd / fmd) + (sigma_mzd / fmd);
    double Util6_23 = (sigma_c0d / (k_cy * fc0d)) + (sigma_myd / fmd) + km * (sigma_mzd / fmd);//if statement
    double Util6_24 = (sigma_c0d / (k_cz * fc0d)) + km * (sigma_myd / fmd) + (sigma_mzd / fmd);//if statement
    double Util6_35 = Math.Pow(Math.Max(sigma_myd / (k_crit * fmd), sigma_mzd / (k_crit * fmd)), 2) + (sigma_c0d / Math.Min(k_cy * fc0d, k_cz * fc0d));//if statement

    //double Util6_35y = Math.Pow(sigma_myd / (k_crit * fmd), 2) + sigma_c0d / (k_cy * fc0d);
    double Util6_35y = Math.Pow(sigma_mzd / (k_crit * fmd), 2) + sigma_c0d / (k_cz * fc0d);
    if(Ncd == 0){ Util6_35 = 0; Util6_24 = 0; Util6_23 = 0; Util6_20 = 0; Util6_19 = 0;}
    if(Ntd == 0){Util6_17 = 0; Util6_18 = 0;}
    //UTIL Shear.
    double Util6_13y = tao_vyd / GL28h.fvd(kmod);
    double Util6_13z = tao_vzd / GL28h.fvd(kmod);

    List<double> Util6 = new List<double>(){Util6_17,Util6_18,Util6_19,Util6_20,Util6_23,Util6_24,Util6_35,Util6_13y,Util6_13z};
    List < string > URstr = new List<string>(){"Util6_17","Util6_18","Util6_19","Util6_20","Util6_23","Util6_24","Util6_35","Util6_13y","Util6_13z"};


    if (ElemType_m == "Column")
    {
      Util6.RemoveAt(6);
      URstr.RemoveAt(6);
    }
    else if (ElemType_m == "Beam")
    {
      Util6.RemoveAt(4);
      URstr.RemoveAt(4);
      Util6.RemoveAt(4);
      URstr.RemoveAt(4);
    }

    else
    {throw new ArgumentException("ElemType_m can only beam Beam or Column");}
    //Remove 4 and 5, which will be 4-(4) in reduced list.
    //Decision should be made earlier. if statement, else nothing. Append instead of creating list Like this.

    //OUTPUT
    Util_max = Util6.Max();
    Util = Util6;
    F_out = new List<double>{Ncd,Ntd,Vyd,Vzd,Myd,Mzd};
    List <string> name = URstr;
    CS_name = CS_out;
# ---------- c_latest: C# additional code ----------
  //public static int index_m;
  public class GL28h //class to define a Glulam material with static properties i.e. no get/set
  {
    //MPa (Karamba uses kN/cm2)
    public static double E05 = 10500;
    public static double G05 = 542;


    public static double fmk(double k_h_local)
    {return 28 * k_h_local;}
    public static double ft0k(double k_h_local)
    {return 22.3 * k_h_local;}

    public static double fc0k = 28;
    public static double fvk = 3.5;
    public static double fc90k = 2.5;
    public static double ft90k = 0.5;
    public static double gammaM = 1.25;

    public static double fvd(double kmod_local)
    {return fvk * kmod_local / gammaM;}
    public static double fc90d(double kmod_local)
    {return fc90k * kmod_local / gammaM;}
    public static double ft90d(double kmod_local)
    {return ft90k * kmod_local / gammaM;}
  }
  //CSprop
  public class CS //class to define a Glulam material with static properties i.e. no get/set
  {
    public static double A(double width, double depth)    {return width * depth;}
    public static double Iy(double width, double depth)   {return width * Math.Pow(depth, 3) / 12;} //Major axis
    public static double Iz(double width, double depth)   {return depth * Math.Pow(width, 3) / 12;} //Major axis
    public static double Itor(double width, double depth) {return depth * Math.Pow(width, 3) * ((1.0 / 3.0) - 0.21 * (width / depth) * (1 - Math.Pow(width, 4) / (12 * Math.Pow(depth, 4))));}
    public static double Wy(double width, double depth)   {return width * Math.Pow(depth, 2) / 6;}
    public static double Wz(double width, double depth)   {return depth * Math.Pow(width, 2) / 6;}

  }
  public double sigma_t0d(double Ntd, double width, double depth) //kPa
  {
    return Ntd / (width * depth);
  }

  //public double sigmamcritFunc1(double width, double depth, double Lef)
  //{
  //  return Math.PI * Math.Sqrt(GL28h.E05 * CS.Iz(width, depth) * GL28h.G05 * CS.Itor(width, depth)) / (Lef * CS.Wy(width, depth));
  //}
  //Not supposed to be used.
  public double sigmamcritFunc(double width, double depth, double Lef, double E)
  {
    //In BS excel spreadsheet this one is used for softwood solid rect sections. How to incorporate this?
    return 0.78 * Math.Pow(width, 2) * E / (depth * Lef);//Check units on E.
  }
  public double k_critFunc(double lambda_rel_m)
  {
    if        (lambda_rel_m <= 0.75)
    {return 1.00;}
    else if   (0.75 < lambda_rel_m && lambda_rel_m < 1.40)
    {return 1.56 - 0.75 * lambda_rel_m;}
    else
    {return 1 / Math.Pow(lambda_rel_m, 2);}
  }
  //UNIT CONVERSIONS



  /// <summary>
  /// This method will be called once every solution, before any calls to RunScript.
  /// </summary>
  public override void BeforeRunScript()
  { }
  /// <summary>
  /// This method will be called once every solution, after any calls to RunScript.
  /// </summary>
  public override void AfterRunScript()
  { }
# ---------- end c_latest ----------
branch_19 = TreeBranch(Tree=da_upper_row_c_2.OriginalLines, Path=item_51, MaintainPaths=True)
multiplication_19 = Multiplication(A=num_7, B="10")
crv_61 = Curve(da_upper_row_c_2.ChangedLines)
bang_24 = ExplodeTree(Data=da_upper_row_c_2.ChangedLines)
extremums_46 = MinMax(Number=flatten)  # -> Minimum, Maximum
smaller_2 = SmallerThan(FirstNumber=extremums_46.Minimum, SecondNumber=0)  # -> SmallerThan, OrEqualTo
crv_62 = Curve(flatten(da_upper_row_c_2.ChangedLines))
item_53 = ListItem(List=branch_19, Index=0, Wrap=True)
lng_11 = ListLength(List=tstat_20.Paths)
addition_7 = Addition(A=multiplication_19, B=lng_11)
bang_25 = ExplodeTree(Data=branch_18)  # -> Branch0, Branch1
lng_12 = ListLength(List=tstat_21.Paths)
multiplication_20 = Multiplication(A=lng_12, B="1")
previewlw_22 = CustomPreviewLineweights(
    Geometry=bang_23.Branch0,
    Shader=ColourSwatch(SwatchColor=RGB(195, 84, 255)),
    Thickness=Slider(6.38, range=0..10),
    Absolute=False)
subtraction_27 = Subtraction(A=addition_7, B=multiplication_20)
subtraction_28 = Subtraction(A=lng_11, B=lng_12)
item_54 = ListItem(List=branch_17, Index=Slider(5, range=0..10), Wrap=True)
multiplication_21 = Multiplication(A=subtraction_27, B=100)
item_55 = ListItem(List=bang_25.Branch0, Index=Slider(1, range=0..10), Wrap=True)
extremums_47 = MinMax(Number=flatten(c_latest.Util_max))  # -> Minimum, Maximum
item_56 = ListItem(List=bang_25.Branch0, Index=Slider(5, range=0..10), Wrap=True)
project_13 = Project(Geometry=item_53, Plane=item_56)  # -> Geometry, Transform
panel_141 = Panel(lng_12)
filter_3 = StreamFilter(Gate=smaller_2.SmallerThan, Stream0=subtraction_27, Stream1=multiplication_21)
panel_142 = Panel(filter_3)
panel_143 = Panel(subtraction_28)
firstdeformation_3 = RemoteReceiver(firstdeformation)
grid_curves = Curve(firstdeformation_3)
panel_144 = Panel(extremums_47.Maximum)
midpt = CurveMiddle(Curve=grid_curves)
dist_total = RemoteSender(da_upper_row_c_2.CastingsDist)
min_fitness = Number(filter_3)
wallacei_x_2 = WallaceiX(
    Genes=[genes_32, genes_36, genes_33, genes_34, genes_37, genes_35, genes_31],
    Objectives=min_fitness,
    allFitness="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",
    allFrontIdx="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",
    allGenomes="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",
    curFrontIdx="99|0;99|1;99|2;99|3;99|4;99|5;99|6;99|7;99|8;99|9;99|10;99|11;99|12;99|13;99|14;99|15;99|16;99|17;99|18;99|19;99|20;99|21;99|22;99|23;99|24;99|25;99|26;99|27;99|28;99|29;99|30;99|31;99|32;99|33;99|34;99|35;99|36;99|37;99|38;99|39;99|40;99|41;99|42;99|43;99|44;99|45;99|46;99|47;99|48;99|49",
    curFrontIdxSave="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",
    popGen="50,100",
    total="271578",
    wlcDone=True)  # -> WallaceiGenomes, FitnessValues, Data, WPhenotypes
item_57 = ListItem(List=da_upper_row_c_2.CastingBuildUp, Index=Slider(1, range=0..10), Wrap=True)  # -> flatten(Item)
item_58 = ListItem(List=da_upper_row_c_2.CastingBuildUp, Index=Slider(2, range=0..10), Wrap=True)  # -> flatten(Item)
da_upper_row_ar_3 = DynamicAnglesUpperRowRelationAngles(
    TopLines=crv_32,
    DiagonalLines=crv_33,
    TopLineIndex=number_slider_12,
    DiagonalIndex=number_slider_14,
    CastingIndex=genes_40,
    TopAngles1=genes_39,
    TopAngles2=subtraction_9,
    SideAngles=genes_38,
    DomeMesh=gridshell_3)  # -> OriginalLines, ChangedPoints, ChangedLines, AnglesTop, AnglesSide, TestingPoint, Cost, Cost1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
cluster_15 = Cluster_10(
    top_angles=da_upper_row_c_2.AnglesTop,
    castings=da_upper_row_c_2.Castings,
    cbd=da_upper_row_c_2.CastingBuildUp,
    i=number_slider_22,
    side_angles=da_upper_row_c_2.AnglesSide)  # -> B, R, side_results, side_check
crv_63 = Curve(da_upper_row_ar_3.ChangedLines)
new_curves = Curve(flatten(crv_63))
rdlines = RemoveDuplicateLinesKaramba3D(Line=new_curves, LimitDistance=0.005)  # -> OutLine, Info, Indexes
mp_15 = Midpoint(Curve=rdlines.OutLine)
cp_9 = ClosestPoint(Point=graft(mp_15), Cloud=midpt)  # -> ClosestPoint, flatten(CPIndex), Distance
cull_i_5 = CullIndex(List=grid_curves, Indices=cp_9.CPIndex, Wrap=True)
extremums_48 = MinMax(Number=flatten(cp_9.Distance))  # -> Minimum, Maximum
larger_4 = LargerThan(FirstNumber=extremums_48.Maximum, SecondNumber=Slider(2, range=0..10))  # -> LargerThan, OrEqualTo
end_23 = EndPoints(Curve=rdlines.OutLine)  # -> Start, End
merge_39 = Merge(Data1=end_23.Start, Data2=end_23.End)
pdecon_19 = Deconstruct(Point=merge_39)  # -> XComponent, YComponent, ZComponent
extremums_49 = MinMax(Number=pdecon_19.ZComponent)  # -> Minimum, Maximum
filter_4 = StreamFilter(Gate=larger_4.LargerThan, Stream0=cull_i_5)
equalst_2 = EqualityWithinTolerance(FirstNumber=pdecon_19.ZComponent, SecondNumber=extremums_49.Maximum, Tolerance=tolerance_for_end_node_placement)  # -> Equality, Inequality
end_24 = EndPoints(Curve=graft(filter_4))  # -> Start, End
dispatch_13 = DispatchUnweave(Data=merge_39, Pattern=equalst_2.Equality)  # -> Out00, Out01, Out02
merge_40 = Merge(Data1=end_24.Start, Data2=end_24.End)
geo = Geometry(dispatch_13.Out01)
pdecon_20 = Deconstruct(Point=merge_40)  # -> XComponent, YComponent, ZComponent
panel_146 = Panel(da_upper_row_ar_3.Castings)
item_59 = ListItem(List=da_upper_row_ar_3.Castings, Index=Slider(1, range=0..1), Wrap=True)
item_60 = ListItem(List=da_upper_row_ar_3.Castings, Index=Slider(2, range=0..10), Wrap=True)
cullpt_14 = CullDuplicates(Points=geo, Tolerance=0.1, CullMode=1)  # -> Points, Indices, Valence
panel_147 = Panel(cluster_15.side_results)
panel_148 = Panel(cluster_15.side_check)
weave = Weave(Pattern=panel_29, Stream0=item_59, Stream1=item_60, NullGaps=False)  # -> flatten(Weave)
subtraction_29 = Subtraction(A=pdecon_20.ZComponent, B=extremums_49.Maximum)
abs_22 = Absolute(Value=subtraction_29)
panel_149 = Panel(cluster_15.R)
first_last = FirstLast(List=abs_22)  # -> FirstValue, LastValue
panel_150 = Panel(cluster_15.B)
min = Minimum(A=first_last.FirstValue, B=first_last.LastValue)
mindex_5 = MemberIndex(Set=abs_22, Member=min)  # -> Index, Count
item_61 = ListItem(List=merge_40, Index=mindex_5.Index, Wrap=True)
multiplication_22 = Multiplication(A=num_7, B=Slider(200, range=0..1000))
panel_151 = Panel(weave)
pdecon_21 = Deconstruct(Point=item_61)  # -> XComponent, YComponent, ZComponent
multiplication_23 = Multiplication(A=filter_3, B=100)
abs_23 = Absolute(Value=pdecon_21.YComponent)
first_last_2 = FirstLast(List=abs_23)  # -> FirstValue, LastValue
cull_i_6 = CullIndex(List=merge_40, Indices=mindex_5.Index, Wrap=True)
min_2 = Minimum(A=first_last_2.FirstValue, B=first_last_2.LastValue)
mindex_6 = MemberIndex(Set=abs_23, Member=min_2)  # -> Index, Count
cull_i_7 = CullIndex(List=item_61, Indices=mindex_6.Index, Wrap=True)
item_62 = ListItem(List=item_61, Index=mindex_6.Index, Wrap=True)
dist_5 = Distance(PointA=graft(cullpt_14.Points), PointB=flatten(item_62))
lng_13 = ListLength(List=dist_5)
series_4 = Series(Start=0, Step=1, Count=lng_13)
cp_10 = ClosestPoint(Point=flatten(item_62), Cloud=graft(cullpt_14.Points))  # -> ClosestPoint, flatten(CPIndex), Distance
smaller_3 = SmallerThan(FirstNumber=dist_5, SecondNumber=Slider(1.5, range=0..10))  # -> SmallerThan, OrEqualTo
dispatch_14 = Dispatch(List=series_4, DispatchPattern=smaller_3.SmallerThan)  # -> ListA, ListB
tstat_22 = TreeStatistics(Tree=item_62)  # -> Paths, Length, Count
lng_14 = ListLength(List=dispatch_14.ListA)
extremums_50 = MinMax(Number=flatten(da_upper_row_ar_3.Cost))  # -> Minimum, Maximum
cull_i_8 = CullIndex(List=tstat_22.Paths, Indices=flatten(dispatch_14.ListA), Wrap=True)
repeat_7 = RepeatData(Data=graft(cullpt_14.Points), Length=lng_14)
sort_18 = SortList(Keys=flatten(cp_10.CPIndex), ValuesA=flatten(cp_10.ClosestPoint))  # -> Keys, ValuesA
merge_41 = Merge(Data1=cull_i_7, Data2=cull_i_6)
item_63 = ListItem(List=tstat_22.Paths, Index=flatten(dispatch_14.ListA), Wrap=True)
branch_20 = TreeBranch(Tree=item_62, Path=cull_i_8, MaintainPaths=True)
sort_19 = SortList(Keys=flatten(dispatch_14.ListA), ValuesA=flatten(repeat_7))  # -> Keys, ValuesA
multiplication_24 = Multiplication(A=extremums_50.Maximum, B=Slider(30, range=0..100))
branch_21 = TreeBranch(Tree=item_62, Path=item_63, MaintainPaths=True)
clone = CloneStructure(List=sort_19.ValuesA, Structure=branch_21)
merge_42 = Merge(Data1=simplify(branch_20), Data2=simplify(merge_41), Data3=simplify(clone))
pline_2 = PolyLine(Vertices=merge_42, Closed=False)
merge_43 = Merge(Data1=flatten(pline_2), Data2=flatten(rdlines.OutLine))
mp_16 = Midpoint(Curve=merge_43)
pdecon_22 = Deconstruct(Point=mp_16)  # -> XComponent, YComponent, ZComponent
sort_20 = SortList(Keys=pdecon_22.XComponent, ValuesA=merge_43)  # -> Keys, ValuesA
pt_8 = ConstructPoint(XCoordinate=sort_20.Keys, YCoordinate=0, ZCoordinate=0)
cullpt_15 = CullDuplicates(Points=pt_8, Tolerance=Slider(1, range=0..1), CullMode=1)  # -> Points, Indices, Valence
partition_8 = PartitionList(List=sort_20.ValuesA, Size=repeat)
mp_17 = Midpoint(Curve=partition_8)
pdecon_23 = Deconstruct(Point=mp_17)  # -> XComponent, YComponent, ZComponent
sort_21 = SortList(Keys=pdecon_23.YComponent, ValuesA=partition_8)  # -> Keys, reverse(ValuesA)
end_25 = EndPoints(Curve=flatten(sort_21.ValuesA))  # -> Start, End
tstat_23 = TreeStatistics(Tree=sort_21.ValuesA)  # -> Paths, Length, Count
item_64 = ListItem(List=tstat_23.Paths, Index=merge_13, Wrap=True)
merge_44 = Merge(Data1=end_25.Start, Data2=end_25.End)
branch_22 = TreeBranch(Tree=sort_21.ValuesA, Path=item_64, MaintainPaths=True)
bang_26 = ExplodeTree(Data=branch_22)  # -> Branch0, Branch1
da_upper_row_ar_4 = DynamicAnglesUpperRowRelationAngles(
    TopLines=bang_26.Branch1,
    DiagonalLines=bang_26.Branch0,
    TopLineIndex=Slider(0, range=0..10),
    DiagonalIndex=Slider(2, range=0..10),
    CastingIndex=weave,
    TopAngles1=genes_39,
    TopAngles2=subtraction_10,
    SideAngles=genes_38,
    DomeMesh=gridshell_3)  # -> OriginalLines, ChangedPoints, ChangedLines, AnglesTop, AnglesSide, TestingPoint, Cost, Cost1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
panel_152 = Panel(da_upper_row_ar_4.Castings)
null_4 = NullItem(Item=da_upper_row_ar_4.Cost)  # -> flatten(NullFlags), InvalidFlags, Description
item_65 = ListItem(List=null_4.NullFlags, Index=0, Wrap=True)
extremums_51 = MinMax(Number=flatten(da_upper_row_ar_4.Cost))  # -> Minimum, Maximum
crv_64 = Curve(da_upper_row_ar_4.ChangedLines)
filter_5 = StreamFilter(Gate=item_65, Stream0=extremums_51.Maximum, Stream1=multiplication_24)
roundd = RoundToDecimalPlace(NumberX=filter_5, DecimalPlace=Slider(3, range=0..100), RoundType=0)  # -> Rounded, Difference
panel_153 = Panel(roundd.Rounded)
round = Round(Number=roundd.Rounded)  # -> Nearest, Floor, Ceiling
cullpt_16 = CullDuplicates(Points=merge_44, Tolerance=0.1, CullMode=1)  # -> Points, Indices, Valence
del_9 = DelaunayMesh(Points=cullpt_16.Points, Plane=PlaneXY(0, 0, 0))
previewlw_23 = CustomPreviewLineweights(Geometry=branch_22, Shader=ColourSwatch(SwatchColor=RGB(203, 207, 91)), Thickness=Slider(2, range=0..10), Absolute=False)
multiplication_25 = Multiplication(A=num_7, B=Slider(200, range=0..1000))
num_8 = Number(filter_3)
multiplication_26 = Multiplication(A=num_8, B=100)

closeness_need_2 = Slider(0.8, range=0..1)
tolerance_for_end_node_placement_2 = Slider(0.4, range=0..1)
distance_between_point_and_node_2 = Slider(1, range=0..1)
merge_45 = Merge(
    Data1=Slider(17, range=0..100),
    Data2=Slider(36, range=0..100),
    Data3=Slider(18, range=0..100),
    Data4=Slider(36, range=0..100))
repeat_8 = RepeatData(Data=merge_45, Length=Slider(29, range=0..100))
number_slider_33 = Slider(5, range=0..10)
number_slider_34 = Slider(5, range=0..10)

addition_8 = Addition(A=number_slider_34, B=1)

grid_curves_2 = Curve(firstdeformation_3)
new_curves_2 = Curve(crv_62)
midpt_2 = CurveMiddle(Curve=grid_curves_2)
rdlines_2 = RemoveDuplicateLinesKaramba3D(Line=new_curves_2, LimitDistance=0.005)  # -> OutLine, Info, Indexes
mp_18 = Midpoint(Curve=rdlines_2.OutLine)
cp_11 = ClosestPoint(Point=graft(mp_18), Cloud=midpt_2)  # -> ClosestPoint, flatten(CPIndex), Distance
closeness_need_3 = Slider(1, range=0..1)
cull_i_9 = CullIndex(List=grid_curves_2, Indices=cp_11.CPIndex, Wrap=True)
extremums_52 = MinMax(Number=flatten(cp_11.Distance))  # -> Minimum, Maximum
larger_5 = LargerThan(FirstNumber=extremums_52.Maximum, SecondNumber=closeness_need_3)  # -> LargerThan, OrEqualTo
end_26 = EndPoints(Curve=rdlines_2.OutLine)  # -> Start, End
tolerance_for_end_node_placement_3 = Slider(0.4, range=0..1)
merge_46 = Merge(Data1=end_26.Start, Data2=end_26.End)
pdecon_24 = Deconstruct(Point=merge_46)  # -> XComponent, YComponent, ZComponent
extremums_53 = MinMax(Number=pdecon_24.ZComponent)  # -> Minimum, Maximum
filter_6 = StreamFilter(Gate=larger_5.LargerThan, Stream0=cull_i_9)
equalst_3 = EqualityWithinTolerance(FirstNumber=pdecon_24.ZComponent, SecondNumber=extremums_53.Maximum, Tolerance=tolerance_for_end_node_placement_3)  # -> Equality, Inequality
end_27 = EndPoints(Curve=graft(filter_6))  # -> Start, End
dispatch_15 = DispatchUnweave(Data=merge_46, Pattern=equalst_3.Equality)  # -> Out00, Out01, Out02
merge_47 = Merge(Data1=end_27.Start, Data2=end_27.End)
distance_between_point_and_node_3 = Slider(1, range=0..1)
geo_2 = Geometry(dispatch_15.Out01)
pdecon_25 = Deconstruct(Point=merge_47)  # -> XComponent, YComponent, ZComponent
cullpt_17 = CullDuplicates(Points=geo_2, Tolerance=0.1, CullMode=1)  # -> Points, Indices, Valence
subtraction_30 = Subtraction(A=pdecon_25.ZComponent, B=extremums_53.Maximum)
abs_24 = Absolute(Value=subtraction_30)
first_last_3 = FirstLast(List=abs_24)  # -> FirstValue, LastValue
min_3 = Minimum(A=first_last_3.FirstValue, B=first_last_3.LastValue)
mindex_7 = MemberIndex(Set=abs_24, Member=min_3)  # -> Index, Count
item_66 = ListItem(List=merge_47, Index=mindex_7.Index, Wrap=True)
pdecon_26 = Deconstruct(Point=item_66)  # -> XComponent, YComponent, ZComponent
abs_25 = Absolute(Value=pdecon_26.YComponent)
first_last_4 = FirstLast(List=abs_25)  # -> FirstValue, LastValue
cull_i_10 = CullIndex(List=merge_47, Indices=mindex_7.Index, Wrap=True)
min_4 = Minimum(A=first_last_4.FirstValue, B=first_last_4.LastValue)
mindex_8 = MemberIndex(Set=abs_25, Member=min_4)  # -> Index, Count
cull_i_11 = CullIndex(List=item_66, Indices=mindex_8.Index, Wrap=True)
item_67 = ListItem(List=item_66, Index=mindex_8.Index, Wrap=True)
dist_6 = Distance(PointA=graft(cullpt_17.Points), PointB=flatten(item_67))
lng_15 = ListLength(List=dist_6)
series_5 = Series(Start=0, Step=1, Count=lng_15)
cp_12 = ClosestPoint(Point=flatten(item_67), Cloud=graft(cullpt_17.Points))  # -> ClosestPoint, flatten(CPIndex), Distance
smaller_4 = SmallerThan(FirstNumber=dist_6, SecondNumber=Slider(1.5, range=0..10))  # -> SmallerThan, OrEqualTo
dispatch_16 = Dispatch(List=series_5, DispatchPattern=smaller_4.SmallerThan)  # -> ListA, ListB
tstat_24 = TreeStatistics(Tree=item_67)  # -> Paths, Length, Count
lng_16 = ListLength(List=dispatch_16.ListA)
cull_i_12 = CullIndex(List=tstat_24.Paths, Indices=flatten(dispatch_16.ListA), Wrap=True)
repeat_9 = RepeatData(Data=graft(cullpt_17.Points), Length=lng_16)
sort_22 = SortList(Keys=flatten(cp_12.CPIndex), ValuesA=flatten(cp_12.ClosestPoint))  # -> Keys, ValuesA
merge_48 = Merge(Data1=cull_i_11, Data2=cull_i_10)
item_68 = ListItem(List=tstat_24.Paths, Index=flatten(dispatch_16.ListA), Wrap=True)
branch_23 = TreeBranch(Tree=item_67, Path=cull_i_12, MaintainPaths=True)
sort_23 = SortList(Keys=flatten(dispatch_16.ListA), ValuesA=flatten(repeat_9))  # -> Keys, ValuesA
branch_24 = TreeBranch(Tree=item_67, Path=item_68, MaintainPaths=True)
clone_2 = CloneStructure(List=sort_23.ValuesA, Structure=branch_24)
merge_49 = Merge(Data1=simplify(branch_23), Data2=simplify(merge_48), Data3=simplify(clone_2))
merge_50 = Merge(
    Data1=Slider(17, range=0..100),
    Data2=Slider(36, range=0..100),
    Data3=Slider(18, range=0..100),
    Data4=Slider(36, range=0..100))
repeat_10 = RepeatData(Data=merge_50, Length=Slider(29, range=0..100))

pline_3 = PolyLine(Vertices=merge_49, Closed=False)

merge_51 = Merge(Data1=flatten(pline_3), Data2=flatten(rdlines_2.OutLine))
mp_19 = Midpoint(Curve=merge_51)
pdecon_27 = Deconstruct(Point=mp_19)  # -> XComponent, YComponent, ZComponent
sort_24 = SortList(Keys=pdecon_27.XComponent, ValuesA=merge_51)  # -> Keys, ValuesA
pt_9 = ConstructPoint(XCoordinate=sort_24.Keys, YCoordinate=0, ZCoordinate=0)
cullpt_18 = CullDuplicates(Points=pt_9, Tolerance=Slider(1, range=0..1), CullMode=1)  # -> Points, Indices, Valence
partition_9 = PartitionList(List=sort_24.ValuesA, Size=repeat_10)
mp_20 = Midpoint(Curve=partition_9)
pdecon_28 = Deconstruct(Point=mp_20)  # -> XComponent, YComponent, ZComponent
sort_25 = SortList(Keys=pdecon_28.YComponent, ValuesA=partition_9)  # -> Keys, reverse(ValuesA)

end_28 = EndPoints(Curve=flatten(sort_25.ValuesA))  # -> Start, End
tstat_25 = TreeStatistics(Tree=sort_25.ValuesA)  # -> Paths, Length, Count
item_69 = ListItem(List=tstat_25.Paths, Index=merge_14, Wrap=True)
merge_52 = Merge(Data1=end_28.Start, Data2=end_28.End)
branch_25 = TreeBranch(Tree=sort_25.ValuesA, Path=item_69, MaintainPaths=True)
cullpt_19 = CullDuplicates(Points=merge_52, Tolerance=0.1, CullMode=1)  # -> Points, Indices, Valence
lines_2 = RemoteSender(branch_25)
lines_2_2 = RemoteReceiver(lines_2)
bang_27 = ExplodeTree(Data=lines_2_2)  # -> Branch0, Branch1
del_10 = DelaunayMesh(Points=cullpt_19.Points, Plane=PlaneXY(0, 0, 0))
shell_2 = RemoteSender(del_10)
shell_2_2 = RemoteReceiver(shell_2)
da_upper_row_c_3 = DynamicAnglesUpperRowCastings(
    TopLines=bang_27.Branch1,
    DiagonalLines=bang_27.Branch0,
    TopLineIndex=Slider(0, range=0..10),
    DiagonalIndex=Slider(2, range=0..10),
    TopAngles0=genes_32,
    TopAngles4=genes_36,
    TopAngles5=genes_33,
    TopAngles9=genes_34,
    DefAngles1=genes_37,
    DefAngles2=genes_35,
    SideAngles5=genes_31,
    DomeMesh=shell_2_2,
    Castings=da_upper_row_c_2.Castings,
    CastingFrom2Becoming6=item_58,
    CastingFrom1Becoming7=item_57,
    MachineNumber=number_slider_18,
    MoldCastings=da_upper_row_c_2.MoldedCastings)  # -> OriginalLines, ChangedPoints, ChangedLines, AnglesTop, AnglesSide, TestingPoint, Cost, AngleCost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
tstat_26 = TreeStatistics(Tree=da_upper_row_c_3.NewMeshes)  # -> Paths, Length, Count
tstat_27 = TreeStatistics(Tree=da_upper_row_c_3.OriginalLines)  # -> Paths, Length, Count
tstat_28 = TreeStatistics(Tree=da_upper_row_c_3.TopPlanes)  # -> Paths, Length, Count
tstat_29 = TreeStatistics(Tree=da_upper_row_c_3.ChangedLines)  # -> Paths, Length, Count
item_70 = ListItem(List=tstat_26.Paths, Index=Slider(8, range=0..14), Wrap=True)
tstat_30 = TreeStatistics(Tree=da_upper_row_c_3.SidePlanes)  # -> Paths, Length, Count
item_71 = ListItem(List=da_upper_row_c_3.OriginalLines, Index=number_slider_21, Wrap=True)
item_72 = ListItem(List=tstat_28.Paths, Index=number_slider_21, Wrap=True)
item_73 = ListItem(List=tstat_30.Paths, Index=number_slider_21, Wrap=True)
item_74 = ListItem(List=tstat_29.Paths, Index=number_slider_22, Wrap=True)
branch_26 = TreeBranch(Tree=da_upper_row_c_3.NewMeshes, Path=item_70, MaintainPaths=True)
branch_27 = TreeBranch(Tree=da_upper_row_c_3.OriginalLines, Path=item_71, MaintainPaths=True)
demesh_7 = DeconstructMesh(Mesh=branch_26)  # -> Vertices, Faces, Colours, Normals
branch_28 = TreeBranch(Tree=da_upper_row_c_3.ChangedLines, Path=item_74, MaintainPaths=True)
branch_29 = TreeBranch(Tree=da_upper_row_c_3.TopPlanes, Path=item_72, MaintainPaths=True)
item_75 = ListItem(List=branch_29, Index=0, Wrap=True)  # -> Item, Item1, Item2, Item3
branch_30 = TreeBranch(Tree=da_upper_row_c_3.SidePlanes, Path=item_73, MaintainPaths=True)
meshcp_2 = MeshClosestPoint(Point=demesh_7.Vertices, Mesh=branch_26)  # -> Point, Index, Parameter
item_76 = ListItem(List=branch_28, Index=0, Wrap=True)  # -> Item, Item1, Item2, Item3, Item4
item_77 = ListItem(List=branch_30, Index=9, Wrap=True)
pln_9 = Plane(item_75.Item1)
meval_2 = MeshEval(Mesh=branch_26, Parameter=meshcp_2.Parameter)  # -> Point, Normal, Colour
deplane_4 = DeconstructPlane(Plane=pln_9)  # -> Origin, XAxis, YAxis, ZAxis
project_14 = Project(Geometry=item_76.Item4, Plane=item_75.Item1)  # -> Geometry, Transform
pln_10 = Plane(item_77)
new_lines_2 = RemoteSender(da_upper_row_c_3.ChangedLines)
pl_3 = ConstructPlane(Origin=deplane_4.Origin, XAxis=deplane_4.ZAxis, YAxis=item_76.Item4)
dist_total_2 = RemoteSender(da_upper_row_c_3.CastingsDist)
bang_28 = ExplodeTree(Data=da_upper_row_c_3.ChangedLines)  # -> Branch0, Branch1
line_9 = LineSDL(Start=meval_2.Point, Direction=meval_2.Normal, Length=1)
angle_15 = Angle(VectorA=project_14.Geometry, VectorB=item_76.Item4, Plane=pl_3)  # -> Angle, Reflex
castings_3 = RemoteSender(da_upper_row_c_3.Castings)
cbd_3 = RemoteSender(da_upper_row_c_3.CastingBuildUp)
cluster_16 = Cluster_10(
    top_angles=da_upper_row_c_3.AnglesTop,
    castings=da_upper_row_c_3.Castings,
    cbd=da_upper_row_c_3.CastingBuildUp,
    i=Slider(14, range=0..100))  # -> B, R, side_results, side_check
bang_29 = ExplodeTree(Data=da_upper_row_c_3.OriginalLines)  # -> Branch0, Branch1
tstat_31 = TreeStatistics(Tree=da_upper_row_c_3.MachinedCastings)  # -> Paths, Length, Count
deg_15 = Degrees(Radians=angle_15.Angle)
tstat_32 = TreeStatistics(Tree=da_upper_row_c_3.Castings)  # -> Paths, Length, Count
previewlw_24 = CustomPreviewLineweights(
    Geometry=da_upper_row_c_3.ChangedLines,
    Shader=ColourSwatch(SwatchColor=RGB(40, 68, 97)),
    Thickness=number_slider_23,
    Absolute=False)
subtraction_31 = Subtraction(A=Slider(360, range=0..1000), B=deg_15)
bang_30 = ExplodeTree(Data=da_upper_row_c_3.TopPlanes)  # -> Branch0, Branch1
lng_17 = ListLength(List=tstat_32.Paths)
crv_65 = Curve(da_upper_row_c_3.ChangedLines)
flatten_2 = FlattenTree(Tree=da_upper_row_c_3.Castings, Path="{0}")
lng_18 = ListLength(List=tstat_31.Paths)
panel_154 = Panel(subtraction_31)
addition_9 = Addition(A=lng_12, B=lng_18)
extremums_54 = MinMax(Number=flatten_2)  # -> Minimum, Maximum
smaller_5 = SmallerThan(FirstNumber=extremums_54.Minimum, SecondNumber=0)  # -> SmallerThan, OrEqualTo
subtraction_32 = Subtraction(A=lng_17, B=lng_18, C=lng_12)
mn_3 = RemoteSender(addition_9)
panel_155 = Panel(addition_9)
panel_156 = Panel(cluster_16.R)
panel_157 = Panel(cluster_16.B)
previewlw_25 = CustomPreviewLineweights(Geometry=da_upper_row_c_3.ChangedLines, Shader=swatch_2, Thickness=number_slider_23, Absolute=False)
panel_158 = Panel(subtraction_32)
prot_2 = RotatePlane(Plane=bang_30.Branch1, Angle=neg_5)
num_9 = Number(da_upper_row_c_3.Castings)
num_10 = Number(da_upper_row_c_3.CastingBuildUp)
tstat_33 = TreeStatistics(Tree=num_9)  # -> Paths, Length, Count
bang_31 = ExplodeTree(Data=num_10)  # -> Branch0, Branch1
item_78 = ListItem(List=tstat_33.Paths, Index=bang_31.Branch0, Wrap=True)
branch_31 = TreeBranch(Tree=num_9, Path=item_78, MaintainPaths=False)
tag_5 = TextTag3D(Location=prot_2, Text=panel_30, Size=1, Colour=swatch_3, Justification=8)
panel_159 = Panel(branch_31)
item_79 = ListItem(List=branch_31, Index=0, Wrap=True)  # -> flatten(Item)
item_80 = ListItem(List=branch_31, Index=1, Wrap=True)  # -> flatten(Item)
item_81 = ListItem(List=item_79, Index=panel_31, Wrap=True)
item_82 = ListItem(List=item_80, Index=panel_32, Wrap=True)
addition_10 = Addition(A=item_81, B=item_82)
panel_160 = Panel(da_upper_row_c_3.AnglesTop)
panel_161 = Panel(addition_10)
cbd_3_2 = RemoteReceiver(cbd_3)
cbd_3_3 = RemoteReceiver(cbd_3)
item_83 = ListItem(List=cbd_3_2, Index=Slider(2, range=0..10), Wrap=True)  # -> flatten(Item)
item_84 = ListItem(List=cbd_3_3, Index=Slider(1, range=0..10), Wrap=True)  # -> flatten(Item)
cull_i_13 = CullIndex(List=item_83, Indices="0", Wrap=True)
cull_i_14 = CullIndex(List=item_84, Indices="0", Wrap=True)
castings_3_2 = RemoteReceiver(castings_3)
mn_3_2 = RemoteReceiver(mn_3)
mn_3_3 = RemoteReceiver(mn_3)
previewlw_26 = CustomPreviewLineweights(Geometry=branch_25, Shader=ColourSwatch(SwatchColor=RGB(203, 207, 91)), Thickness=Slider(2, range=0..10), Absolute=False)

new_lines_2_2 = RemoteReceiver(new_lines_2)
grid_curves_3 = Curve(flatten(partition_9))
new_curves_3 = Curve(flatten(new_lines_2_2))
rdlines_3 = RemoveDuplicateLinesKaramba3D(Line=new_curves_3, LimitDistance=0.005)  # -> OutLine, Info, Indexes
midpt_3 = CurveMiddle(Curve=grid_curves_3)
mp_21 = Midpoint(Curve=rdlines_3.OutLine)
cp_13 = ClosestPoint(Point=graft(mp_21), Cloud=midpt_3)  # -> ClosestPoint, flatten(CPIndex), Distance
cull_i_15 = CullIndex(List=grid_curves_3, Indices=cp_13.CPIndex, Wrap=True)
extremums_55 = MinMax(Number=flatten(cp_13.Distance))  # -> Minimum, Maximum
larger_6 = LargerThan(FirstNumber=extremums_55.Maximum, SecondNumber=closeness_need_2)  # -> LargerThan, OrEqualTo
end_29 = EndPoints(Curve=rdlines_3.OutLine)  # -> Start, End
merge_53 = Merge(Data1=end_29.Start, Data2=end_29.End)
pdecon_29 = Deconstruct(Point=merge_53)  # -> XComponent, YComponent, ZComponent
extremums_56 = MinMax(Number=pdecon_29.ZComponent)  # -> Minimum, Maximum
filter_7 = StreamFilter(Gate=larger_6.LargerThan, Stream0=cull_i_15)
equalst_4 = EqualityWithinTolerance(FirstNumber=pdecon_29.ZComponent, SecondNumber=extremums_56.Maximum, Tolerance=tolerance_for_end_node_placement_2)  # -> Equality, Inequality
end_30 = EndPoints(Curve=graft(filter_7))  # -> Start, End
dispatch_17 = DispatchUnweave(Data=merge_53, Pattern=equalst_4.Equality)  # -> Out00, Out01, Out02
merge_54 = Merge(Data1=end_30.Start, Data2=end_30.End)
geo_3 = Geometry(dispatch_17.Out01)
pdecon_30 = Deconstruct(Point=merge_54)  # -> XComponent, YComponent, ZComponent
cullpt_20 = CullDuplicates(Points=geo_3, Tolerance=0.1, CullMode=1)  # -> Points, Indices, Valence
subtraction_33 = Subtraction(A=pdecon_30.ZComponent, B=extremums_56.Maximum)
abs_26 = Absolute(Value=subtraction_33)
first_last_5 = FirstLast(List=abs_26)  # -> FirstValue, LastValue
min_5 = Minimum(A=first_last_5.FirstValue, B=first_last_5.LastValue)
mindex_9 = MemberIndex(Set=abs_26, Member=min_5)  # -> Index, Count
item_85 = ListItem(List=merge_54, Index=mindex_9.Index, Wrap=True)
pdecon_31 = Deconstruct(Point=item_85)  # -> XComponent, YComponent, ZComponent
abs_27 = Absolute(Value=pdecon_31.YComponent)
first_last_6 = FirstLast(List=abs_27)  # -> FirstValue, LastValue
cull_i_16 = CullIndex(List=merge_54, Indices=mindex_9.Index, Wrap=True)
min_6 = Minimum(A=first_last_6.FirstValue, B=first_last_6.LastValue)
mindex_10 = MemberIndex(Set=abs_27, Member=min_6)  # -> Index, Count
merge_55 = Merge(Data1=addition_8, Data2=number_slider_34)

item_86 = ListItem(List=cullpt_20.Points, Index=Slider(0, range=0..10), Wrap=True)
item_87 = ListItem(List=mindex_10.Index, Index=0, Wrap=True)

item_88 = ListItem(List=item_85, Index=item_87, Wrap=True)  # -> simplify(Item)
dist_7 = Distance(PointA=graft(cullpt_20.Points), PointB=flatten(item_88))
lng_19 = ListLength(List=dist_7)
cull_i_17 = CullIndex(List=item_85, Indices=item_87, Wrap=True)
smaller_6 = SmallerThan(FirstNumber=dist_7, SecondNumber=Slider(1.49, range=0..10))  # -> SmallerThan, OrEqualTo
series_6 = Series(Start=0, Step=1, Count=lng_19)
dispatch_18 = Dispatch(List=series_6, DispatchPattern=smaller_6.SmallerThan)  # -> ListA, ListB
tstat_34 = TreeStatistics(Tree=item_88)  # -> Paths, Length, Count
lng_20 = ListLength(List=dispatch_18.ListA)
repeat_11 = RepeatData(Data=graft(cullpt_20.Points), Length=lng_20)
cull_i_18 = CullIndex(List=tstat_34.Paths, Indices=flatten(dispatch_18.ListA), Wrap=True)
merge_56 = Merge(Data1=cull_i_17, Data2=cull_i_16)
branch_32 = TreeBranch(Tree=item_88, Path=cull_i_18, MaintainPaths=True)
sort_26 = SortList(Keys=flatten(dispatch_18.ListA), ValuesA=flatten(repeat_11))  # -> Keys, ValuesA
item_89 = ListItem(List=tstat_34.Paths, Index=flatten(dispatch_18.ListA), Wrap=True)
branch_33 = TreeBranch(Tree=item_88, Path=item_89, MaintainPaths=True)
clone_3 = CloneStructure(List=sort_26.ValuesA, Structure=branch_33)
merge_57 = Merge(Data1=simplify(branch_32), Data2=simplify(merge_56), Data3=simplify(clone_3))
pline_4 = PolyLine(Vertices=merge_57, Closed=False)
merge_58 = Merge(Data1=flatten(pline_4), Data2=flatten(rdlines_3.OutLine))
mp_22 = Midpoint(Curve=merge_58)
pdecon_32 = Deconstruct(Point=mp_22)  # -> XComponent, YComponent, ZComponent
sort_27 = SortList(Keys=pdecon_32.XComponent, ValuesA=merge_58)  # -> Keys, ValuesA
pt_10 = ConstructPoint(XCoordinate=sort_27.Keys, YCoordinate=0, ZCoordinate=0)
cullpt_21 = CullDuplicates(Points=pt_10, Tolerance=Slider(1, range=0..1), CullMode=1)  # -> Points, Indices, Valence
partition_10 = PartitionList(List=sort_27.ValuesA, Size=repeat_8)
mp_23 = Midpoint(Curve=partition_10)
pdecon_33 = Deconstruct(Point=mp_23)  # -> XComponent, YComponent, ZComponent
sort_28 = SortList(Keys=pdecon_33.YComponent, ValuesA=partition_10)  # -> Keys, reverse(ValuesA)
end_31 = EndPoints(Curve=flatten(sort_28.ValuesA))  # -> Start, End
tstat_35 = TreeStatistics(Tree=sort_28.ValuesA)  # -> Paths, Length, Count
item_90 = ListItem(List=tstat_35.Paths, Index=merge_55, Wrap=True)
merge_59 = Merge(Data1=end_31.Start, Data2=end_31.End)
branch_34 = TreeBranch(Tree=sort_28.ValuesA, Path=item_90, MaintainPaths=True)
cullpt_22 = CullDuplicates(Points=merge_59, Tolerance=0.1, CullMode=1)  # -> Points, Indices, Valence
lines_3 = RemoteSender(branch_34)
del_11 = DelaunayMesh(Points=cullpt_22.Points, Plane=PlaneXY(0, 0, 0))
shell_3 = RemoteSender(del_11)

shell_3_2 = RemoteReceiver(shell_3)
lines_3_2 = RemoteReceiver(lines_3)
bang_32 = ExplodeTree(Data=lines_3_2)  # -> Branch0, Branch1
da_upper_row_c_4 = DynamicAnglesUpperRowCastings(
    TopLines=bang_32.Branch1,
    DiagonalLines=bang_32.Branch0,
    TopLineIndex=Slider(1, range=0..10),
    DiagonalIndex=Slider(3, range=0..10),
    TopAngles0=genes_32,
    TopAngles4=genes_36,
    TopAngles5=genes_33,
    TopAngles9=genes_34,
    DefAngles1=genes_37,
    DefAngles2=genes_35,
    SideAngles5=genes_31,
    DomeMesh=shell_3_2,
    Castings=castings_3_2,
    CastingFrom2Becoming6=cull_i_13,
    CastingFrom1Becoming7=cull_i_14,
    MachineNumber=mn_3_2,
    MoldCastings=da_upper_row_c_3.MoldedCastings)  # -> OriginalLines, ChangedPoints, ChangedLines, AnglesTop, AnglesSide, TestingPoint, Cost, AngleCost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
cluster_17 = Cluster_10(
    top_angles=da_upper_row_c_4.AnglesTop,
    castings=da_upper_row_c_4.Castings,
    cbd=da_upper_row_c_4.CastingBuildUp,
    i=Slider(42, range=0..100),
    side_angles=da_upper_row_c_4.AnglesSide)  # -> B, R, side_results, side_check
panel_162 = Panel(cluster_17.side_results)
panel_163 = Panel(cluster_17.side_check)
panel_164 = Panel(da_upper_row_c_4.CastingBuildUp)
cbd_4 = RemoteSender(da_upper_row_c_4.CastingBuildUp)
dist_total_3 = RemoteSender(da_upper_row_c_4.CastingsDist)
new_lines_3 = RemoteSender(da_upper_row_c_4.ChangedLines)
casting_4 = RemoteSender(da_upper_row_c_4.Castings)
panel_165 = Panel(cluster_17.R)
panel_166 = Panel(cluster_17.B)
tstat_36 = TreeStatistics(Tree=da_upper_row_c_4.Castings)  # -> Paths, Length, Count
bang_33 = ExplodeTree(Data=da_upper_row_c_4.CastingBuildUp)  # -> Branch0, Branch1
tstat_37 = TreeStatistics(Tree=da_upper_row_c_4.MachinedCastings)  # -> Paths, Length, Count
bang_34 = ExplodeTree(Data=da_upper_row_c_4.AnglesTop)  # -> Branch0, Branch1
tstat_38 = TreeStatistics(Tree=da_upper_row_c_4.Castings)  # -> Paths, Length, Count
lng_21 = ListLength(List=tstat_38.Paths)
flatten_3 = FlattenTree(Tree=da_upper_row_c_4.Castings, Path="{0}")
lng_22 = ListLength(List=tstat_37.Paths)
item_91 = ListItem(List=tstat_36.Paths, Index=bang_33.Branch0, Wrap=True)
addition_11 = Addition(A=mn_3_3, B=lng_22)
extremums_57 = MinMax(Number=flatten_3)  # -> Minimum, Maximum
smaller_7 = SmallerThan(FirstNumber=extremums_57.Minimum, SecondNumber=0)  # -> SmallerThan, OrEqualTo
subtraction_34 = Subtraction(A=lng_21, B=lng_22, C=mn_3_3)
branch_35 = TreeBranch(Tree=da_upper_row_c_4.Castings, Path=item_91, MaintainPaths=False)
panel_167 = Panel(bang_34.Branch0)
mn_4 = RemoteSender(addition_11)
panel_168 = Panel(addition_11)
panel_169 = Panel(subtraction_34)
panel_170 = Panel(branch_35)
gridlines_3 = RemoteSender(partition_10)
gridlines_3_2 = RemoteReceiver(gridlines_3)
cbd_4_2 = RemoteReceiver(cbd_4)
cbd_4_3 = RemoteReceiver(cbd_4)
item_92 = ListItem(List=cbd_4_2, Index=Slider(2, range=0..10), Wrap=True)  # -> flatten(Item)
item_93 = ListItem(List=cbd_4_3, Index=Slider(1, range=0..10), Wrap=True)  # -> flatten(Item)
cull_i_19 = CullIndex(List=item_93, Indices="0", Wrap=True)
cull_i_20 = CullIndex(List=item_92, Indices="0", Wrap=True)
casting_4_2 = RemoteReceiver(casting_4)
mn_4_2 = RemoteReceiver(mn_4)

new_lines_3_2 = RemoteReceiver(new_lines_3)
grid_curves_4 = Curve(flatten(gridlines_3_2))
new_curves_4 = Curve(flatten(new_lines_3_2))
rdlines_4 = RemoveDuplicateLinesKaramba3D(Line=new_curves_4, LimitDistance=0.005)  # -> OutLine, Info, Indexes
midpt_4 = CurveMiddle(Curve=grid_curves_4)
mp_24 = Midpoint(Curve=rdlines_4.OutLine)
cp_14 = ClosestPoint(Point=graft(mp_24), Cloud=midpt_4)  # -> ClosestPoint, flatten(CPIndex), Distance
closeness_need_4 = Slider(0.8, range=0..1)
extremums_58 = MinMax(Number=flatten(cp_14.Distance))  # -> Minimum, Maximum
larger_7 = LargerThan(FirstNumber=extremums_58.Maximum, SecondNumber=Slider(1.6, range=0..10))  # -> LargerThan, OrEqualTo
end_32 = EndPoints(Curve=rdlines_4.OutLine)  # -> Start, End
tolerance_for_end_node_placement_4 = Slider(0.4, range=0..1)
merge_60 = Merge(Data1=end_32.Start, Data2=end_32.End)
pdecon_34 = Deconstruct(Point=merge_60)  # -> XComponent, YComponent, ZComponent
extremums_59 = MinMax(Number=pdecon_34.ZComponent)  # -> Minimum, Maximum
equalst_5 = EqualityWithinTolerance(FirstNumber=pdecon_34.ZComponent, SecondNumber=extremums_59.Maximum, Tolerance=tolerance_for_end_node_placement_4)  # -> Equality, Inequality
dispatch_19 = DispatchUnweave(Data=merge_60, Pattern=equalst_5.Equality)  # -> Out00, Out01, Out02
distance_between_point_and_node_4 = Slider(1, range=0..1)
geo_4 = Geometry(dispatch_19.Out01)
cullpt_23 = CullDuplicates(Points=geo_4, Tolerance=0.1, CullMode=1)  # -> Points, Indices, Valence
item_94 = ListItem(List=cullpt_23.Points, Index=Slider(0, range=0..10), Wrap=True)
merge_61 = Merge(
    Data1=Slider(17, range=0..100),
    Data2=Slider(36, range=0..100),
    Data3=Slider(18, range=0..100),
    Data4=Slider(36, range=0..100))
repeat_12 = RepeatData(Data=merge_61, Length=Slider(29, range=0..100))
number_slider_35 = Slider(5, range=0..10)
number_slider_36 = Slider(7, range=0..10)
addition_12 = Addition(A=number_slider_36, B=1)
merge_62 = Merge(Data1=addition_12, Data2=number_slider_36)

rdlines_5 = RemoveDuplicateLinesKaramba3D(Line=grid_curves_4, LimitDistance=0.005)  # -> OutLine, Info, Indexes

cull_i_21 = CullIndex(List=rdlines_5.OutLine, Indices=cp_14.CPIndex, Wrap=True)
filter_8 = StreamFilter(Gate=larger_7.LargerThan, Stream0=cull_i_21)
end_33 = EndPoints(Curve=graft(filter_8))  # -> Start, End
merge_63 = Merge(Data1=end_33.Start, Data2=end_33.End)
pdecon_35 = Deconstruct(Point=merge_63)  # -> XComponent, YComponent, ZComponent
subtraction_35 = Subtraction(A=pdecon_35.ZComponent, B=extremums_59.Maximum)
abs_28 = Absolute(Value=subtraction_35)
first_last_7 = FirstLast(List=abs_28)  # -> FirstValue, LastValue
min_7 = Minimum(A=first_last_7.FirstValue, B=first_last_7.LastValue)
mindex_11 = MemberIndex(Set=abs_28, Member=min_7)  # -> Index, Count
item_95 = ListItem(List=merge_63, Index=mindex_11.Index, Wrap=True)
pdecon_36 = Deconstruct(Point=item_95)  # -> XComponent, YComponent, ZComponent
abs_29 = Absolute(Value=pdecon_36.YComponent)
first_last_8 = FirstLast(List=abs_29)  # -> FirstValue, LastValue
cull_i_22 = CullIndex(List=merge_63, Indices=mindex_11.Index, Wrap=True)
min_8 = Minimum(A=first_last_8.FirstValue, B=first_last_8.LastValue)
mindex_12 = MemberIndex(Set=abs_29, Member=min_8)  # -> Index, Count
item_96 = ListItem(List=mindex_12.Index, Index=0, Wrap=True)
cull_i_23 = CullIndex(List=item_95, Indices=item_96, Wrap=True)
item_97 = ListItem(List=item_95, Index=item_96, Wrap=True)  # -> simplify(Item)
dist_8 = Distance(PointA=graft(cullpt_23.Points), PointB=flatten(item_97))
lng_23 = ListLength(List=dist_8)
smaller_8 = SmallerThan(FirstNumber=dist_8, SecondNumber=Slider(2.01, range=0..10))  # -> SmallerThan, OrEqualTo
series_7 = Series(Start=0, Step=1, Count=lng_23)
dispatch_20 = Dispatch(List=series_7, DispatchPattern=smaller_8.SmallerThan)  # -> ListA, ListB
tstat_39 = TreeStatistics(Tree=item_97)  # -> Paths, Length, Count
lng_24 = ListLength(List=dispatch_20.ListA)
repeat_13 = RepeatData(Data=graft(cullpt_23.Points), Length=lng_24)
cull_i_24 = CullIndex(List=tstat_39.Paths, Indices=flatten(dispatch_20.ListA), Wrap=True)
merge_64 = Merge(Data1=cull_i_23, Data2=cull_i_22)
branch_36 = TreeBranch(Tree=item_97, Path=cull_i_24, MaintainPaths=True)
item_98 = ListItem(List=tstat_39.Paths, Index=flatten(dispatch_20.ListA), Wrap=True)
sort_29 = SortList(Keys=flatten(dispatch_20.ListA), ValuesA=flatten(repeat_13))  # -> Keys, ValuesA
branch_37 = TreeBranch(Tree=item_97, Path=item_98, MaintainPaths=True)
clone_4 = CloneStructure(List=sort_29.ValuesA, Structure=branch_37)
merge_65 = Merge(Data1=simplify(branch_36), Data2=simplify(merge_64), Data3=simplify(clone_4))
pline_5 = PolyLine(Vertices=merge_65, Closed=False)
merge_66 = Merge(Data1=flatten(pline_5), Data2=flatten(rdlines_4.OutLine))
mp_25 = Midpoint(Curve=merge_66)
pdecon_37 = Deconstruct(Point=mp_25)  # -> XComponent, YComponent, ZComponent
sort_30 = SortList(Keys=pdecon_37.XComponent, ValuesA=merge_66)  # -> Keys, ValuesA
pt_11 = ConstructPoint(XCoordinate=sort_30.Keys, YCoordinate=0, ZCoordinate=0)
cullpt_24 = CullDuplicates(Points=pt_11, Tolerance=Slider(1, range=0..1), CullMode=1)  # -> Points, Indices, Valence
partition_11 = PartitionList(List=sort_30.ValuesA, Size=repeat_12)
mp_26 = Midpoint(Curve=partition_11)
pdecon_38 = Deconstruct(Point=mp_26)  # -> XComponent, YComponent, ZComponent
sort_31 = SortList(Keys=pdecon_38.YComponent, ValuesA=partition_11)  # -> Keys, reverse(ValuesA)
end_34 = EndPoints(Curve=flatten(sort_31.ValuesA))  # -> Start, End
tstat_40 = TreeStatistics(Tree=sort_31.ValuesA)  # -> Paths, Length, Count
item_99 = ListItem(List=tstat_40.Paths, Index=merge_62, Wrap=True)
merge_67 = Merge(Data1=end_34.Start, Data2=end_34.End)
branch_38 = TreeBranch(Tree=sort_31.ValuesA, Path=item_99, MaintainPaths=True)
cullpt_25 = CullDuplicates(Points=merge_67, Tolerance=0.1, CullMode=1)  # -> Points, Indices, Valence
lines_4 = RemoteSender(branch_38)
del_12 = DelaunayMesh(Points=cullpt_25.Points, Plane=PlaneXY(0, 0, 0))
shell_4 = RemoteSender(del_12)

lines_4_2 = RemoteReceiver(lines_4)
shell_4_2 = RemoteReceiver(shell_4)
bang_35 = ExplodeTree(Data=lines_4_2)  # -> Branch0, Branch1
da_upper_row_c_5 = DynamicAnglesUpperRowCastings(
    TopLines=bang_35.Branch1,
    DiagonalLines=bang_35.Branch0,
    TopLineIndex=Slider(0, range=0..10),
    DiagonalIndex=Slider(2, range=0..10),
    TopAngles0=genes_32,
    TopAngles4=genes_36,
    TopAngles5=genes_33,
    TopAngles9=genes_34,
    DefAngles1=genes_37,
    DefAngles2=genes_35,
    SideAngles5=genes_31,
    DomeMesh=shell_4_2,
    Castings=casting_4_2,
    CastingFrom2Becoming6=item_92,
    CastingFrom1Becoming7=item_93,
    MachineNumber=mn_4_2,
    MoldCastings=da_upper_row_c_4.MoldedCastings)  # -> OriginalLines, ChangedPoints, ChangedLines, AnglesTop, AnglesSide, TestingPoint, Cost, AngleCost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
cluster_18 = Cluster_10(
    top_angles=da_upper_row_c_5.AnglesTop,
    castings=da_upper_row_c_5.Castings,
    cbd=da_upper_row_c_5.CastingBuildUp,
    i=Slider(0, range=0..100))  # -> B, R, side_results, side_check
cbd_5 = RemoteSender(da_upper_row_c_5.CastingBuildUp)
panel_171 = Panel(cluster_18.R)
panel_172 = Panel(cluster_18.B)
gridlines_4 = RemoteSender(partition_11)
cbd_5_2 = RemoteReceiver(cbd_5)
cbd_5_3 = RemoteReceiver(cbd_5)
item_100 = ListItem(List=cbd_5_2, Index=Slider(2, range=0..10), Wrap=True)  # -> flatten(Item)
item_101 = ListItem(List=cbd_5_3, Index=Slider(1, range=0..10), Wrap=True)  # -> flatten(Item)
cull_i_25 = CullIndex(List=item_101, Indices="0", Wrap=True)
cull_i_26 = CullIndex(List=item_100, Indices="0", Wrap=True)
cbd_5_4 = RemoteReceiver(cbd_5)  # disabled
cbd_5_5 = RemoteReceiver(cbd_5)  # disabled
item_102 = ListItem(List=cbd_5_4, Index=number_slider_26, Wrap=True)  # -> flatten(Item); disabled
item_103 = ListItem(List=cbd_5_5, Index=number_slider_27, Wrap=True)  # -> flatten(Item); disabled
cull_i_27 = CullIndex(List=item_103, Indices=panel_33, Wrap=True)  # disabled
cull_i_28 = CullIndex(List=item_102, Indices=panel_34, Wrap=True)  # disabled

dist_total_4 = RemoteSender(da_upper_row_c_5.CastingsDist)
casting_5 = RemoteSender(da_upper_row_c_5.Castings)
crv_66 = Curve(da_upper_row_c_5.ChangedLines)
mn_4_3 = RemoteReceiver(mn_4)
tstat_41 = TreeStatistics(Tree=da_upper_row_c_5.MachinedCastings)  # -> Paths, Length, Count
tstat_42 = TreeStatistics(Tree=da_upper_row_c_5.Castings)  # -> Paths, Length, Count
lng_25 = ListLength(List=tstat_42.Paths)
lng_26 = ListLength(List=tstat_41.Paths)
flatten_4 = FlattenTree(Tree=da_upper_row_c_5.Castings, Path="{0}")
addition_13 = Addition(A=mn_4_3, B=lng_26)
subtraction_36 = Subtraction(A=lng_25, B=lng_26, C=mn_4_3)
mn_5 = RemoteSender(addition_13)
extremums_60 = MinMax(Number=flatten_4)  # -> Minimum, Maximum
smaller_9 = SmallerThan(FirstNumber=extremums_60.Minimum, SecondNumber=0)  # -> SmallerThan, OrEqualTo
multiplication_27 = Multiplication(A=num_7, B=Slider(200, range=0..1000))
panel_173 = Panel(addition_13)
num_11 = Number(filter_3)
multiplication_28 = Multiplication(A=num_11, B=100)
panel_174 = Panel(subtraction_36)
multiplication_29 = Multiplication(B=10)
number_slider_37 = Slider(600000, range=0..1000000)

new_lines_4 = RemoteSender(crv_66)

gridlines_4_2 = RemoteReceiver(gridlines_4)
new_lines_4_2 = RemoteReceiver(new_lines_4)
grid_curves_5 = Curve(flatten(gridlines_4_2))
new_curves_5 = Curve(flatten(new_lines_4_2))
rdlines_6 = RemoveDuplicateLinesKaramba3D(Line=grid_curves_5, LimitDistance=0.005)  # -> OutLine, Info, Indexes
rdlines_7 = RemoveDuplicateLinesKaramba3D(Line=new_curves_5, LimitDistance=0.005)  # -> OutLine, Info, Indexes
midpt_5 = CurveMiddle(Curve=grid_curves_5)
mp_27 = Midpoint(Curve=rdlines_7.OutLine)
cp_15 = ClosestPoint(Point=graft(mp_27), Cloud=midpt_5)  # -> ClosestPoint, flatten(CPIndex), Distance
closeness_need_5 = Slider(0.8, range=0..1)
cull_i_29 = CullIndex(List=rdlines_6.OutLine, Indices=cp_15.CPIndex, Wrap=True)
extremums_61 = MinMax(Number=flatten(cp_15.Distance))  # -> Minimum, Maximum
larger_8 = LargerThan(FirstNumber=extremums_61.Maximum, SecondNumber=Slider(1.6, range=0..10))  # -> LargerThan, OrEqualTo
end_35 = EndPoints(Curve=rdlines_7.OutLine)  # -> Start, End
tolerance_for_end_node_placement_5 = Slider(0.4, range=0..1)
merge_68 = Merge(Data1=end_35.Start, Data2=end_35.End)
pdecon_39 = Deconstruct(Point=merge_68)  # -> XComponent, YComponent, ZComponent
extremums_62 = MinMax(Number=pdecon_39.ZComponent)  # -> Minimum, Maximum
filter_9 = StreamFilter(Gate=larger_8.LargerThan, Stream0=cull_i_29)
equalst_6 = EqualityWithinTolerance(FirstNumber=pdecon_39.ZComponent, SecondNumber=extremums_62.Maximum, Tolerance=tolerance_for_end_node_placement_5)  # -> Equality, Inequality
end_36 = EndPoints(Curve=graft(filter_9))  # -> Start, End
dispatch_21 = DispatchUnweave(Data=merge_68, Pattern=equalst_6.Equality)  # -> Out00, Out01, Out02
merge_69 = Merge(Data1=end_36.Start, Data2=end_36.End)
distance_between_point_and_node_5 = Slider(1, range=0..1)
pdecon_40 = Deconstruct(Point=merge_69)  # -> XComponent, YComponent, ZComponent
geo_5 = Geometry(dispatch_21.Out01)
cullpt_26 = CullDuplicates(Points=geo_5, Tolerance=0.1, CullMode=1)  # -> Points, Indices, Valence
subtraction_37 = Subtraction(A=pdecon_40.ZComponent, B=extremums_62.Maximum)
abs_30 = Absolute(Value=subtraction_37)
first_last_9 = FirstLast(List=abs_30)  # -> FirstValue, LastValue
item_104 = ListItem(List=cullpt_26.Points, Index=Slider(0, range=0..10), Wrap=True)
min_9 = Minimum(A=first_last_9.FirstValue, B=first_last_9.LastValue)
mindex_13 = MemberIndex(Set=abs_30, Member=min_9)  # -> Index, Count
item_105 = ListItem(List=merge_69, Index=mindex_13.Index, Wrap=True)
pdecon_41 = Deconstruct(Point=item_105)  # -> XComponent, YComponent, ZComponent
abs_31 = Absolute(Value=pdecon_41.YComponent)
first_last_10 = FirstLast(List=abs_31)  # -> FirstValue, LastValue
cull_i_30 = CullIndex(List=merge_69, Indices=mindex_13.Index, Wrap=True)
min_10 = Minimum(A=first_last_10.FirstValue, B=first_last_10.LastValue)
mindex_14 = MemberIndex(Set=abs_31, Member=min_10)  # -> Index, Count
item_106 = ListItem(List=mindex_14.Index, Index=0, Wrap=True)
cull_i_31 = CullIndex(List=item_105, Indices=item_106, Wrap=True)
item_107 = ListItem(List=item_105, Index=item_106, Wrap=True)  # -> simplify(Item)
dist_9 = Distance(PointA=graft(cullpt_26.Points), PointB=flatten(item_107))
lng_27 = ListLength(List=dist_9)
smaller_10 = SmallerThan(FirstNumber=dist_9, SecondNumber=Slider(2.01, range=0..10))  # -> SmallerThan, OrEqualTo
series_8 = Series(Start=0, Step=1, Count=lng_27)
dispatch_22 = Dispatch(List=series_8, DispatchPattern=smaller_10.SmallerThan)  # -> ListA, ListB
tstat_43 = TreeStatistics(Tree=item_107)  # -> Paths, Length, Count
lng_28 = ListLength(List=dispatch_22.ListA)
repeat_14 = RepeatData(Data=graft(cullpt_26.Points), Length=lng_28)
cull_i_32 = CullIndex(List=tstat_43.Paths, Indices=flatten(dispatch_22.ListA), Wrap=True)
merge_70 = Merge(Data1=cull_i_31, Data2=cull_i_30)
branch_39 = TreeBranch(Tree=item_107, Path=cull_i_32, MaintainPaths=True)
item_108 = ListItem(List=tstat_43.Paths, Index=flatten(dispatch_22.ListA), Wrap=True)
sort_32 = SortList(Keys=flatten(dispatch_22.ListA), ValuesA=flatten(repeat_14))  # -> Keys, ValuesA
branch_40 = TreeBranch(Tree=item_107, Path=item_108, MaintainPaths=True)
clone_5 = CloneStructure(List=sort_32.ValuesA, Structure=branch_40)
merge_71 = Merge(Data1=simplify(branch_39), Data2=simplify(merge_70), Data3=simplify(clone_5))
pline_6 = PolyLine(Vertices=merge_71, Closed=False)
merge_72 = Merge(Data1=flatten(pline_6), Data2=flatten(rdlines_7.OutLine))
mp_28 = Midpoint(Curve=merge_72)
pdecon_42 = Deconstruct(Point=mp_28)  # -> XComponent, YComponent, ZComponent
sort_33 = SortList(Keys=pdecon_42.XComponent, ValuesA=merge_72)  # -> Keys, ValuesA
pt_12 = ConstructPoint(XCoordinate=sort_33.Keys, YCoordinate=0, ZCoordinate=0)
cullpt_27 = CullDuplicates(Points=pt_12, Tolerance=Slider(1, range=0..1), CullMode=1)  # -> Points, Indices, Valence
merge_73 = Merge(
    Data1=Slider(17, range=0..100),
    Data2=Slider(36, range=0..100),
    Data3=Slider(18, range=0..100),
    Data4=Slider(36, range=0..100))
repeat_15 = RepeatData(Data=merge_73, Length=Slider(29, range=0..100))
partition_12 = PartitionList(List=sort_33.ValuesA, Size=repeat_15)
mp_29 = Midpoint(Curve=partition_12)
gridlines_5 = RemoteSender(partition_12)
pdecon_43 = Deconstruct(Point=mp_29)  # -> XComponent, YComponent, ZComponent
number_slider_38 = Slider(5, range=0..10)
number_slider_39 = Slider(9, range=0..10)
sort_34 = SortList(Keys=pdecon_43.YComponent, ValuesA=partition_12)  # -> Keys, reverse(ValuesA)
addition_14 = Addition(A=number_slider_39, B=1)
end_37 = EndPoints(Curve=flatten(sort_34.ValuesA))  # -> Start, End
tstat_44 = TreeStatistics(Tree=sort_34.ValuesA)  # -> Paths, Length, Count
merge_74 = Merge(Data1=addition_14, Data2=number_slider_39)
item_109 = ListItem(List=tstat_44.Paths, Index=merge_74, Wrap=True)
merge_75 = Merge(Data1=end_37.Start, Data2=end_37.End)
branch_41 = TreeBranch(Tree=sort_34.ValuesA, Path=item_109, MaintainPaths=True)
cullpt_28 = CullDuplicates(Points=merge_75, Tolerance=0.1, CullMode=1)  # -> Points, Indices, Valence
lines_5 = RemoteSender(branch_41)
del_13 = DelaunayMesh(Points=cullpt_28.Points, Plane=PlaneXY(0, 0, 0))
shell_5 = RemoteSender(del_13)

lines_5_2 = RemoteReceiver(lines_5)
casting_5_2 = RemoteReceiver(casting_5)
shell_5_2 = RemoteReceiver(shell_5)
mn_5_2 = RemoteReceiver(mn_5)
bang_36 = ExplodeTree(Data=lines_5_2)  # -> Branch0, Branch1
da_upper_row_c_6 = DynamicAnglesUpperRowCastings(
    TopLines=bang_36.Branch1,
    DiagonalLines=bang_36.Branch0,
    TopLineIndex=Slider(1, range=0..10),
    DiagonalIndex=Slider(3, range=0..10),
    TopAngles0=genes_32,
    TopAngles4=genes_36,
    TopAngles5=genes_33,
    TopAngles9=genes_34,
    DefAngles1=genes_37,
    DefAngles2=genes_35,
    SideAngles5=genes_31,
    DomeMesh=shell_5_2,
    Castings=casting_5_2,
    CastingFrom2Becoming6=cull_i_26,
    CastingFrom1Becoming7=cull_i_25,
    MachineNumber=mn_5_2,
    MoldCastings=da_upper_row_c_5.MoldedCastings)  # -> OriginalLines, ChangedPoints, ChangedLines, AnglesTop, AnglesSide, TestingPoint, Cost, AngleCost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
crv_67 = Curve(da_upper_row_c_6.ChangedLines)

new_lines_5 = RemoteSender(crv_67)
dist_total_5 = RemoteSender(da_upper_row_c_6.CastingsDist)
casting_6 = RemoteSender(da_upper_row_c_6.Castings)
mn_5_3 = RemoteReceiver(mn_5)
tstat_45 = TreeStatistics(Tree=da_upper_row_c_6.MachinedCastings)  # -> Paths, Length, Count
tstat_46 = TreeStatistics(Tree=da_upper_row_c_6.Castings)  # -> Paths, Length, Count
lng_29 = ListLength(List=tstat_46.Paths)
lng_30 = ListLength(List=tstat_45.Paths)
flatten_5 = FlattenTree(Tree=da_upper_row_c_6.Castings, Path="{0}")
addition_15 = Addition(A=mn_5_3, B=lng_30)
subtraction_38 = Subtraction(A=lng_29, B=lng_30, C=mn_5_3)
mn_6 = RemoteSender(addition_15)
extremums_63 = MinMax(Number=flatten_5)  # -> Minimum, Maximum
smaller_11 = SmallerThan(FirstNumber=extremums_63.Minimum, SecondNumber=0)  # -> SmallerThan, OrEqualTo
multiplication_30 = Multiplication(A=num_7, B=Slider(200, range=0..1000))
panel_175 = Panel(addition_15)
panel_176 = Panel(subtraction_38)
num_12 = Number(filter_3)
multiplication_31 = Multiplication(A=num_12, B=100)
multiplication_32 = Multiplication(B=10)
number_slider_40 = Slider(600000, range=0..1000000)

gridlines_5_2 = RemoteReceiver(gridlines_5)  # disabled
new_lines_5_2 = RemoteReceiver(new_lines_5)  # disabled
grid_curves_6 = Curve(flatten(gridlines_5_2))  # disabled
new_curves_6 = Curve(flatten(new_lines_5_2))  # disabled
rdlines_8 = RemoveDuplicateLinesKaramba3D(Line=grid_curves_6, LimitDistance=0.005)  # -> OutLine, Info, Indexes; disabled
rdlines_9 = RemoveDuplicateLinesKaramba3D(Line=new_curves_6, LimitDistance=0.005)  # -> OutLine, Info, Indexes; disabled
midpt_6 = CurveMiddle(Curve=grid_curves_6)  # disabled
mp_30 = Midpoint(Curve=rdlines_9.OutLine)  # disabled
cp_16 = ClosestPoint(Point=graft(mp_30), Cloud=midpt_6)  # -> ClosestPoint, flatten(CPIndex), Distance; disabled
closeness_need_6 = Slider(0.8, range=0..1)  # disabled
cull_i_33 = CullIndex(List=rdlines_8.OutLine, Indices=cp_16.CPIndex, Wrap=True)  # disabled
extremums_64 = MinMax(Number=flatten(cp_16.Distance))  # -> Minimum, Maximum; disabled
number_slider_41 = Slider(1.6, range=0..10)  # disabled
larger_9 = LargerThan(FirstNumber=extremums_64.Maximum, SecondNumber=number_slider_41)  # -> LargerThan, OrEqualTo; disabled
end_38 = EndPoints(Curve=rdlines_9.OutLine)  # -> Start, End; disabled
tolerance_for_end_node_placement_6 = Slider(0.4, range=0..1)  # disabled
merge_76 = Merge(Data1=end_38.Start, Data2=end_38.End)  # disabled
pdecon_44 = Deconstruct(Point=merge_76)  # -> XComponent, YComponent, ZComponent; disabled
extremums_65 = MinMax(Number=pdecon_44.ZComponent)  # -> Minimum, Maximum; disabled
filter_10 = StreamFilter(Gate=larger_9.LargerThan, Stream0=cull_i_33)  # disabled
equalst_7 = EqualityWithinTolerance(FirstNumber=pdecon_44.ZComponent, SecondNumber=extremums_65.Maximum, Tolerance=tolerance_for_end_node_placement_6)  # -> Equality, Inequality; disabled
end_39 = EndPoints(Curve=graft(filter_10))  # -> Start, End; disabled
dispatch_23 = DispatchUnweave(Data=merge_76, Pattern=equalst_7.Equality)  # -> Out00, Out01, Out02; disabled
merge_77 = Merge(Data1=end_39.Start, Data2=end_39.End)  # disabled
distance_between_point_and_node_6 = Slider(1, range=0..1)  # disabled
pdecon_45 = Deconstruct(Point=merge_77)  # -> XComponent, YComponent, ZComponent; disabled
geo_6 = Geometry(dispatch_23.Out01)  # disabled
cullpt_29 = CullDuplicates(Points=geo_6, Tolerance=0.1, CullMode=1)  # -> Points, Indices, Valence; disabled
number_slider_42 = Slider(0, range=0..10)  # disabled
subtraction_39 = Subtraction(A=pdecon_45.ZComponent, B=extremums_65.Maximum)  # disabled
abs_32 = Absolute(Value=subtraction_39)  # disabled
number_slider_43 = Slider(2.01, range=0..10)  # disabled
first_last_11 = FirstLast(List=abs_32)  # -> FirstValue, LastValue; disabled
item_110 = ListItem(List=cullpt_29.Points, Index=number_slider_42, Wrap=True)  # disabled
min_11 = Minimum(A=first_last_11.FirstValue, B=first_last_11.LastValue)  # disabled
mindex_15 = MemberIndex(Set=abs_32, Member=min_11)  # -> Index, Count; disabled
item_111 = ListItem(List=merge_77, Index=mindex_15.Index, Wrap=True)  # disabled
pdecon_46 = Deconstruct(Point=item_111)  # -> XComponent, YComponent, ZComponent; disabled
abs_33 = Absolute(Value=pdecon_46.YComponent)  # disabled
first_last_12 = FirstLast(List=abs_33)  # -> FirstValue, LastValue; disabled
cull_i_34 = CullIndex(List=merge_77, Indices=mindex_15.Index, Wrap=True)  # disabled
min_12 = Minimum(A=first_last_12.FirstValue, B=first_last_12.LastValue)  # disabled
mindex_16 = MemberIndex(Set=abs_33, Member=min_12)  # -> Index, Count; disabled
item_112 = ListItem(List=mindex_16.Index, Index=0, Wrap=True)  # disabled
cull_i_35 = CullIndex(List=item_111, Indices=item_112, Wrap=True)  # disabled
item_113 = ListItem(List=item_111, Index=item_112, Wrap=True)  # -> simplify(Item); disabled
dist_10 = Distance(PointA=graft(cullpt_29.Points), PointB=flatten(item_113))  # disabled
lng_31 = ListLength(List=dist_10)  # disabled
smaller_12 = SmallerThan(FirstNumber=dist_10, SecondNumber=number_slider_43)  # -> SmallerThan, OrEqualTo; disabled
series_9 = Series(Start=0, Step=1, Count=lng_31)  # disabled
dispatch_24 = Dispatch(List=series_9, DispatchPattern=smaller_12.SmallerThan)  # -> ListA, ListB; disabled
tstat_47 = TreeStatistics(Tree=item_113)  # -> Paths, Length, Count; disabled
lng_32 = ListLength(List=dispatch_24.ListA)  # disabled
repeat_16 = RepeatData(Data=graft(cullpt_29.Points), Length=lng_32)  # disabled
cull_i_36 = CullIndex(List=tstat_47.Paths, Indices=flatten(dispatch_24.ListA), Wrap=True)  # disabled
merge_78 = Merge(Data1=cull_i_35, Data2=cull_i_34)  # disabled
branch_42 = TreeBranch(Tree=item_113, Path=cull_i_36, MaintainPaths=True)  # disabled
item_114 = ListItem(List=tstat_47.Paths, Index=flatten(dispatch_24.ListA), Wrap=True)  # disabled
sort_35 = SortList(Keys=flatten(dispatch_24.ListA), ValuesA=flatten(repeat_16))  # -> Keys, ValuesA; disabled
branch_43 = TreeBranch(Tree=item_113, Path=item_114, MaintainPaths=True)  # disabled
clone_6 = CloneStructure(List=sort_35.ValuesA, Structure=branch_43)  # disabled
merge_79 = Merge(Data1=simplify(branch_42), Data2=simplify(merge_78), Data3=simplify(clone_6))  # disabled
pline_7 = PolyLine(Vertices=merge_79, Closed=False)  # disabled
merge_80 = Merge(Data1=flatten(pline_7), Data2=flatten(rdlines_9.OutLine))  # disabled
mp_31 = Midpoint(Curve=merge_80)  # disabled
number_slider_44 = Slider(1, range=0..1)  # disabled
pdecon_47 = Deconstruct(Point=mp_31)  # -> XComponent, YComponent, ZComponent; disabled
number_slider_45 = Slider(36, range=0..100)  # disabled
number_slider_46 = Slider(18, range=0..100)  # disabled
number_slider_47 = Slider(36, range=0..100)  # disabled
sort_36 = SortList(Keys=pdecon_47.XComponent, ValuesA=merge_80)  # -> Keys, ValuesA; disabled
number_slider_48 = Slider(17, range=0..100)  # disabled
pt_13 = ConstructPoint(XCoordinate=sort_36.Keys, YCoordinate=0, ZCoordinate=0)  # disabled
cullpt_30 = CullDuplicates(Points=pt_13, Tolerance=number_slider_44, CullMode=1)  # -> Points, Indices, Valence; disabled
merge_81 = Merge(Data1=number_slider_48, Data2=number_slider_45, Data3=number_slider_46, Data4=number_slider_47)  # disabled
number_slider_49 = Slider(29, range=0..100)  # disabled
repeat_17 = RepeatData(Data=merge_81, Length=number_slider_49)  # disabled
partition_13 = PartitionList(List=sort_36.ValuesA, Size=repeat_17)  # disabled
mp_32 = Midpoint(Curve=partition_13)  # disabled
gridlines_6 = RemoteSender(partition_13)  # disabled
pdecon_48 = Deconstruct(Point=mp_32)  # -> XComponent, YComponent, ZComponent; disabled
number_slider_50 = Slider(5, range=0..10)  # disabled
number_slider_51 = Slider(9, range=0..10)  # disabled
sort_37 = SortList(Keys=pdecon_48.YComponent, ValuesA=partition_13)  # -> Keys, reverse(ValuesA); disabled
number_slider_52 = Slider(11, range=0..100)  # disabled
addition_16 = Addition(A=number_slider_52, B=1)  # disabled
end_40 = EndPoints(Curve=flatten(sort_37.ValuesA))  # -> Start, End; disabled
tstat_48 = TreeStatistics(Tree=sort_37.ValuesA)  # -> Paths, Length, Count; disabled
merge_82 = Merge(Data1=addition_16, Data2=number_slider_52)  # disabled
item_115 = ListItem(List=tstat_48.Paths, Index=merge_82, Wrap=True)  # disabled
merge_83 = Merge(Data1=end_40.Start, Data2=end_40.End)  # disabled
branch_44 = TreeBranch(Tree=sort_37.ValuesA, Path=item_115, MaintainPaths=True)  # disabled
cullpt_31 = CullDuplicates(Points=merge_83, Tolerance=0.1, CullMode=1)  # -> Points, Indices, Valence; disabled
del_14 = DelaunayMesh(Points=cullpt_31.Points, Plane=PlaneXY(0, 0, 0))  # disabled
lines_6 = RemoteSender(branch_44)  # disabled
shell_6 = RemoteSender(del_14)  # disabled

lines_6_2 = RemoteReceiver(lines_6)  # disabled
casting_6_2 = RemoteReceiver(casting_6)  # disabled
shell_6_2 = RemoteReceiver(shell_6)  # disabled
mn_6_2 = RemoteReceiver(mn_6)  # disabled
bang_37 = ExplodeTree(Data=lines_6_2)  # -> Branch0, Branch1; disabled
da_upper_row_c_7 = DynamicAnglesUpperRowCastings(
    TopLines=bang_37.Branch1,
    DiagonalLines=bang_37.Branch0,
    TopLineIndex=number_slider_29,
    DiagonalIndex=number_slider_28,
    TopAngles0=genes_32,
    TopAngles4=genes_36,
    TopAngles5=genes_33,
    TopAngles9=genes_34,
    DefAngles1=genes_37,
    DefAngles2=genes_35,
    SideAngles5=genes_31,
    DomeMesh=shell_6_2,
    Castings=casting_6_2,
    CastingFrom2Becoming6=item_102,
    CastingFrom1Becoming7=item_103,
    MachineNumber=mn_6_2,
    MoldCastings=da_upper_row_c_6.MoldedCastings)  # -> OriginalLines, ChangedPoints, ChangedLines, AnglesTop, AnglesSide, TestingPoint, Cost, AngleCost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; disabled
cluster_19 = Cluster_10(
    top_angles=da_upper_row_c_7.AnglesTop,
    castings=da_upper_row_c_7.Castings,
    cbd=da_upper_row_c_7.CastingBuildUp,
    i=number_slider_30,
    side_angles=da_upper_row_c_7.AnglesSide)  # -> B, R, side_results, side_check; disabled

crv_68 = Curve(da_upper_row_c_7.ChangedLines)  # disabled
new_lines_6 = RemoteSender(crv_68)  # disabled
dist_total_6 = RemoteSender(da_upper_row_c_7.CastingsDist)  # disabled
dist_total_7 = RemoteReceiver([dist_total_2, dist_total, dist_total_6, dist_total_3, dist_total_4, dist_total_5])  # disabled
ma_7 = MassAddition(Input=flatten(dist_total_7))  # -> Result, PartialResults; disabled
casting_7 = RemoteSender(da_upper_row_c_7.Castings)  # disabled
null_5 = NullItem(Item=da_upper_row_c_7.CastingsDist)  # -> NullFlags, InvalidFlags, Description; disabled
mn_6_3 = RemoteReceiver(mn_6)  # disabled
tstat_49 = TreeStatistics(Tree=da_upper_row_c_7.MachinedCastings)  # -> Paths, Length, Count; disabled
tstat_50 = TreeStatistics(Tree=da_upper_row_c_7.Castings)  # -> Paths, Length, Count; disabled
multiplication_33 = Multiplication(A=ma_7.Result, B=number_slider_31)  # disabled
lng_33 = ListLength(List=tstat_50.Paths)  # disabled
lng_34 = ListLength(List=tstat_49.Paths)  # disabled
flatten_6 = FlattenTree(Tree=da_upper_row_c_7.Castings, Path="{0}")  # disabled
number_slider_53 = Slider(1000, range=0..1000)  # disabled
extremums_66 = MinMax(Number=flatten_6)  # -> Minimum, Maximum; disabled
addition_17 = Addition(A=mn_6_3, B=lng_34)  # disabled
subtraction_40 = Subtraction(A=lng_33, B=lng_34, C=mn_6_3)  # disabled
smaller_13 = SmallerThan(FirstNumber=extremums_66.Minimum, SecondNumber=0)  # -> SmallerThan, OrEqualTo; disabled
filter_11 = StreamFilter(Gate=smaller_13.SmallerThan, Stream0=ma_7.Result, Stream1=multiplication_33)  # disabled
mn_7 = RemoteSender(addition_17)  # disabled
multiplication_34 = Multiplication(A=num_7, B=number_slider_53)  # disabled
multiplication_35 = Multiplication(A=filter_11, B=10)  # disabled
panel_177 = Panel(addition_17)  # disabled
panel_178 = Panel(subtraction_40)  # disabled
addition_18 = Addition(A=multiplication_35, B=subtraction_40)  # disabled
num_13 = Number(filter_3)  # disabled
multiplication_36 = Multiplication(A=num_13, B=100)  # disabled
filter_12 = StreamFilter(Gate=null_5.NullFlags, Stream0=addition_18, Stream1=multiplication_34)  # disabled
multiplication_37 = Multiplication(B=10)  # disabled
smaller_14 = SmallerThan(FirstNumber=filter_12, SecondNumber=num_13)  # -> SmallerThan, OrEqualTo; disabled
filter_13 = StreamFilter(Gate=smaller_14.SmallerThan, Stream0=filter_12, Stream1=multiplication_36)  # disabled
min_fitness_2 = Number(filter_13)  # disabled
number_slider_54 = Slider(600000, range=0..1000000)  # disabled
larger_10 = LargerThan(FirstNumber=filter_13, SecondNumber=60000000)  # -> LargerThan, OrEqualTo; disabled
filter_14 = StreamFilter(Gate=larger_10.LargerThan, Stream0=filter_13, Stream1=number_slider_54)  # disabled
null_6 = NullItem(Item=filter_14)  # -> NullFlags, InvalidFlags, Description; disabled
filter_15 = StreamFilter(Gate=null_6.NullFlags, Stream0=filter_14, Stream1=number_slider_54)  # disabled
panel_179 = Panel(filter_15)  # disabled

dist_total_8 = RemoteReceiver([dist_total_2, dist_total, dist_total_3, dist_total_4, dist_total_5, dist_total_6])
ma_8 = MassAddition(Input=flatten(dist_total_8))  # -> Result, PartialResults
null_7 = NullItem(Item=ma_8.Result)  # -> NullFlags, InvalidFlags, Description
multiplication_38 = Multiplication(A=ma_8.Result, B=100)
filter_16 = StreamFilter(Gate=smaller_5.SmallerThan, Stream0=ma_8.Result, Stream1=multiplication_38)
multiplication_39 = Multiplication(A=filter_16, B=10)
addition_19 = Addition(A=multiplication_39, B=subtraction_32)
filter_17 = StreamFilter(Gate=null_7.NullFlags, Stream0=addition_19, Stream1=multiplication_22)
smaller_15 = SmallerThan(FirstNumber=filter_17, SecondNumber=filter_3)  # -> SmallerThan, OrEqualTo
filter_18 = StreamFilter(Gate=smaller_15.SmallerThan, Stream0=filter_17, Stream1=multiplication_23)
min_fitness_3 = Number(filter_18)
panel_180 = Panel(filter_18)
dist_total_9 = RemoteReceiver([dist_total_2, dist_total, dist_total_3, dist_total_4, dist_total_5, dist_total_6])
ma_9 = MassAddition(Input=flatten(dist_total_9))  # -> Result, PartialResults
null_8 = NullItem(Item=ma_9.Result)  # -> NullFlags, InvalidFlags, Description
multiplication_40 = Multiplication(A=ma_9.Result, B=100)
filter_19 = StreamFilter(Gate=smaller_7.SmallerThan, Stream0=ma_9.Result, Stream1=multiplication_40)
multiplication_41 = Multiplication(A=filter_19, B=10)
addition_20 = Addition(A=multiplication_41, B=subtraction_34)
filter_20 = StreamFilter(Gate=null_8.NullFlags, Stream0=addition_20, Stream1=multiplication_25)
smaller_16 = SmallerThan(FirstNumber=filter_20, SecondNumber=num_8)  # -> SmallerThan, OrEqualTo
filter_21 = StreamFilter(Gate=smaller_16.SmallerThan, Stream0=filter_20, Stream1=multiplication_26)
min_fitness_4 = Number(filter_21)
larger_11 = LargerThan(FirstNumber=filter_21, SecondNumber=60000000)  # -> LargerThan, OrEqualTo
filter_22 = StreamFilter(Gate=larger_11.LargerThan, Stream0=filter_21, Stream1=number_slider_24)
null_9 = NullItem(Item=filter_22)  # -> NullFlags, InvalidFlags, Description
filter_23 = StreamFilter(Gate=null_9.NullFlags, Stream0=filter_22, Stream1=number_slider_24)
panel_181 = Panel(filter_23)

dist_total_10 = RemoteReceiver([dist_total_2, dist_total, dist_total_4, dist_total_3, dist_total_5, dist_total_6])
ma_10 = MassAddition(Input=flatten(dist_total_10))  # -> Result, PartialResults
null_10 = NullItem(Item=ma_10.Result)  # -> NullFlags, InvalidFlags, Description
multiplication_42 = Multiplication(A=ma_10.Result, B=100)
filter_24 = StreamFilter(Gate=smaller_9.SmallerThan, Stream0=ma_10.Result, Stream1=multiplication_42)
multiplication_43 = Multiplication(A=filter_24, B=10)
addition_21 = Addition(A=multiplication_43, B=subtraction_36)
filter_25 = StreamFilter(Gate=null_10.NullFlags, Stream0=addition_21, Stream1=multiplication_27)
smaller_17 = SmallerThan(FirstNumber=filter_25, SecondNumber=num_11)  # -> SmallerThan, OrEqualTo
filter_26 = StreamFilter(Gate=smaller_17.SmallerThan, Stream0=filter_25, Stream1=multiplication_28)
min_fitness_5 = Number(filter_26)
larger_12 = LargerThan(FirstNumber=filter_26, SecondNumber=60000000)  # -> LargerThan, OrEqualTo
filter_27 = StreamFilter(Gate=larger_12.LargerThan, Stream0=filter_26, Stream1=number_slider_37)
null_11 = NullItem(Item=filter_27)  # -> NullFlags, InvalidFlags, Description
filter_28 = StreamFilter(Gate=null_11.NullFlags, Stream0=filter_27, Stream1=number_slider_37)
panel_182 = Panel(filter_28)

dist_total_11 = RemoteReceiver([dist_total_2, dist_total, dist_total_5, dist_total_3, dist_total_4, dist_total_6])
ma_11 = MassAddition(Input=flatten(dist_total_11))  # -> Result, PartialResults
null_12 = NullItem(Item=ma_11.Result)  # -> NullFlags, InvalidFlags, Description
multiplication_44 = Multiplication(A=ma_11.Result, B=100)
filter_29 = StreamFilter(Gate=smaller_11.SmallerThan, Stream0=ma_11.Result, Stream1=multiplication_44)
multiplication_45 = Multiplication(A=filter_29, B=10)
addition_22 = Addition(A=multiplication_45, B=subtraction_38)
filter_30 = StreamFilter(Gate=null_12.NullFlags, Stream0=addition_22, Stream1=multiplication_30)
smaller_18 = SmallerThan(FirstNumber=filter_30, SecondNumber=num_12)  # -> SmallerThan, OrEqualTo
filter_31 = StreamFilter(Gate=smaller_18.SmallerThan, Stream0=filter_30, Stream1=multiplication_31)
min_fitness_6 = Number(filter_31)
larger_13 = LargerThan(FirstNumber=filter_31, SecondNumber=60000000)  # -> LargerThan, OrEqualTo
filter_32 = StreamFilter(Gate=larger_13.LargerThan, Stream0=filter_31, Stream1=number_slider_40)
null_13 = NullItem(Item=filter_32)  # -> NullFlags, InvalidFlags, Description
filter_33 = StreamFilter(Gate=null_13.NullFlags, Stream0=filter_32, Stream1=number_slider_40)
panel_183 = Panel(filter_33)

panel_184 = Panel(cluster_19.side_results)  # disabled
panel_185 = Panel(cluster_19.side_check)  # disabled
panel_186 = Panel(cluster_19.R)  # disabled
panel_187 = Panel(cluster_19.B)  # disabled
cull_i_37 = CullIndex(List=tstat_48.Paths, Indices=merge_82, Wrap=True)  # disabled
branch_45 = TreeBranch(Tree=sort_37.ValuesA, Path=cull_i_37, MaintainPaths=True)  # disabled

# ==== cluster Cluster_2
panel = Panel("""2
1""")
L = ClusterInput()
A = ClusterInput()
T = ClusterInput()
planes = ClusterInput()
B = ClusterInput()
cluster = Cluster(L=L, A_2=A, T=T, planes=planes, A=panel, B=B)  # -> points, i
points = ClusterOutput(cluster.points)
i = ClusterOutput(cluster.i)

# ==== cluster Cluster_6
relay = ClusterInput()
gridshell = ClusterInput()
L = ClusterInput()
L_2 = ClusterInput()
A = ClusterInput()
T = ClusterInput()
planes = ClusterInput()
B = ClusterInput()
cluster = Cluster_5(P=relay, S=relay, O=relay, gridshell=gridshell, L_2=L, L=L_2, A=A, T=T, planes=planes, B=B)  # -> L_3, L_4
L_3 = ClusterOutput(cluster.L_3)
L_4 = ClusterOutput(cluster.L_4)

# ==== cluster Cluster_7
relay = ClusterInput()
gridshell = ClusterInput()
L = ClusterInput()
A = ClusterInput()
T = ClusterInput()
planes = ClusterInput()
B = ClusterInput()
cluster = Cluster_6(relay=relay, gridshell=gridshell, L=relay, L_2=L, A=A, T=T, planes=planes, B=B)  # -> L_3, L_4
L_2 = ClusterOutput(cluster.L_3)
L_3 = ClusterOutput(cluster.L_4)

# ==== cluster Cluster_8
_0_x = ClusterInput()
_1_x = ClusterInput()
entwine = Entwine(Branch0X=_0_x, Branch1X=_1_x, FlattenInputs=False)
T = ClusterInput()
P = ClusterInput()
end = EndPoints(Curve=entwine)  # -> Start, End
R = ClusterOutput(entwine)
branch = TreeBranch(Tree=T, Path=P, MaintainPaths=True)  # -> graft(Branch)
merge = Merge(Data1=end.Start, Data2=end.End)  # -> flatten(Result)
end_2 = EndPoints(Curve=branch)  # -> Start, End
cullpt = CullDuplicates(Points=merge, Tolerance=0.1, CullMode=1)  # -> Points, Indices, Valence
merge_2 = Merge(Data1=end_2.Start, Data2=end_2.End)
number_slider = Slider(1, range=0..1)
number_slider_2 = Slider(1.54, range=0..10)
cp = ClosestPoint(Point=merge_2, Cloud=cullpt.Points)  # -> ClosestPoint, CPIndex, Distance
smaller = SmallerThan(FirstNumber=cp.Distance, SecondNumber=number_slider_2)  # -> SmallerThan, OrEqualTo
dispatch = Dispatch(List=branch, DispatchPattern=smaller.SmallerThan)  # -> ListA, ListB
crv = Curve(dispatch.ListA)
end_3 = EndPoints(Curve=crv)  # -> Start, End
merge_3 = Merge(Data1=end_3.Start, Data2=end_3.End)
cp_2 = ClosestPoint(Point=merge_3, Cloud=cullpt.Points)  # -> ClosestPoint, CPIndex, Distance
smaller_2 = SmallerThan(FirstNumber=cp_2.Distance, SecondNumber=number_slider_2)  # -> SmallerThan, OrEqualTo
dispatch_2 = Dispatch(List=merge_3, DispatchPattern=smaller_2.SmallerThan)  # -> ListA, ListB
dispatch_3 = Dispatch(List=cp_2.ClosestPoint, DispatchPattern=smaller_2.SmallerThan)  # -> ListA, ListB
ln = Line(StartPoint=dispatch_2.ListB, EndPoint=dispatch_3.ListA)
crv_2 = Curve(dispatch.ListB)
crv_3 = ClusterOutput(crv_2)
L = ClusterOutput(ln)

# ==== cluster Cluster_9
L = ClusterInput()
item = ListItem(List=L, Index=0, Wrap=True)  # -> Item, Item1, Item2, Item3
L_2 = ClusterInput()
L_3 = ClusterInput()
end = EndPoints(Curve=[item.Item2, item.Item3])  # -> Start, End
item_2 = ListItem(List=L_2, Index=0, Wrap=True)  # -> Item, Item1, Item2, Item3
cullpt = CullDuplicates(Points=end.Start, Tolerance=0.1, CullMode=1)  # -> Points, Indices, Valence
dupln = RemoveDuplicateLines(Lines=L_3, Tolerance=0.01)
mp = Midpoint(Curve=flatten([item_2.Item2, item_2.Item1, item_2.Item, item_2.Item3]))
mp_2 = Midpoint(Curve=dupln)
cp = ClosestPoint(Point=graft(mp), Cloud=flatten(mp_2))  # -> ClosestPoint, flatten(CPIndex), Distance
smaller = SmallerThan(FirstNumber=flatten(cp.Distance), SecondNumber=Slider(0.325, range=0..1))  # -> SmallerThan, OrEqualTo
dispatch = Dispatch(List=cp.CPIndex, DispatchPattern=smaller.SmallerThan)  # -> ListA, ListB
cull_i = CullIndex(List=dupln, Indices=flatten(dispatch.ListA), Wrap=True)
end_2 = EndPoints(Curve=graft(cull_i))  # -> Start, End
merge = Merge(Data1=end_2.Start, Data2=end_2.End)
cp_2 = ClosestPoint(Point=merge, Cloud=flatten(cullpt.Points))  # -> ClosestPoint, CPIndex, Distance
extremums = MinMax(Number=cp_2.Distance)  # -> Minimum, Maximum
mindex = MemberIndex(Set=cp_2.Distance, Member=extremums.Minimum)  # -> Index, Count
smaller_2 = SmallerThan(FirstNumber=extremums.Minimum, SecondNumber=Slider(0.281, range=0..1))  # -> SmallerThan, OrEqualTo
flip = FlipMatrix(Data=merge)
flip_2 = FlipMatrix(Data=cp_2.ClosestPoint)
dispatch_2 = Dispatch(List=flatten(mindex.Index), DispatchPattern=flatten(smaller_2.SmallerThan))  # -> ListA, ListB
dispatch_3 = Dispatch(List=flip_2, DispatchPattern=flatten(smaller_2.SmallerThan))  # -> ListA, ListB
dispatch_4 = Dispatch(List=flip, DispatchPattern=flatten(smaller_2.SmallerThan))  # -> ListA, ListB
flip_3 = FlipMatrix(Data=dispatch_3.ListA)
flip_4 = FlipMatrix(Data=dispatch_4.ListA)
expression = Expression(x=dispatch_2.ListA, Expression="if(x = 0, 1, 0)")
dispatch_5 = Dispatch(List=cull_i, DispatchPattern=flatten(smaller_2.SmallerThan))  # -> ListA, ListB
item_3 = ListItem(List=flip_3, Index=graft(dispatch_2.ListA), Wrap=True)
crv = Curve(cull_i)
crv_2 = Curve(dispatch_5.ListB)
item_4 = ListItem(List=flip_4, Index=graft(expression), Wrap=True)
ln = Line(StartPoint=item_3, EndPoint=item_4)
merge_2 = Merge(Data1=ln, Data2=crv_2)
R = ClusterOutput(merge_2)

# ==== cluster Cluster_10
top_angles = ClusterInput()
castings = ClusterInput()
cbd = ClusterInput()
side_angles = ClusterInput()  # SIDE ANGLES
i = ClusterInput()
top_angles_2 = Number(top_angles)
castings_2 = Number(castings)
tstat = TreeStatistics(Tree=top_angles_2)  # -> Paths, Length, Count
cbd_2 = Number(cbd)
top_angles_3 = Number(top_angles)
tstat_2 = TreeStatistics(Tree=cbd_2)  # -> Paths, Length, Count
tstat_3 = TreeStatistics(Tree=castings_2)  # -> Paths, Length, Count
item = ListItem(List=tstat.Paths, Index=i, Wrap=True)
tstat_4 = TreeStatistics(Tree=side_angles)  # -> Paths, Length, Count
item_2 = ListItem(List=tstat_2.Paths, Index=i, Wrap=True)
branch = TreeBranch(Tree=top_angles_2, Path=item, MaintainPaths=True)
item_3 = ListItem(List=tstat_4.Paths, Index=i, Wrap=True)
B = ClusterOutput(branch)
branch_2 = TreeBranch(Tree=cbd_2, Path=item_2, MaintainPaths=True)
item_4 = ListItem(List=tstat_3.Paths, Index=branch_2, Wrap=True)
branch_3 = TreeBranch(Tree=castings_2, Path=item_4, MaintainPaths=False)
branch_4 = TreeBranch(Tree=side_angles, Path=item_3, MaintainPaths=True)
item_5 = ListItem(List=branch_3, Index=0, Wrap=True)  # -> Item, Item1, flatten(Item2)
side_results = ClusterOutput(branch_4)
side_check = ClusterOutput(item_5.Item2)
panel = Panel(branch_3)
panel_2 = Panel("""1
3
4
6
8
9""")
panel_3 = Panel("""0
2
3
5
7
8""")
item_6 = ListItem(List=branch_3, Index=0, Wrap=True)  # -> flatten(Item)
item_7 = ListItem(List=branch_3, Index=1, Wrap=True)  # -> flatten(Item)
item_8 = ListItem(List=item_6, Index=panel_2, Wrap=True)
item_9 = ListItem(List=item_7, Index=panel_3, Wrap=True)
addition = Addition(A=item_8, B=item_9)
R = ClusterOutput(addition)

# ==== cluster Cluster
T = ClusterInput()
A = ClusterInput()
B = ClusterInput()
tstat = TreeStatistics(Tree=T)  # -> Paths, Length, Count
multiplication = Multiplication(A=A, B=B)
lng = ListLength(List=tstat.Length)
L = ClusterInput()
A_2 = ClusterInput()
repeat = RepeatData(Data=multiplication, Length=lng)  # -> graft(Data)
planes = ClusterInput()
finding_sets = FindingSets(L=L, A=A_2, B=repeat)  # -> R, B_2
planes_2 = RemoteReceiver(planes)
points = ClusterOutput(finding_sets.R)
deplane = DeconstructPlane(Plane=flatten(planes_2))  # -> Origin, XAxis, YAxis, ZAxis
cp = ClosestPoint(Point=graft(finding_sets.R), Cloud=deplane.Origin)  # -> ClosestPoint, CPIndex, Distance
item = ListItem(List=flatten(planes_2), Index=cp.CPIndex, Wrap=True)  # -> flatten(Item)
i = ClusterOutput(item)

# ==== cluster Cluster_5
gridshell = ClusterInput()
P = ClusterInput()
gridshell_2 = RemoteReceiver(gridshell)
meshcp = MeshClosestPoint(Point=P, Mesh=gridshell_2)  # -> Point, Index, Parameter
L = ClusterInput()
A = ClusterInput()
T = ClusterInput()
planes = ClusterInput()
B = ClusterInput()
S = ClusterInput()
meval = MeshEval(Mesh=gridshell_2, Parameter=meshcp.Parameter)  # -> Point, Normal, Colour
cluster = Cluster_4(L=L, A=A, T=T, planes=planes, B=B)  # -> points, i
O = ClusterInput()
line = LineSDL(Start=S, Direction=meval.Normal, Length=1)
L_2 = ClusterInput()
pl = PlaneNormal(Origin=O, ZAxis=line)
item = ListItem(List=L_2, Index=0, Wrap=True)
item_2 = ListItem(List=pl, Index=0, Wrap=True)
replace = ReplaceItems(List=cluster.i, Item=item_2, Indices="2", Wrap=False)
replace_2 = ReplaceItems(List=cluster.points, Item=item, Indices="2", Wrap=False)
L_3 = ClusterOutput(replace)
L_4 = ClusterOutput(replace_2)

# ==== cluster FindingSets
L = ClusterInput()
A = ClusterInput()
B = ClusterInput()
addition = Addition(A=A, B=B)
item = ListItem(List=L, Index=addition, Wrap=True)
tstat = TreeStatistics(Tree=item)  # -> Paths, Length, Count
equals = Equality(FirstNumber=tstat.Length, SecondNumber="1")  # -> Equality, Inequality
dispatch = Dispatch(List=tstat.Paths, DispatchPattern=equals.Equality)  # -> ListA, ListB
branch = TreeBranch(Tree=item, Path=dispatch.ListB, MaintainPaths=False)
branch_2 = TreeBranch(Tree=item, Path=dispatch.ListA, MaintainPaths=False)
merge = Merge(Data1=branch, Data2=branch_2)
tstat_2 = TreeStatistics(Tree=merge)  # -> Paths, Length, Count
item_2 = ListItem(List=tstat_2.Paths, Index=0, Wrap=True)  # -> Item, Item1
branch_3 = TreeBranch(Tree=merge, Path=item_2.Item, MaintainPaths=True)
end = EndPoints(Curve=branch_3)  # -> Start, End
merge_2 = Merge(Data1=end.Start, Data2=end.End)
cullpt = CullDuplicates(Points=merge_2, Tolerance=0.1, CullMode=1)  # -> Points, Indices, Valence
pdecon = Deconstruct(Point=cullpt.Points)  # -> XComponent, YComponent, ZComponent
sort = SortList(Keys=pdecon.ZComponent, ValuesA=cullpt.Points)  # -> Keys, ValuesA
partition = PartitionList(List=sort.ValuesA, Size="2")
pdecon_2 = Deconstruct(Point=partition)  # -> XComponent, YComponent, ZComponent
sort_2 = SortList(Keys=pdecon_2.YComponent, ValuesA=partition)  # -> Keys, ValuesA
item_3 = ListItem(List=sort_2.ValuesA, Index=0, Wrap=True)  # -> flatten(Item), flatten(Item1)
B_2 = ClusterOutput(branch_3)
merge_3 = Merge(Data1=reverse(item_3.Item), Data2=reverse(item_3.Item1))  # -> flatten(Result)
R = ClusterOutput(merge_3)

# ==== cluster Cluster_4
panel = Panel("""2
1""")
L = ClusterInput()
A = ClusterInput()
T = ClusterInput()
planes = ClusterInput()
B = ClusterInput()
cluster = Cluster_3(L=L, A_2=A, T=T, planes=planes, A=panel, B=B)  # -> points, i
points = ClusterOutput(cluster.points)
i = ClusterOutput(cluster.i)

# ==== cluster Cluster_3
T = ClusterInput()
A = ClusterInput()
B = ClusterInput()
tstat = TreeStatistics(Tree=T)  # -> Paths, Length, Count
multiplication = Multiplication(A=A, B=B)
lng = ListLength(List=tstat.Length)
L = ClusterInput()
A_2 = ClusterInput()
repeat = RepeatData(Data=multiplication, Length=lng)  # -> graft(Data)
planes = ClusterInput()
finding_sets = FindingSets_2(L=L, A=A_2, B=repeat)  # -> R, B_2
planes_2 = RemoteReceiver(planes)
points = ClusterOutput(finding_sets.R)
deplane = DeconstructPlane(Plane=flatten(planes_2))  # -> Origin, XAxis, YAxis, ZAxis
cp = ClosestPoint(Point=graft(finding_sets.R), Cloud=deplane.Origin)  # -> ClosestPoint, CPIndex, Distance
item = ListItem(List=flatten(planes_2), Index=cp.CPIndex, Wrap=True)  # -> flatten(Item)
i = ClusterOutput(item)

# ==== cluster FindingSets_2
L = ClusterInput()
A = ClusterInput()
B = ClusterInput()
addition = Addition(A=A, B=B)
item = ListItem(List=L, Index=addition, Wrap=True)
tstat = TreeStatistics(Tree=item)  # -> Paths, Length, Count
equals = Equality(FirstNumber=tstat.Length, SecondNumber="1")  # -> Equality, Inequality
dispatch = Dispatch(List=tstat.Paths, DispatchPattern=equals.Equality)  # -> ListA, ListB
branch = TreeBranch(Tree=item, Path=dispatch.ListB, MaintainPaths=False)
branch_2 = TreeBranch(Tree=item, Path=dispatch.ListA, MaintainPaths=False)
merge = Merge(Data1=branch, Data2=branch_2)
tstat_2 = TreeStatistics(Tree=merge)  # -> Paths, Length, Count
item_2 = ListItem(List=tstat_2.Paths, Index=0, Wrap=True)
branch_3 = TreeBranch(Tree=merge, Path=item_2, MaintainPaths=True)
end = EndPoints(Curve=branch_3)  # -> Start, End
merge_2 = Merge(Data1=end.Start, Data2=end.End)
cullpt = CullDuplicates(Points=merge_2, Tolerance=0.1, CullMode=1)  # -> Points, Indices, Valence
pdecon = Deconstruct(Point=cullpt.Points)  # -> XComponent, YComponent, ZComponent
sort = SortList(Keys=pdecon.ZComponent, ValuesA=cullpt.Points)  # -> Keys, ValuesA
partition = PartitionList(List=sort.ValuesA, Size="2")
pdecon_2 = Deconstruct(Point=partition)  # -> XComponent, YComponent, ZComponent
sort_2 = SortList(Keys=pdecon_2.YComponent, ValuesA=partition)  # -> Keys, ValuesA
item_3 = ListItem(List=sort_2.ValuesA, Index=0, Wrap=True)  # -> flatten(Item), flatten(Item1)
B_2 = ClusterOutput(branch_3)
merge_3 = Merge(Data1=reverse(item_3.Item), Data2=reverse(item_3.Item1))  # -> flatten(Result)
R = ClusterOutput(merge_3)
